# Grasshopper definition KleinSurface_001.gh (Grasshopper 1.0.7)

# Architectural Parametric
# Digital Assets
# gpt-4 into ghpython node
# #Text prompting in GPT-4 at www.wickersonstudios.com
number_slider = Slider(0.1, range=0.1..10)
# Klein Surface
ghpython_script = GhPythonScript(u_step=number_slider, v_step=Slider(0.1, range=0.1..10), scale=Slider(3, range=0.1..3))  # -> out, a
# ---------- ghpython_script: Python ----------
#Text prompting in GPT-4 at www.wickersonstudios.com

import math
import Rhino.Geometry as rg

def frange(start, stop, step):
    i = start
    while i < stop:
        yield i
        i += step

def klein(u, v, scale):
    half = (0 <= u <= math.pi)
    r = 4 * (1 - math.cos(u) / 2 if half else math.sin(u))
    phi = v / 2 if half else v
    x = scale * r * math.cos(phi)
    y = scale * r * math.sin(phi)
    z = scale * (-math.sin(u) if half else -3 * math.cos(u))
    return rg.Point3d(x, y, z)

# Create 2D list of points
points = [[klein(u, v, scale) for v in frange(0, 2*math.pi, v_step)] for u in frange(0, 2*math.pi, u_step)]

# The number of points in the u and v directions
uCount = len(points)
vCount = len(points[0]) if points else 0

# Create mesh
mesh = rg.Mesh()

# Add vertices to mesh
for row in points:
    for point in row:
        mesh.Vertices.Add(point)

# Create faces
for i in range(uCount - 1):
    for j in range(vCount - 1):
        mesh.Faces.AddFace(i*vCount + j, i*vCount + j + 1, (i+1)*vCount + j + 1, (i+1)*vCount + j)

# Output
a = mesh
# ---------- end ghpython_script ----------
# Klein Surface
ghpython_script_2 = GhPythonScript(u_step=Slider(0.1, range=0.1..10), v_step=Slider(0.1, range=0.1..10), scale=Slider(3, range=0.1..3))  # -> out, a
# ---------- ghpython_script_2: Python ----------
#Text prompting in GPT-4 at www.wickersonstudios.com

import math
import Rhino.Geometry as rg

def frange(start, stop, step):
    i = start
    while i < stop:
        yield i
        i += step

def klein(u, v, scale):
    if (0 <= u < math.pi):
        x = 3 * math.cos(u) * (1 + math.sin(u)) + (2 * (1 - math.cos(u) / 2)) * math.cos(u) * math.cos(v)
        y = 8 * math.sin(u) + (2 * (1 - math.cos(u) / 2)) * math.sin(u) * math.cos(v)
        z = -2 * (1 - math.cos(u) / 2) * math.sin(v)
    else:
        x = 3 * math.cos(u) * (1 + math.sin(u)) + (2 * (1 - math.cos(u) / 2)) * math.cos(v + math.pi)
        y = 8 * math.sin(u)
        z = -2 * (1 - math.cos(u) / 2) * math.sin(v)

    return rg.Point3d(scale * x, scale * y, scale * z)

# Create 2D list of points
points = [[klein(u, v, scale) for v in frange(0, 2*math.pi, v_step)] for u in frange(0, 2*math.pi, u_step)]

# The number of points in the u and v directions
uCount = len(points)
vCount = len(points[0]) if points else 0

# Create mesh
mesh = rg.Mesh()

# Add vertices to mesh
for row in points:
    for point in row:
        mesh.Vertices.Add(point)

# Create faces
for i in range(uCount - 1):
    for j in range(vCount - 1):
        mesh.Faces.AddFace(i*vCount + j, i*vCount + j + 1, (i+1)*vCount + j + 1, (i+1)*vCount + j)

# Output
a = mesh
# ---------- end ghpython_script_2 ----------
# Klein Surface
ghpython_script_3 = GhPythonScript(u_step=Slider(0.1, range=0.1..10), v_step=Slider(0.1, range=0.1..10), scale=Slider(3, range=0.1..3))  # -> out, a
# ---------- ghpython_script_3: Python ----------
#Text prompting in GPT-4 at www.wickersonstudios.com

import math
import Rhino.Geometry as rg

def frange(start, stop, step):
    i = start
    while i <= stop:  # Include the stop value
        yield i
        i += step

def klein(u, v, scale):
    if (0 <= u < math.pi):
        x = 3 * math.cos(u) * (1 + math.sin(u)) + (2 * (1 - math.cos(u) / 2)) * math.cos(u) * math.cos(v)
        y = 8 * math.sin(u) + (2 * (1 - math.cos(u) / 2)) * math.sin(u) * math.cos(v)
        z = -2 * (1 - math.cos(u) / 2) * math.sin(v)
    else:
        x = 3 * math.cos(u) * (1 + math.sin(u)) + (2 * (1 - math.cos(u) / 2)) * math.cos(v + math.pi)
        y = 8 * math.sin(u)
        z = -2 * (1 - math.cos(u) / 2) * math.sin(v)

    return rg.Point3d(scale * x, scale * y, scale * z)

# Create 2D list of points
points = [[klein(u, v, scale) for v in frange(0, 2*math.pi, v_step)] for u in frange(0, 2*math.pi, u_step)]

# The number of points in the u and v directions
uCount = len(points)
vCount = len(points[0]) if points else 0

# Create mesh
mesh = rg.Mesh()

# Add vertices to mesh
for row in points:
    for point in row:
        mesh.Vertices.Add(point)

# Create faces
for i in range(uCount):
    for j in range(vCount):
        mesh.Faces.AddFace((i % uCount)*vCount + j, (i % uCount)*vCount + (j + 1) % vCount, ((i + 1) % uCount)*vCount + (j + 1) % vCount, ((i + 1) % uCount)*vCount + j)

# Output
a = mesh
# ---------- end ghpython_script_3 ----------
# Klein Surface
ghpython_script_4 = GhPythonScript(u_step=Slider(0.1, range=0.1..10), v_step=Slider(0.1, range=0.1..10), scale=Slider(3, range=0.1..3))  # -> out, a
# ---------- ghpython_script_4: Python ----------
#Text prompting in GPT-4 at www.wickersonstudios.com

import math
import Rhino.Geometry as rg

def frange(start, stop, step):
    i = start
    while i < stop:
        yield i
        i += step

def klein(u, v, scale):
    if (0 <= u < math.pi):
        x = 3 * math.cos(u) * (1 + math.sin(u)) + (2 * (1 - math.cos(u) / 2)) * math.cos(u) * math.cos(v)
        y = 8 * math.sin(u) + (2 * (1 - math.cos(u) / 2)) * math.sin(u) * math.cos(v)
        z = -2 * (1 - math.cos(u) / 2) * math.sin(v)
    else:
        x = 3 * math.cos(u) * (1 + math.sin(u)) + (2 * (1 - math.cos(u) / 2)) * math.cos(v + math.pi)
        y = 8 * math.sin(u)
        z = -2 * (1 - math.cos(u) / 2) * math.sin(v)

    return rg.Point3d(scale * x, scale * y, scale * z)

# Create 2D list of points
points = [[klein(u, v, scale) for v in frange(0, 2*math.pi, v_step)] for u in frange(0, 2*math.pi, u_step)]
points = [row if i % 2 == 0 else row[::-1] for i, row in enumerate(points)]  # Reverse the order of every other row

# The number of points in the u and v directions
uCount = len(points)
vCount = len(points[0]) if points else 0

# Create mesh
mesh = rg.Mesh()

# Add vertices to mesh
for row in points:
    for point in row:
        mesh.Vertices.Add(point)

# Create faces
for i in range(uCount - 1):
    for j in range(vCount - 1):
        mesh.Faces.AddFace(i*vCount + j, i*vCount + j + 1, (i+1)*vCount + j + 1, (i+1)*vCount + j)

# Output
a = mesh
# ---------- end ghpython_script_4 ----------
# Klein Surface
ghpython_script_5 = GhPythonScript(u_step=Slider(0.1, range=0.1..10), v_step=Slider(0.1, range=0.1..10), scale=Slider(3, range=0.1..3))  # -> out, a; same code as ghpython_script_2
# Klein Surface
ghpython_script_6 = GhPythonScript(u_step=Slider(0.1, range=0.1..10), v_step=Slider(0.1, range=0.1..10), scale=Slider(3, range=0.1..3))  # -> out, a
# ---------- ghpython_script_6: Python ----------
#Text prompting in GPT-4 at www.wickersonstudios.com

import math
import Rhino.Geometry as rg

def frange(start, stop, step):
    i = start
    while i < stop:
        yield i
        i += step

def klein(u, v, scale):
    if (0 <= u < math.pi):
        x = 3 * math.cos(u) * (1 + math.sin(u)) + (2 * (1 - math.cos(u) / 2)) * math.cos(u) * math.cos(v)
        y = 8 * math.sin(u) + (2 * (1 - math.cos(u) / 2)) * math.sin(u) * math.cos(v)
        z = -2 * (1 - math.cos(u) / 2) * math.sin(v)
    else:
        x = 3 * math.cos(u) * (1 + math.sin(u)) + (2 * (1 - math.cos(u) / 2)) * math.cos(v + math.pi)
        y = 8 * math.sin(u)
        z = -2 * (1 - math.cos(u) / 2) * math.sin(v)

    return rg.Point3d(scale * x, scale * y, scale * z)

# Create 2D list of points
points = [[klein(u, v, scale) for v in frange(0, 2*math.pi, v_step)] for u in frange(0, 2*math.pi, u_step)]

# Make last row coincide with the first one
points[-1] = points[0]

# Make last column coincide with the first one
for row in points:
    row[-1] = row[0]

# The number of points in the u and v directions
uCount = len(points)
vCount = len(points[0]) if points else 0

# Create mesh
mesh = rg.Mesh()

# Add vertices to mesh
for row in points:
    for point in row:
        mesh.Vertices.Add(point)

# Create faces
for i in range(uCount - 1):
    for j in range(vCount - 1):
        mesh.Faces.AddFace(i*vCount + j, i*vCount + j + 1, (i+1)*vCount + j + 1, (i+1)*vCount + j)

# Output
a = mesh
# ---------- end ghpython_script_6 ----------
geometry = Geometry(ghpython_script.a)
geometry_2 = Geometry(ghpython_script_2.a)
geometry_3 = Geometry(ghpython_script_3.a)
geometry_4 = Geometry(ghpython_script_4.a)
geometry_5 = Geometry(ghpython_script_5.a)
geometry_6 = Geometry(ghpython_script_6.a)
