# Grasshopper definition Lattice_001.gh (Grasshopper 1.0.7)
# plug-ins: Kangaroo2 Components

ghpython_script = GhPythonScript()  # -> out, a, b
# ---------- ghpython_script: Python ----------
import Rhino.Geometry as rg
import math

# Input parameters
size = 10.0  # Size of the lattice
spacing = 1.0  # Spacing between lattice points
amplitude = 5.0  # Amplitude of the trigonometric function
frequency = 1.0  # Frequency of the trigonometric function

# Generate lattice points
points = []
for i in range(int(size/spacing)):
    for j in range(int(size/spacing)):
        x = i * spacing
        y = j * spacing
        z = amplitude * math.sin(frequency * (x + y))
        points.append(rg.Point3d(x, y, z))

# Generate lattice lines
lines = []
for i in range(len(points)):
    for j in range(i+1, len(points)):
        dist = points[i].DistanceTo(points[j])
        if dist <= spacing * math.sqrt(2):
            lines.append(rg.Line(points[i], points[j]))

# Output the lattice points and lines
a = points
b = lines
# ---------- end ghpython_script ----------
ghpython_script_2 = GhPythonScript()  # -> out, a, b
# ---------- ghpython_script_2: Python ----------
import Rhino.Geometry as rg
import math

# Input parameters
size = 15.0  # Size of the lattice
spacing = 1.5  # Spacing between lattice points
amplitude = 8.0  # Amplitude of the trigonometric function
frequency = 3.0  # Frequency of the trigonometric function
rotation_angle = math.radians(45)  # Rotation angle for the lattice structure

# Generate lattice points
points = []
for i in range(int(size/spacing)):
    for j in range(int(size/spacing)):
        x = i * spacing
        y = j * spacing
        z = amplitude * math.sin(frequency * (x + y))
        points.append(rg.Point3d(x, y, z))

# Calculate centroid
centroid = rg.Point3d(0, 0, 0)
for point in points:
    centroid += point
centroid /= len(points)

# Rotate the lattice points around centroid
rotation_axis = rg.Vector3d(0, 0, 1)
rotation = rg.Transform.Rotation(rotation_angle, rotation_axis, centroid)
for i in range(len(points)):
    points[i].Transform(rotation)

# Generate lattice lines
lines = []
for i in range(len(points)):
    for j in range(i+1, len(points)):
        dist = points[i].DistanceTo(points[j])
        if dist <= spacing * math.sqrt(2):
            lines.append(rg.Line(points[i], points[j]))

# Output the lattice points and lines
a = points
b = lines
# ---------- end ghpython_script_2 ----------
ghpython_script_3 = GhPythonScript()  # -> out, a, b
# ---------- ghpython_script_3: Python ----------
import Rhino.Geometry as rg
import math

# Input parameters
size = 15.0  # Size of the lattice
spacing = 1.5  # Spacing between lattice points
amplitude = 8.0  # Amplitude of the trigonometric function
frequency = 3.0  # Frequency of the trigonometric function
rotation_angles = [math.radians(45), math.radians(60), math.radians(30)]  # Rotation angles for the lattice structure

# Generate lattice points
points = []
for i in range(int(size/spacing)):
    for j in range(int(size/spacing)):
        x = i * spacing
        y = j * spacing
        z = 0.0
        for angle in rotation_angles:
            z += amplitude * math.sin(frequency * (x * math.cos(angle) + y * math.sin(angle)))
        points.append(rg.Point3d(x, y, z))

# Generate lattice lines
lines = []
for i in range(len(points)):
    for j in range(i+1, len(points)):
        dist = points[i].DistanceTo(points[j])
        if dist <= spacing * math.sqrt(2):
            lines.append(rg.Line(points[i], points[j]))

# Output the lattice points and lines
a = points
b = lines
# ---------- end ghpython_script_3 ----------
# gpt-4 into ghpython node
# #Text prompting in GPT-4 at www.wickersonstudios.com
# Lattice
geometry = Geometry(ghpython_script.a)
geometry_2 = Geometry(ghpython_script.b)
geometry_3 = Geometry(ghpython_script_2.a)
geometry_4 = Geometry(ghpython_script_2.b)
geometry_5 = Geometry(ghpython_script_3.a)
geometry_6 = Geometry(ghpython_script_3.b)
number_slider = Slider(30, range=0..100)
series = Series(Start=number_slider, Step=number_slider, Count=Slider(3, range=0..10))
ghpython_script_4 = GhPythonScript(
    x_size=Slider(149.781, range=1..400),
    x_spacing=Slider(18, range=10..50),
    x_amplitude=Slider(5.129, range=0..20),
    x_frequency=Slider(48.661, range=1..100),
    x_rotation_angles=series)  # -> out, a, b; inputs x_spacing: Int32, x_rotation_angles: list
# ---------- ghpython_script_4: Python ----------
import Rhino.Geometry as rg
import math

# Input parameters
size = float(x_size)  # Size of the lattice (input parameter)
spacing = float(x_spacing)  # Spacing between lattice points (input parameter)
amplitude = float(x_amplitude)  # Amplitude of the trigonometric function (input parameter)
frequency = float(x_frequency)  # Frequency of the trigonometric function (input parameter)
rotation_angles = [math.radians(angle) for angle in x_rotation_angles]  # Rotation angles for the lattice structure (input parameter)

# Generate lattice points
points = []
for i in range(int(size/spacing)):
    for j in range(int(size/spacing)):
        x = i * spacing
        y = j * spacing
        z = 0.0
        for angle in rotation_angles:
            z += amplitude * math.sin(frequency * (x * math.cos(angle) + y * math.sin(angle)))
        points.append(rg.Point3d(x, y, z))

# Generate lattice lines
lines = []
for i in range(len(points)):
    for j in range(i+1, len(points)):
        dist = points[i].DistanceTo(points[j])
        if dist <= spacing * math.sqrt(2):
            lines.append(rg.Line(points[i], points[j]))

# Output the lattice points and lines
a = points  # Lattice points (output variable)
b = lines  # Lattice lines (output variable)
# ---------- end ghpython_script_4 ----------
panel = Panel(series)
geometry_7 = Geometry(ghpython_script_4.b)
geometry_8 = Geometry(ghpython_script_4.a)
multipipe = MultiPipe(
    Curves=geometry_7,
    NodeSize=Slider(1.34, range=0..10),
    EndOffset=1,
    StrutSize=1,
    Segment=0,
    KinkAngle=0.6,
    CubeFit=0,
    Caps=0)
