# Grasshopper definition Tree_001.gh (Grasshopper 1.0.7)

# seashell
seashell = GhPythonScript(
    r=Slider(5.419, range=0..20),
    a=Slider(0.32, range=0..1),
    turns=Slider(1, range=0..10),
    segments=Slider(100, range=0..100),
    h=Slider(29.65, range=0..100))  # -> out, a; inputs turns: Int32, segments: Int32
# ---------- seashell: Python ----------
import Rhino.Geometry as rg
import math

# Inputs:
# r - initial radius
# a - growth factor
# turns - number of spiral turns
# segments - number of segments per turn
# h - height

def CreateShell(r, a, turns, segments, h):
    points = [] # list to store the points

    for i in range(turns * segments):
        # angle in radians
        angle = i * math.pi * 2 / segments
        # radius of current turn
        radius = r * math.exp(a * angle)
        # x and y coordinates of the point on the plane
        x = radius * math.cos(angle)
        y = radius * math.sin(angle)
        # z coordinate gradually increasing
        z = h * angle / (turns * math.pi * 2)
        # add the point to the list
        points.append(rg.Point3d(x, y, z))

    # create the polyline curve
    curve = rg.PolylineCurve(points)
    return curve

# Call the function with some example values
shell_curve = CreateShell(r, a, turns, segments, h)

# Output the result
a = shell_curve
# ---------- end seashell ----------
# seashell
seashell_2 = GhPythonScript(
    r=Slider(1.796, range=0..20),
    a=Slider(0.08, range=0..1),
    turns=Slider(7, range=0..10),
    segments=Slider(10, range=0..100),
    h=Slider(100, range=0..100),
    b=Slider(0.14, range=0..1),
    c=Slider(8, range=0..10))  # -> out, a; inputs turns: Int32, segments: Int32
# ---------- seashell_2: Python ----------
import Rhino.Geometry as rg
import math

# Inputs:
# r - initial radius
# a - growth factor
# turns - number of spiral turns
# segments - number of segments per turn
# h - height
# b - radius oscillation factor
# c - oscillation speed

def CreateShell(r, a, turns, segments, h, b, c):
    points = [] # list to store the points

    for i in range(turns * segments):
        # angle in radians
        angle = i * math.pi * 2 / segments
        # radius of current turn with oscillation
        radius = (r * math.exp(a * angle)) * (1 + b * math.cos(c * angle))
        # x and y coordinates of the point on the plane
        x = radius * math.cos(angle)
        y = radius * math.sin(angle)
        # z coordinate gradually increasing
        z = h * angle / (turns * math.pi * 2)
        # add the point to the list
        points.append(rg.Point3d(x, y, z))

    # create the polyline curve
    curve = rg.PolylineCurve(points)
    return curve

# Call the function with some example values
shell_curve = CreateShell(r, a, turns, segments, h, b, c)

# Output the result
a = shell_curve
# ---------- end seashell_2 ----------
# seashell
seashell_3 = GhPythonScript(
    r=Slider(1.796, range=0..20),
    a=Slider(0.08, range=0..1),
    turns=Slider(6, range=0..10),
    segments=Slider(45, range=0..100),
    h=Slider(63.9, range=0..100),
    b=Slider(0.13, range=0..1),
    c=Slider(6, range=0..10),
    s=Slider(1, range=0..1))  # -> out, a; inputs turns: Int32, segments: Int32
# ---------- seashell_3: Python ----------
import Rhino.Geometry as rg
import math

# Inputs:
# r - initial radius
# a - growth factor
# turns - number of spiral turns
# segments - number of segments per turn
# h - height
# b - radius oscillation factor
# c - oscillation speed
# s - scale factor for curve oscillation

def CreateShell(r, a, turns, segments, h, b, c, s):
    curves = [] # list to store the curves

    for j in range(-10, 11, 5): # generate a series of curves
        points = [] # list to store the points

        for i in range(turns * segments):
            # angle in radians
            angle = i * math.pi * 2 / segments
            # radius of current turn with oscillation
            radius = (r * math.exp(a * angle)) * (1 + b * math.cos(c * angle))
            # x and y coordinates of the point on the plane
            x = radius * math.cos(angle)
            y = radius * math.sin(angle)
            # z coordinate gradually increasing
            z = h * angle / (turns * math.pi * 2)
            # add the point to the list, adding an oscillation to the z-coordinate
            points.append(rg.Point3d(x, y, z + j * s * math.sin(i / 10.0)))

        # create the polyline curve and add it to the list
        curves.append(rg.PolylineCurve(points))

    # loft the curves to create a surface
    shell_surface = rg.Brep.CreateFromLoft(curves, rg.Point3d.Unset, rg.Point3d.Unset, rg.LoftType.Normal, False)

    return shell_surface

# Call the function with some example values
shell_surface = CreateShell(r, a, turns, segments, h, b, c, s)

# Output the result
a = shell_surface
# ---------- end seashell_3 ----------
geometry = Geometry(seashell_3.a)
geometry_2 = Geometry(seashell.a)
geometry_3 = Geometry(seashell_2.a)
