# Grasshopper definition chair_001.gh (Grasshopper 1.0.7)

# Parametric Chair
ghpython_script = GhPythonScript()  # -> out, a
# ---------- ghpython_script: Python ----------
import rhinoscriptsyntax as rs
import scriptcontext as sc
import Rhino.Geometry as rg

def create_chair(width, depth, height):
    # Create chair seat
    seat_plane = rs.WorldXYPlane()
    seat_corner = rs.PointAdd(seat_plane.Origin, rg.Vector3d(-width/2, -depth/2, 0) * height/10)
    seat_box = rg.Box(rg.Plane(seat_corner, rg.Vector3d.XAxis, rg.Vector3d.YAxis), rg.Interval(0, width), rg.Interval(0, depth), rg.Interval(0, height/10))
    seat_brep = rg.Brep.CreateFromBox(seat_box)
    seat = sc.doc.Objects.AddBrep(seat_brep)

    # Create chair backrest
    backrest_width = width * 0.9
    backrest_height = height * 0.9
    backrest_plane = rs.MovePlane(seat_plane, rg.Vector3d(0, 0, height/10 + backrest_height/2))
    backrest_corner = rs.PointAdd(backrest_plane.Origin, rg.Vector3d(-backrest_width/2, 0, -backrest_height/2))
    backrest_box = rg.Box(rg.Plane(backrest_corner, rg.Vector3d.XAxis, rg.Vector3d.YAxis), rg.Interval(0, backrest_width), rg.Interval(0, depth/10), rg.Interval(0, backrest_height))
    backrest_brep = rg.Brep.CreateFromBox(backrest_box)
    backrest = sc.doc.Objects.AddBrep(backrest_brep)

    # Create chair legs
    leg_width = width / 10
    leg_depth = depth / 10
    leg_height = height - (height/10 + backrest_height)

    leg1_plane = rs.MovePlane(seat_plane, rg.Vector3d(-width/2 + leg_width/2, -depth/2 + leg_depth/2, height/10 + backrest_height + leg_height/2))
    leg1_corner = rs.PointAdd(leg1_plane.Origin, rg.Vector3d(0, 0, -leg_height/2))
    leg1_box = rg.Box(rg.Plane(leg1_corner, rg.Vector3d.XAxis, rg.Vector3d.YAxis), rg.Interval(0, leg_width), rg.Interval(0, leg_depth), rg.Interval(0, leg_height))
    leg1_brep = rg.Brep.CreateFromBox(leg1_box)
    leg1 = sc.doc.Objects.AddBrep(leg1_brep)

    leg2_plane = rs.MovePlane(seat_plane, rg.Vector3d(-width/2 + leg_width/2, depth/2 - leg_depth/2, height/10 + backrest_height + leg_height/2))
    leg2_corner = rs.PointAdd(leg2_plane.Origin, rg.Vector3d(0, 0, -leg_height/2))
    leg2_box = rg.Box(rg.Plane(leg2_corner, rg.Vector3d.XAxis, rg.Vector3d.YAxis), rg.Interval(0, leg_width), rg.Interval(0, leg_depth), rg.Interval(0, leg_height))
    leg2_brep = rg.Brep.CreateFromBox(leg2_box)
    leg2 = sc.doc.Objects.AddBrep(leg2_brep)

    leg3_plane = rs.MovePlane(seat_plane, rg.Vector3d(width/2 - leg_width/2, -depth/2 + leg_depth/2, height/10 + backrest_height + leg_height/2))
    leg3_corner = rs.PointAdd(leg3_plane.Origin, rg.Vector3d(0, 0, -leg_height/2))
    leg3_box = rg.Box(rg.Plane(leg3_corner, rg.Vector3d.XAxis, rg.Vector3d.YAxis), rg.Interval(0, leg_width), rg.Interval(0, leg_depth), rg.Interval(0, leg_height))
    leg3_brep = rg.Brep.CreateFromBox(leg3_box)
    leg3 = sc.doc.Objects.AddBrep(leg3_brep)

    leg4_plane = rs.MovePlane(seat_plane, rg.Vector3d(width/2 - leg_width/2, depth/2 - leg_depth/2, height/10 + backrest_height + leg_height/2))
    leg4_corner = rs.PointAdd(leg4_plane.Origin, rg.Vector3d(0, 0, -leg_height/2))
    leg4_box = rg.Box(rg.Plane(leg4_corner, rg.Vector3d.XAxis, rg.Vector3d.YAxis), rg.Interval(0, leg_width), rg.Interval(0, leg_depth), rg.Interval(0, leg_height))
    leg4_brep = rg.Brep.CreateFromBox(leg4_box)
    leg4 = sc.doc.Objects.AddBrep(leg4_brep)

    # Join all chair parts
    chair_parts = [seat_brep, backrest_brep, leg1_brep, leg2_brep, leg3_brep, leg4_brep]
    chair = rg.Brep.JoinBreps(chair_parts, sc.doc.ModelAbsoluteTolerance)
    if chair:
        chair = chair[0]

    return chair

# Input parameters
chair_width = 1.0  # Width of the chair
chair_depth = 0.8  # Depth of the chair
chair_height = 1.2  # Height of the chair

# Create chair
chair = create_chair(chair_width, chair_depth, chair_height)

# Output the chair
a = chair
# ---------- end ghpython_script ----------
# Parametric Chair
ghpython_script_2 = GhPythonScript()  # -> out, a
# ---------- ghpython_script_2: Python ----------
import rhinoscriptsyntax as rs
import scriptcontext as sc
import Rhino.Geometry as rg

def create_chair(width, depth, height):
    # Create chair seat
    seat_plane = rs.WorldXYPlane()
    seat_corner = rs.PointAdd(seat_plane.Origin, rs.VectorCreate([-width/2, -depth/2, 0], [0, 0, height/10]))
    seat_box = rg.Box(rg.Plane(seat_corner, rs.VectorCreate([1, 0, 0]), rs.VectorCreate([0, 1, 0])), width, depth, height/10)
    seat = rs.AddBrep(seat_box)

    # Create chair backrest
    backrest_width = width * 0.9
    backrest_height = height * 0.9
    backrest_plane = rs.MovePlane(seat_plane, rs.VectorCreate([0, 0, height/10 + backrest_height/2], [0, 0, 1]))
    backrest_corner = rs.PointAdd(backrest_plane.Origin, rs.VectorCreate([-backrest_width/2, 0, -backrest_height/2], [0, 1, 0]))
    backrest_box = rg.Box(rg.Plane(backrest_corner, rs.VectorCreate([1, 0, 0]), rs.VectorCreate([0, 1, 0])), backrest_width, depth/10, backrest_height)
    backrest = rs.AddBrep(backrest_box)

    # Create chair legs
    leg_width = width / 10
    leg_depth = depth / 10
    leg_height = height - (height/10 + backrest_height)

    leg1_plane = rs.MovePlane(seat_plane, rs.VectorCreate([-width/2 + leg_width/2, -depth/2 + leg_depth/2, height/10 + backrest_height + leg_height/2], [0, 0, 1]))
    leg1_corner = rs.PointAdd(leg1_plane.Origin, rs.VectorCreate([0, 0, -leg_height/2], [0, 0, 1]))
    leg1_box = rg.Box(rg.Plane(leg1_corner, rs.VectorCreate([1, 0, 0]), rs.VectorCreate([0, 1, 0])), leg_width, leg_depth, leg_height)
    leg1 = rs.AddBrep(leg1_box)

    leg2_plane = rs.MovePlane(seat_plane, rs.VectorCreate([-width/2 + leg_width/2, depth/2 - leg_depth/2, height/10 + backrest_height + leg_height/2], [0, 0, 1]))
    leg2_corner = rs.PointAdd(leg2_plane.Origin, rs.VectorCreate([0, 0, -leg_height/2], [0, 0, 1]))
    leg2_box = rg.Box(rg.Plane(leg2_corner, rs.VectorCreate([1, 0, 0]), rs.VectorCreate([0, 1, 0])), leg_width, leg_depth, leg_height)
    leg2 = rs.AddBrep(leg2_box)

    leg3_plane = rs.MovePlane(seat_plane, rs.VectorCreate([width/2 - leg_width/2, -depth/2 + leg_depth/2, height/10 + backrest_height + leg_height/2], [0, 0, 1]))
    leg3_corner = rs.PointAdd(leg3_plane.Origin, rs.VectorCreate([0, 0, -leg_height/2], [0, 0, 1]))
    leg3_box = rg.Box(rg.Plane(leg3_corner, rs.VectorCreate([1, 0, 0]), rs.VectorCreate([0, 1, 0])), leg_width, leg_depth, leg_height)
    leg3 = rs.AddBrep(leg3_box)

    leg4_plane = rs.MovePlane(seat_plane, rs.VectorCreate([width/2 - leg_width/2, depth/2 - leg_depth/2, height/10 + backrest_height + leg_height/2], [0, 0, 1]))
    leg4_corner = rs.PointAdd(leg4_plane.Origin, rs.VectorCreate([0, 0, -leg_height/2], [0, 0, 1]))
    leg4_box = rg.Box(rg.Plane(leg4_corner, rs.VectorCreate([1, 0, 0]), rs.VectorCreate([0, 1, 0])), leg_width, leg_depth, leg_height)
    leg4 = rs.AddBrep(leg4_box)

    # Join all chair parts
    chair_parts = [seat, backrest, leg1, leg2, leg3, leg4]
    chair = rs.JoinBreps(chair_parts)

    return chair

# Input parameters
chair_width = 1.0  # Width of the chair
chair_depth = 0.8  # Depth of the chair
chair_height = 1.2  # Height of the chair

# Create chair
chair = create_chair(chair_width, chair_depth, chair_height)

# Output the chair
a = chair
# ---------- end ghpython_script_2 ----------
# Parametric Chair
ghpython_script_3 = GhPythonScript()  # -> out, a
# ---------- ghpython_script_3: Python ----------
import rhinoscriptsyntax as rs
import scriptcontext as sc
import Rhino.Geometry as rg

def create_chair(width, depth, height):
    # Create chair seat
    seat_plane = rs.WorldXYPlane()
    seat_corner = rs.PointAdd(seat_plane.Origin, rs.VectorCreate([-width/2, -depth/2, 0], [0, 0, height/10]))
    seat = rs.AddBox([seat_corner,
                      rs.PointAdd(seat_corner, [width, 0, 0]),
                      rs.PointAdd(seat_corner, [width, depth, 0]),
                      rs.PointAdd(seat_corner, [0, depth, 0])])

    # Create chair backrest
    backrest_width = width * 0.9
    backrest_height = height * 0.9
    backrest_plane = rs.MovePlane(seat_plane, rs.VectorCreate([0, 0, height/10 + backrest_height/2], [0, 0, 1]))
    backrest_corner = rs.PointAdd(backrest_plane.Origin, rs.VectorCreate([-backrest_width/2, 0, -backrest_height/2], [0, 1, 0]))
    backrest = rs.AddBox([backrest_corner,
                          rs.PointAdd(backrest_corner, [backrest_width, 0, 0]),
                          rs.PointAdd(backrest_corner, [backrest_width, depth/10, 0]),
                          rs.PointAdd(backrest_corner, [0, depth/10, 0])])

    # Create chair legs
    leg_width = width / 10
    leg_depth = depth / 10
    leg_height = height - (height/10 + backrest_height)

    leg1_plane = rs.MovePlane(seat_plane, rs.VectorCreate([-width/2 + leg_width/2, -depth/2 + leg_depth/2, height/10 + backrest_height + leg_height/2], [0, 0, 1]))
    leg1_corner = rs.PointAdd(leg1_plane.Origin, rs.VectorCreate([0, 0, -leg_height/2], [0, 0, 1]))
    leg1 = rs.AddBox([leg1_corner,
                      rs.PointAdd(leg1_corner, [leg_width, 0, 0]),
                      rs.PointAdd(leg1_corner, [leg_width, leg_depth, 0]),
                      rs.PointAdd(leg1_corner, [0, leg_depth, 0])])

    leg2_plane = rs.MovePlane(seat_plane, rs.VectorCreate([-width/2 + leg_width/2, depth/2 - leg_depth/2, height/10 + backrest_height + leg_height/2], [0, 0, 1]))
    leg2_corner = rs.PointAdd(leg2_plane.Origin, rs.VectorCreate([0, 0, -leg_height/2], [0, 0, 1]))
    leg2 = rs.AddBox([leg2_corner,
                      rs.PointAdd(leg2_corner, [leg_width, 0, 0]),
                      rs.PointAdd(leg2_corner, [leg_width, leg_depth, 0]),
                      rs.PointAdd(leg2_corner, [0, leg_depth, 0])])

    leg3_plane = rs.MovePlane(seat_plane, rs.VectorCreate([width/2 - leg_width/2, -depth/2 + leg_depth/2, height/10 + backrest_height + leg_height/2], [0, 0, 1]))
    leg3_corner = rs.PointAdd(leg3_plane.Origin, rs.VectorCreate([0, 0, -leg_height/2], [0, 0, 1]))
    leg3 = rs.AddBox([leg3_corner,
                      rs.PointAdd(leg3_corner, [leg_width, 0, 0]),
                      rs.PointAdd(leg3_corner, [leg_width, leg_depth, 0]),
                      rs.PointAdd(leg3_corner, [0, leg_depth, 0])])

    leg4_plane = rs.MovePlane(seat_plane, rs.VectorCreate([width/2 - leg_width/2, depth/2 - leg_depth/2, height/10 + backrest_height + leg_height/2], [0, 0, 1]))
    leg4_corner = rs.PointAdd(leg4_plane.Origin, rs.VectorCreate([0, 0, -leg_height/2], [0, 0, 1]))
    leg4 = rs.AddBox([leg4_corner,
                      rs.PointAdd(leg4_corner, [leg_width, 0, 0]),
                      rs.PointAdd(leg4_corner, [leg_width, leg_depth, 0]),
                      rs.PointAdd(leg4_corner, [0, leg_depth, 0])])

    # Join all chair parts
    chair = rs.JoinSurfaces([seat, backrest, leg1, leg2, leg3, leg4])

    return chair

# Input parameters
chair_width = 1.0  # Width of the chair
chair_depth = 0.8  # Depth of the chair
chair_height = 1.2  # Height of the chair

# Create chair
chair = create_chair(chair_width, chair_depth, chair_height)

# Output the chair
a = chair
# ---------- end ghpython_script_3 ----------
# Parametric Chair
ghpython_script_4 = GhPythonScript()  # -> out, a
# ---------- ghpython_script_4: Python ----------
import rhinoscriptsyntax as rs
import scriptcontext as sc
import Rhino.Geometry as rg

def create_chair(width, depth, height):
    # Create chair seat
    seat_plane = rs.WorldXYPlane()
    seat_corner = rs.PointAdd(seat_plane.Origin, rs.VectorCreate([-width/2, -depth/2, 0], [0, 0, height/10]))
    seat = rs.AddBox(rg.BoundingBox.CreateFromCorners(rs.PointAdd(seat_corner, [0, 0, -height/20]),
                                                      rs.PointAdd(seat_corner, [width, 0, -height/20]),
                                                      rs.PointAdd(seat_corner, [width, depth, -height/20]),
                                                      rs.PointAdd(seat_corner, [0, depth, -height/20])))

    # Create chair backrest
    backrest_width = width * 0.9
    backrest_height = height * 0.9
    backrest_plane = rs.MovePlane(seat_plane, rs.VectorCreate([0, 0, height/10 + backrest_height/2], [0, 0, 1]))
    backrest_corner = rs.PointAdd(backrest_plane.Origin, rs.VectorCreate([-backrest_width/2, 0, -backrest_height/2], [0, 1, 0]))
    backrest = rs.AddBox(rg.BoundingBox.CreateFromCorners(rs.PointAdd(backrest_corner, [0, -depth/20, 0]),
                                                          rs.PointAdd(backrest_corner, [backrest_width, -depth/20, 0]),
                                                          rs.PointAdd(backrest_corner, [backrest_width, depth/20, 0]),
                                                          rs.PointAdd(backrest_corner, [0, depth/20, 0])))

    # Create chair legs
    leg_width = width / 10
    leg_depth = depth / 10
    leg_height = height - (height/10 + backrest_height)

    leg1_plane = rs.MovePlane(seat_plane, rs.VectorCreate([-width/2 + leg_width/2, -depth/2 + leg_depth/2, height/10 + backrest_height + leg_height/2], [0, 0, 1]))
    leg1_corner = rs.PointAdd(leg1_plane.Origin, rs.VectorCreate([0, 0, -leg_height/2], [0, 0, 1]))
    leg1 = rs.AddBox(rg.BoundingBox.CreateFromCorners(rs.PointAdd(leg1_corner, [-leg_width/20, -leg_depth/20, 0]),
                                                      rs.PointAdd(leg1_corner, [leg_width/20, -leg_depth/20, 0]),
                                                      rs.PointAdd(leg1_corner, [leg_width/20, leg_depth/20, 0]),
                                                      rs.PointAdd(leg1_corner, [-leg_width/20, leg_depth/20, 0])))

    leg2_plane = rs.MovePlane(seat_plane, rs.VectorCreate([-width/2 + leg_width/2, depth/2 - leg_depth/2, height/10 + backrest_height + leg_height/2], [0, 0, 1]))
    leg2_corner = rs.PointAdd(leg2_plane.Origin, rs.VectorCreate([0, 0, -leg_height/2], [0, 0, 1]))
    leg2 = rs.AddBox(rg.BoundingBox.CreateFromCorners(rs.PointAdd(leg2_corner, [-leg_width/20, -leg_depth/20, 0]),
                                                      rs.PointAdd(leg2_corner, [leg_width/20, -leg_depth/20, 0]),
                                                      rs.PointAdd(leg2_corner, [leg_width/20, leg_depth/20, 0]),
                                                      rs.PointAdd(leg2_corner, [-leg_width/20, leg_depth/20, 0])))

    leg3_plane = rs.MovePlane(seat_plane, rs.VectorCreate([width/2 - leg_width/2, -depth/2 + leg_depth/2, height/10 + backrest_height + leg_height/2], [0, 0, 1]))
    leg3_corner = rs.PointAdd(leg3_plane.Origin, rs.VectorCreate([0, 0, -leg_height/2], [0, 0, 1]))
    leg3 = rs.AddBox(rg.BoundingBox.CreateFromCorners(rs.PointAdd(leg3_corner, [-leg_width/20, -leg_depth/20, 0]),
                                                      rs.PointAdd(leg3_corner, [leg_width/20, -leg_depth/20, 0]),
                                                      rs.PointAdd(leg3_corner, [leg_width/20, leg_depth/20, 0]),
                                                      rs.PointAdd(leg3_corner, [-leg_width/20, leg_depth/20, 0])))

    leg4_plane = rs.MovePlane(seat_plane, rs.VectorCreate([width/2 - leg_width/2, depth/2 - leg_depth/2, height/10 + backrest_height + leg_height/2], [0, 0, 1]))
    leg4_corner = rs.PointAdd(leg4_plane.Origin, rs.VectorCreate([0, 0, -leg_height/2], [0, 0, 1]))
    leg4 = rs.AddBox(rg.BoundingBox.CreateFromCorners(rs.PointAdd(leg4_corner, [-leg_width/20, -leg_depth/20, 0]),
                                                      rs.PointAdd(leg4_corner, [leg_width/20, -leg_depth/20, 0]),
                                                      rs.PointAdd(leg4_corner, [leg_width/20, leg_depth/20, 0]),
                                                      rs.PointAdd(leg4_corner, [-leg_width/20, leg_depth/20, 0])))

    # Join all chair parts
    chair = rs.JoinSurfaces([seat, backrest, leg1, leg2, leg3, leg4])

    return chair

# Input parameters
chair_width = 1.0  # Width of the chair
chair_depth = 0.8  # Depth of the chair
chair_height = 1.2  # Height of the chair

# Create chair
chair = create_chair(chair_width, chair_depth, chair_height)

# Output the chair
a = chair
# ---------- end ghpython_script_4 ----------
# Parametric Chair
ghpython_script_5 = GhPythonScript()  # -> out, a
# ---------- ghpython_script_5: Python ----------
import rhinoscriptsyntax as rs
import scriptcontext as sc
import Rhino.Geometry as rg

def create_chair(width, depth, height):
    # Create chair seat
    seat_plane = rs.WorldXYPlane()
    seat_corner = rs.PointAdd(seat_plane.Origin, rs.VectorCreate([-width/2, -depth/2, 0], [0, 0, height/10]))
    seat = rs.AddBox(rg.BoundingBox.CreateFromCorners(rs.PointAdd(seat_corner, [0, 0, -height/20]),
                                                      rs.PointAdd(seat_corner, [width, 0, -height/20]),
                                                      rs.PointAdd(seat_corner, [width, depth, -height/20]),
                                                      rs.PointAdd(seat_corner, [0, depth, -height/20])))

    # Create chair backrest
    backrest_width = width * 0.9
    backrest_height = height * 0.9
    backrest_plane = rs.MovePlane(seat_plane, rs.VectorCreate([0, 0, height/10 + backrest_height/2], [0, 0, 1]))
    backrest_corner = rs.PointAdd(backrest_plane.Origin, rs.VectorCreate([-backrest_width/2, 0, -backrest_height/2], [0, 1, 0]))
    backrest = rs.AddBox(rg.BoundingBox.CreateFromCorners(rs.PointAdd(backrest_corner, [0, -depth/20, 0]),
                                                          rs.PointAdd(backrest_corner, [backrest_width, -depth/20, 0]),
                                                          rs.PointAdd(backrest_corner, [backrest_width, depth/20, 0]),
                                                          rs.PointAdd(backrest_corner, [0, depth/20, 0])))

    # Create chair legs
    leg_width = width / 10
    leg_depth = depth / 10
    leg_height = height - (height/10 + backrest_height)

    leg1_plane = rs.MovePlane(seat_plane, rs.VectorCreate([-width/2 + leg_width/2, -depth/2 + leg_depth/2, height/10 + backrest_height + leg_height/2], [0, 0, 1]))
    leg1_corner = rs.PointAdd(leg1_plane.Origin, rs.VectorCreate([0, 0, -leg_height/2], [0, 0, 1]))
    leg1 = rs.AddBox(rg.BoundingBox.CreateFromCorners(rs.PointAdd(leg1_corner, [-leg_width/20, -leg_depth/20, 0]),
                                                      rs.PointAdd(leg1_corner, [leg_width/20, -leg_depth/20, 0]),
                                                      rs.PointAdd(leg1_corner, [leg_width/20, leg_depth/20, 0]),
                                                      rs.PointAdd(leg1_corner, [-leg_width/20, leg_depth/20, 0])))

    leg2_plane = rs.MovePlane(seat_plane, rs.VectorCreate([-width/2 + leg_width/2, depth/2 - leg_depth/2, height/10 + backrest_height + leg_height/2], [0, 0, 1]))
    leg2_corner = rs.PointAdd(leg2_plane.Origin,
# ---------- end ghpython_script_5 ----------
# Parametric Chair
ghpython_script_6 = GhPythonScript()  # -> out, a
# ---------- ghpython_script_6: Python ----------
import rhinoscriptsyntax as rs
import scriptcontext as sc
import Rhino.Geometry as rg

def create_chair(width, depth, height):
    # Create chair seat
    seat_plane = rs.WorldXYPlane()
    seat_corner = rs.PointAdd(seat_plane.Origin, rs.VectorCreate([-width/2, -depth/2, 0], [0, 0, height/10]))
    seat = rs.AddBox(rs.BoundingBox(seat_corner, width, depth, height/10))
    
    # Create chair backrest
    backrest_width = width * 0.9
    backrest_height = height * 0.9
    backrest_plane = rs.MovePlane(seat_plane, rs.VectorCreate([0, 0, height/10 + backrest_height/2], [0, 0, 1]))
    backrest_corner = rs.PointAdd(backrest_plane.Origin, rs.VectorCreate([-backrest_width/2, 0, -backrest_height/2], [0, 1, 0]))
    backrest = rs.AddBox(rs.BoundingBox(backrest_corner, backrest_width, depth/10, backrest_height))
    
    # Create chair legs
    leg_width = width / 10
    leg_depth = depth / 10
    leg_height = height - (height/10 + backrest_height)
    
    leg1_plane = rs.MovePlane(seat_plane, rs.VectorCreate([-width/2 + leg_width/2, -depth/2 + leg_depth/2, height/10 + backrest_height + leg_height/2], [0, 0, 1]))
    leg1_corner = rs.PointAdd(leg1_plane.Origin, rs.VectorCreate([0, 0, -leg_height/2], [0, 0, 1]))
    leg1 = rs.AddBox(rs.BoundingBox(leg1_corner, leg_width, leg_depth, leg_height))
    
    leg2_plane = rs.MovePlane(seat_plane, rs.VectorCreate([-width/2 + leg_width/2, depth/2 - leg_depth/2, height/10 + backrest_height + leg_height/2], [0, 0, 1]))
    leg2_corner = rs.PointAdd(leg2_plane.Origin, rs.VectorCreate([0, 0, -leg_height/2], [0, 0, 1]))
    leg2 = rs.AddBox(rs.BoundingBox(leg2_corner, leg_width, leg_depth, leg_height))
    
    leg3_plane = rs.MovePlane(seat_plane, rs.VectorCreate([width/2 - leg_width/2, -depth/2 + leg_depth/2, height/10 + backrest_height + leg_height/2], [0, 0, 1]))
    leg3_corner = rs.PointAdd(leg3_plane.Origin, rs.VectorCreate([0, 0, -leg_height/2], [0, 0, 1]))
    leg3 = rs.AddBox(rs.BoundingBox(leg3_corner, leg_width, leg_depth, leg_height))
    
    leg4_plane = rs.MovePlane(seat_plane, rs.VectorCreate([width/2 - leg_width/2, depth/2 - leg_depth/2, height/10 + backrest_height + leg_height/2], [0, 0, 1]))
    leg4_corner = rs.PointAdd(leg4_plane.Origin, rs.VectorCreate([0, 0, -leg_height/2], [0, 0, 1]))
    leg4 = rs.AddBox(rs.BoundingBox(leg4_corner, leg_width, leg_depth, leg_height))
    
    # Join all chair parts
    chair = rs.JoinSurfaces([seat, backrest, leg1, leg2, leg3, leg4])
    
    return chair

# Input parameters
chair_width = 1.0  # Width of the chair
chair_depth = 0.8  # Depth of the chair
chair_height = 1.2  # Height of the chair

# Create chair
chair = create_chair(chair_width, chair_depth, chair_height)

# Output the chair
a = chair
# ---------- end ghpython_script_6 ----------
# Architectural Parametric
# Digital Assets
# gpt-4 into ghpython node
# #Text prompting in GPT-4 at www.wickersonstudios.com
# Parametric Chair
ghpython_script_7 = GhPythonScript()  # -> out, a
# ---------- ghpython_script_7: Python ----------
import rhinoscriptsyntax as rs

def create_chair(width, depth, height):
    # Create chair seat
    seat = rs.AddBox(rs.WorldXYPlane(), width, depth, height/10)
    
    # Create chair backrest
    backrest_width = width * 0.9
    backrest_height = height * 0.9
    backrest = rs.AddBox(rs.MovePlane(rs.WorldXYPlane(), [0, 0, height/10]), backrest_width, depth/10, backrest_height)
    
    # Create chair legs
    leg_width = width / 10
    leg_depth = depth / 10
    leg_height = height - (height/10 + backrest_height)
    
    leg1 = rs.AddBox(rs.MovePlane(rs.WorldXYPlane(), [-width/2 + leg_width/2, -depth/2 + leg_depth/2, height/10 + backrest_height]), leg_width, leg_depth, leg_height)
    leg2 = rs.AddBox(rs.MovePlane(rs.WorldXYPlane(), [-width/2 + leg_width/2, depth/2 - leg_depth/2, height/10 + backrest_height]), leg_width, leg_depth, leg_height)
    leg3 = rs.AddBox(rs.MovePlane(rs.WorldXYPlane(), [width/2 - leg_width/2, -depth/2 + leg_depth/2, height/10 + backrest_height]), leg_width, leg_depth, leg_height)
    leg4 = rs.AddBox(rs.MovePlane(rs.WorldXYPlane(), [width/2 - leg_width/2, depth/2 - leg_depth/2, height/10 + backrest_height]), leg_width, leg_depth, leg_height)
    
    # Join all chair parts
    chair = rs.JoinSurfaces([seat, backrest, leg1, leg2, leg3, leg4])
    
    return chair

# Input parameters
chair_width = 1.0  # Width of the chair
chair_depth = 0.8  # Depth of the chair
chair_height = 1.2  # Height of the chair

# Create chair
chair = create_chair(chair_width, chair_depth, chair_height)

# Output the chair
a = chair
# ---------- end ghpython_script_7 ----------
panel = Panel(ghpython_script.out)
panel_2 = Panel(ghpython_script_2.out)
geometry = Geometry(ghpython_script.a)
panel_3 = Panel(ghpython_script_3.out)
panel_4 = Panel(ghpython_script_4.out)
panel_5 = Panel(ghpython_script_5.out)
panel_6 = Panel(ghpython_script_6.out)
panel_7 = Panel(ghpython_script_7.out)
# Parametric Chair
ghpython_script_8 = GhPythonScript()  # -> out, a, b, c, d
# ---------- ghpython_script_8: Python ----------
import rhinoscriptsyntax as rs
import scriptcontext as sc
import Rhino.Geometry as rg
import math

def create_chair(width, depth, height):
    chair_parts = []

    # Create chair seat
    seat_height = height / 10
    seat_plane = rg.Plane.WorldXY
    seat_corner = seat_plane.Origin - rg.Vector3d(width/2, depth/2, 0) * seat_height
    seat_corner_top = seat_plane.Origin - rg.Vector3d(width/2, depth/2, 0) * height
    seat_curve = rg.Curve.CreateControlPointCurve([seat_corner, seat_corner + rg.Vector3d(width, 0, 0), seat_corner + rg.Vector3d(width, depth, 0), seat_corner + rg.Vector3d(0, depth, 0), seat_corner])
    seat_brep = rg.Brep.CreateFromLoft([seat_curve], rg.Point3d.Unset, rg.Point3d.Unset, rg.LoftType.Normal, False)[0]
    seat = sc.doc.Objects.AddBrep(seat_brep)
    chair_parts.append(seat_brep)

    # Create chair legs
    leg_width = width / 20
    leg_depth = depth / 20
    leg_height = height - seat_height

    num_legs = 4  # Number of legs
    angle_offset = math.pi / num_legs  # Angle offset between legs

    leg_radius = min(leg_width, leg_depth) * 0.75  # Radius of leg base

    for i in range(num_legs):
        angle = i * 2 * math.pi / num_legs + angle_offset

        leg_center = seat_plane.Origin + rg.Vector3d(math.cos(angle) * (width/2 - leg_radius), math.sin(angle) * (depth/2 - leg_radius), -leg_height/2)
        leg_profile = rg.Rectangle3d(rg.Plane(leg_center, rg.Vector3d.XAxis, rg.Vector3d.YAxis), leg_width, leg_depth).ToPolyline(0)
        leg_curve = rg.PolylineCurve(leg_profile)
        leg_brep = rg.Extrusion.Create(leg_curve, leg_height, True)
        leg = sc.doc.Objects.AddBrep(leg_brep)
        chair_parts.append(leg_brep)

    # Create chair backrest
    backrest_width = width * 0.8
    backrest_height = height * 0.6
    backrest_depth = depth / 10

    backrest_profile = rg.Rectangle3d(rg.Plane.WorldXY, backrest_width, backrest_height).ToPolyline(0)
    backrest_curve = rg.PolylineCurve(backrest_profile)

    backrest_transform = rg.Transform.Translation(0, 0, seat_height + backrest_height/2)
    backrest_curve.Transform(backrest_transform)
    backrest_brep = rg.Extrusion.Create(backrest_curve, backrest_depth, True)
    backrest = sc.doc.Objects.AddBrep(backrest_brep)
    chair_parts.append(backrest_brep)

    # Create chair armrests
    armrest_width = width * 0.7
    armrest_depth = depth / 10
    armrest_height = height * 0.3

    armrest_profile = rg.Rectangle3d(rg.Plane.WorldYZ, armrest_depth, armrest_height).ToPolyline(0)
    armrest_curve = rg.PolylineCurve(armrest_profile)

    armrest_transform1 = rg.Transform.Translation(width/2 - armrest_width/2, -depth/2, seat_height + armrest_height/2)
    armrest_curve1 = armrest_curve.Duplicate()
    armrest_curve1.Transform(armrest_transform1)
    armrest_brep1 = rg.Extrusion.Create(armrest_curve1, armrest_width, True)
    armrest1 = sc.doc.Objects.AddBrep(armrest_brep1)
    chair_parts.append(armrest_brep1)

    armrest_transform2 = rg.Transform.Translation(-width/2 + armrest_width/2, -depth/2, seat_height + armrest_height/2)
    armrest_curve2 = armrest_curve.Duplicate()
    armrest_curve2.Transform(armrest_transform2)
    armrest_brep2 = rg.Extrusion.Create(armrest_curve2, armrest_width, True)
    armrest2 = sc.doc.Objects.AddBrep(armrest_brep2)
    chair_parts.append(armrest_brep2)

    # Join all chair parts
    chair_brep = rg.Brep.JoinBreps(chair_parts, sc.doc.ModelAbsoluteTolerance)[0]

    return chair_brep

# Input parameters
chair_width = 1.0  # Width of the chair
chair_depth = 0.8  # Depth of the chair
chair_height = 1.2  # Height of the chair

# Create chair
chair = create_chair(chair_width, chair_depth, chair_height)

# Output the chair
a = chair
# ---------- end ghpython_script_8 ----------
# Parametric Chair
ghpython_script_9 = GhPythonScript()  # -> out, a
# ---------- ghpython_script_9: Python ----------
import rhinoscriptsyntax as rs
import scriptcontext as sc
import Rhino.Geometry as rg
import math

def create_chair(width, depth, height):
    # Create chair seat
    seat_plane = rs.WorldXYPlane()
    seat_corner = rs.PointAdd(seat_plane.Origin, rg.Vector3d(-width/2, -depth/2, 0) * height/10)
    seat_box = rg.Box(rg.Plane(seat_corner, rg.Vector3d.XAxis, rg.Vector3d.YAxis), rg.Interval(0, width), rg.Interval(0, depth), rg.Interval(0, height/10))
    seat_brep = rg.Brep.CreateFromBox(seat_box)
    seat = sc.doc.Objects.AddBrep(seat_brep)

    # Create chair backrest
    backrest_width = width * 0.9
    backrest_height = height * 0.9
    backrest_plane = rs.MovePlane(seat_plane, rg.Vector3d(0, 0, height/10 + backrest_height/2))
    backrest_corner = rs.PointAdd(backrest_plane.Origin, rg.Vector3d(-backrest_width/2, 0, -backrest_height/2))
    backrest_box = rg.Box(rg.Plane(backrest_corner, rg.Vector3d.XAxis, rg.Vector3d.YAxis), rg.Interval(0, backrest_width), rg.Interval(0, depth/10), rg.Interval(0, backrest_height))
    backrest_brep = rg.Brep.CreateFromBox(backrest_box)
    backrest = sc.doc.Objects.AddBrep(backrest_brep)

    # Create chair legs
    leg_width = width / 20
    leg_depth = depth / 20
    leg_height = height - (height/10 + backrest_height)

    num_legs = 4  # Number of legs
    angle_offset = math.pi / num_legs  # Angle offset between legs

    leg_radius = min(leg_width, leg_depth) * 0.75  # Radius of leg base

    for i in range(num_legs):
        angle = i * 2 * math.pi / num_legs + angle_offset

        leg_center = rs.PointAdd(seat_plane.Origin, rg.Vector3d(math.cos(angle) * (width/2 - leg_radius), math.sin(angle) * (depth/2 - leg_radius), height/10 + backrest_height + leg_height/2))
        leg_box = rg.Box(rg.Plane(leg_center, rg.Vector3d.XAxis, rg.Vector3d.YAxis), rg.Interval(0, leg_width), rg.Interval(0, leg_depth), rg.Interval(0, leg_height))
        leg_brep = rg.Brep.CreateFromBox(leg_box)
        leg = sc.doc.Objects.AddBrep(leg_brep)

    # Create chair armrests
    armrest_width = width * 0.6
    armrest_depth = depth / 10
    armrest_height = height * 0.2

    armrest1_plane = rs.MovePlane(backrest_plane, rg.Vector3d(-backrest_width/2 + armrest_width/2, backrest_height/2, -armrest_height/2))
    armrest1_box = rg.Box(rg.Plane(armrest1_plane.Origin, rg.Vector3d.XAxis, rg.Vector3d.YAxis), rg.Interval(0, armrest_width), rg.Interval(0, armrest_depth), rg.Interval(0, armrest_height))
    armrest1_brep = rg.Brep.CreateFromBox(armrest1_box)
    armrest1 = sc.doc.Objects.AddBrep(armrest1_brep)

    armrest2_plane = rs.MovePlane(backrest_plane, rg.Vector3d(backrest_width/2 - armrest_width/2, backrest_height/2, -armrest_height/2))
    armrest2_box = rg.Box(rg.Plane(armrest2_plane.Origin, rg.Vector3d.XAxis, rg.Vector3d.YAxis), rg.Interval(0, armrest_width), rg.Interval(0, armrest_depth), rg.Interval(0, armrest_height))
    armrest2_brep = rg.Brep.CreateFromBox(armrest2_box)
    armrest2 = sc.doc.Objects.AddBrep(armrest2_brep)

    # Join all chair parts
    chair_parts = [seat_brep, backrest_brep] + [leg_brep for _ in range(num_legs)] + [armrest1_brep, armrest2_brep]
    chair = rg.Brep.JoinBreps(chair_parts, sc.doc.ModelAbsoluteTolerance)
    if chair:
        chair = chair[0]

    return chair

# Input parameters
chair_width = 1.0  # Width of the chair
chair_depth = 0.8  # Depth of the chair
chair_height = 1.2  # Height of the chair

# Create chair
chair = create_chair(chair_width, chair_depth, chair_height)

# Output the chair
a = chair
# ---------- end ghpython_script_9 ----------
# Parametric Chair
ghpython_script_10 = GhPythonScript()  # -> out, a
# ---------- ghpython_script_10: Python ----------
import rhinoscriptsyntax as rs
import scriptcontext as sc
import Rhino.Geometry as rg
import math

def create_chair(width, depth, height):
    # Create chair seat
    seat_plane = rs.WorldXYPlane()
    seat_corner = rs.PointAdd(seat_plane.Origin, rg.Vector3d(-width/2, -depth/2, 0) * height/10)
    seat_box = rg.Box(rg.Plane(seat_corner, rg.Vector3d.XAxis, rg.Vector3d.YAxis), rg.Interval(0, width), rg.Interval(0, depth), rg.Interval(0, height/10))
    seat_brep = rg.Brep.CreateFromBox(seat_box)
    seat = sc.doc.Objects.AddBrep(seat_brep)

    # Create chair backrest
    backrest_width = width * 0.9
    backrest_height = height * 0.9
    backrest_plane = rs.MovePlane(seat_plane, rg.Vector3d(0, 0, height/10 + backrest_height/2))
    backrest_corner = rs.PointAdd(backrest_plane.Origin, rg.Vector3d(-backrest_width/2, 0, -backrest_height/2))
    backrest_box = rg.Box(rg.Plane(backrest_corner, rg.Vector3d.XAxis, rg.Vector3d.YAxis), rg.Interval(0, backrest_width), rg.Interval(0, depth/10), rg.Interval(0, backrest_height))
    backrest_brep = rg.Brep.CreateFromBox(backrest_box)
    backrest = sc.doc.Objects.AddBrep(backrest_brep)

    # Create chair legs
    leg_width = width / 20
    leg_depth = depth / 20
    leg_height = height - (height/10 + backrest_height)

    num_legs = 4  # Number of legs
    angle_offset = math.pi / num_legs  # Angle offset between legs

    leg_radius = min(leg_width, leg_depth) * 0.75  # Radius of leg base

    for i in range(num_legs):
        angle = i * 2 * math.pi / num_legs + angle_offset

        leg_center = rs.PointAdd(seat_plane.Origin, rg.Vector3d(math.cos(angle) * (width/2 - leg_radius), math.sin(angle) * (depth/2 - leg_radius), height/10 + backrest_height + leg_height/2))
        leg_circle = rg.Circle(rg.Plane(leg_center, rg.Vector3d.ZAxis), leg_radius)
        leg_cylinder = rg.Cylinder(leg_circle, leg_height)
        leg_brep = rg.Brep.CreateFromCylinder(leg_cylinder, True, True)
        leg = sc.doc.Objects.AddBrep(leg_brep)

    # Create chair patterns
    pattern_radius = min(width, depth) * 0.25  # Radius of pattern circles
    num_patterns = 6  # Number of patterns

    for i in range(num_patterns):
        pattern_angle = i * 2 * math.pi / num_patterns

        pattern_center = rs.PointAdd(seat_plane.Origin, rg.Vector3d(math.cos(pattern_angle) * (width/2 - pattern_radius), math.sin(pattern_angle) * (depth/2 - pattern_radius), height/20))
        pattern_circle = rg.Circle(pattern_center, pattern_radius)
        pattern_surface = rg.Surface.CreateExtrusion(rg.Curve.CreateCircle(pattern_circle), rg.Vector3d.ZAxis * (height/2 - height/20))
        pattern_brep = pattern_surface.ToBrep()
        pattern = sc.doc.Objects.AddBrep(pattern_brep)

    # Join all chair parts
    chair_parts = [seat_brep, backrest_brep] + [leg_brep for _ in range(num_legs)] + [pattern_brep for _ in range(num_patterns)]
    chair = rg.Brep.JoinBreps(chair_parts, sc.doc.ModelAbsoluteTolerance)
    if chair:
        chair = chair[0]

    return chair

# Input parameters
chair_width = 1.0  # Width of the chair
chair_depth = 0.8  # Depth of the chair
chair_height = 1.2  # Height of the chair

# Create chair
chair = create_chair(chair_width, chair_depth, chair_height)

# Output the chair
a = chair
# ---------- end ghpython_script_10 ----------
panel_8 = Panel(ghpython_script_8.out)
panel_9 = Panel(ghpython_script_9.out)
geometry_2 = Geometry(ghpython_script_8.a)
geometry_3 = Geometry(ghpython_script_9.a)
panel_10 = Panel(ghpython_script_10.out)
geometry_4 = Geometry(ghpython_script_10.a)
# Parametric Chair
ghpython_script_11 = GhPythonScript()  # -> out, a, b, c, d, e, f, g, h, i
# ---------- ghpython_script_11: Python ----------
import rhinoscriptsyntax as rs
import scriptcontext as sc
import Rhino.Geometry as rg
import math

def create_chair(width, depth, height):
    chair_parts = []

    # Create chair seat
    seat_plane = rs.WorldXYPlane()
    seat_corner = rs.PointAdd(seat_plane.Origin, rg.Vector3d(-width/2, -depth/2, 0) * height/10)
    seat_box = rg.Box(rg.Plane(seat_corner, rg.Vector3d.XAxis, rg.Vector3d.YAxis), rg.Interval(0, width), rg.Interval(0, depth), rg.Interval(0, height/10))
    seat_brep = rg.Brep.CreateFromBox(seat_box)
    seat = sc.doc.Objects.AddBrep(seat_brep)
    chair_parts.append(seat_brep)

    # Create chair backrest
    backrest_width = width * 0.9
    backrest_height = height * 0.9
    backrest_plane = rs.MovePlane(seat_plane, rg.Vector3d(0, 0, height/10 + backrest_height/2))
    backrest_corner = rs.PointAdd(backrest_plane.Origin, rg.Vector3d(-backrest_width/2, -depth/2, -backrest_height/2))
    backrest_box = rg.Box(rg.Plane(backrest_corner, rg.Vector3d.XAxis, rg.Vector3d.YAxis), rg.Interval(0, backrest_width), rg.Interval(0, depth), rg.Interval(0, backrest_height))
    backrest_brep = rg.Brep.CreateFromBox(backrest_box)
    backrest = sc.doc.Objects.AddBrep(backrest_brep)
    chair_parts.append(backrest_brep)

    # Create chair legs
    leg_width = width / 20
    leg_depth = depth / 20
    leg_height = height - (height/10 + backrest_height)

    num_legs = 4  # Number of legs
    angle_offset = math.pi / num_legs  # Angle offset between legs

    leg_radius = min(leg_width, leg_depth) * 0.75  # Radius of leg base

    for i in range(num_legs):
        angle = i * 2 * math.pi / num_legs + angle_offset

        leg_center = rs.PointAdd(seat_plane.Origin, rg.Vector3d(math.cos(angle) * (width/2 - leg_radius), math.sin(angle) * (depth/2 - leg_radius), height/10 + backrest_height + leg_height/2))
        leg_box = rg.Box(rg.Plane(leg_center, rg.Vector3d.XAxis, rg.Vector3d.YAxis), rg.Interval(0, leg_width), rg.Interval(0, leg_depth), rg.Interval(0, leg_height))
        leg_brep = rg.Brep.CreateFromBox(leg_box)
        leg = sc.doc.Objects.AddBrep(leg_brep)
        chair_parts.append(leg_brep)

    # Create chair arms
    armrest_width = width * 0.6
    armrest_depth = depth / 10
    armrest_height = height * 0.2

    armrest1_plane = rs.MovePlane(backrest_plane, rg.Vector3d(-backrest_width/2 + armrest_width/2, -depth/2, -armrest_height/2))
    armrest1_box = rg.Box(rg.Plane(armrest1_plane.Origin, rg.Vector3d.XAxis, rg.Vector3d.YAxis), rg.Interval(0, armrest_width), rg.Interval(0, depth), rg.Interval(0, armrest_height))
    armrest1_brep = rg.Brep.CreateFromBox(armrest1_box)
    armrest1 = sc.doc.Objects.AddBrep(armrest1_brep)
    chair_parts.append(armrest1_brep)

    armrest2_plane = rs.MovePlane(backrest_plane, rg.Vector3d(backrest_width/2 - armrest_width/2, -depth/2, -armrest_height/2))
    armrest2_box = rg.Box(rg.Plane(armrest2_plane.Origin, rg.Vector3d.XAxis, rg.Vector3d.YAxis), rg.Interval(0, armrest_width), rg.Interval(0, depth), rg.Interval(0, armrest_height))
    armrest2_brep = rg.Brep.CreateFromBox(armrest2_box)
    armrest2 = sc.doc.Objects.AddBrep(armrest2_brep)
    chair_parts.append(armrest2_brep)

    # Create chair backrest shape
    backrest_width = width * 0.9
    backrest_height = height * 0.9
    backrest_curve = rg.Curve.CreateInterpolatedCurve([
        rg.Point3d(-backrest_width / 2, -depth / 2, height / 10),
        rg.Point3d(backrest_width / 2, -depth / 2, height / 10),
        rg.Point3d(backrest_width / 2, depth / 2, height / 10),
        rg.Point3d(-backrest_width / 2, depth / 2, height / 10),
        rg.Point3d(-backrest_width / 2, -depth / 2, height / 10)
    ], 3)
    backrest_extrusion = rg.Extrusion.Create(backrest_curve, backrest_height, True)
    backrest = sc.doc.Objects.AddExtrusion(backrest_extrusion)
    chair_parts.append(backrest_extrusion.ToBrep())

    # Join all chair parts
    chair = rg.Brep.JoinBreps(chair_parts, sc.doc.ModelAbsoluteTolerance)
    if chair:
        chair = chair[0]

    return chair, chair_parts

# Input parameters
chair_width = 1.0  # Width of the chair
chair_depth = 0.8  # Depth of the chair
chair_height = 1.2  # Height of the chair

# Create chair
chair, chair_parts = create_chair(chair_width, chair_depth, chair_height)

# Output the chair parts separately
a = chair_parts[0]  # Chair seat
b = chair_parts[1]  # Chair backrest
c = chair_parts[2]  # Chair leg 1
d = chair_parts[3]  # Chair leg 2
e = chair_parts[4]  # Chair leg 3
f = chair_parts[5]  # Chair leg 4
g = chair_parts[6]  # Chair armrest 1
h = chair_parts[7]  # Chair armrest 2
i = chair_parts[8]  # Chair backrest shape
# ---------- end ghpython_script_11 ----------
# Parametric Chair
ghpython_script_12 = GhPythonScript(
    chair_width=Slider(0.42, range=0..1),
    chair_depth=Slider(0.4, range=0..1),
    chair_height=Slider(1, range=0..1),
    leg_count=Slider(4, range=0..10))  # -> out, a, b, c, d, e, f, g, h, i; inputs leg_count: Int32
# ---------- ghpython_script_12: Python ----------
import rhinoscriptsyntax as rs
import scriptcontext as sc
import Rhino.Geometry as rg
import math

def create_chair(width, depth, height, leg_count=4):
    chair_parts = []

    # Create chair seat
    seat_plane = rs.WorldXYPlane()
    seat_corner = rs.PointAdd(seat_plane.Origin, rg.Vector3d(-width/2, -depth/2, 0) * height/10)
    seat_box = rg.Box(rg.Plane(seat_corner, rg.Vector3d.XAxis, rg.Vector3d.YAxis), rg.Interval(0, width), rg.Interval(0, depth), rg.Interval(0, height/10))
    seat_brep = rg.Brep.CreateFromBox(seat_box)
    seat = sc.doc.Objects.AddBrep(seat_brep)
    chair_parts.append(seat_brep)

    # Create chair backrest
    backrest_width = width * 0.9
    backrest_height = height * 0.9
    backrest_plane = rs.MovePlane(seat_plane, rg.Vector3d(0, 0, height/10 + backrest_height/2))
    backrest_corner = rs.PointAdd(backrest_plane.Origin, rg.Vector3d(-backrest_width/2, -depth/2, -backrest_height/2))
    backrest_box = rg.Box(rg.Plane(backrest_corner, rg.Vector3d.XAxis, rg.Vector3d.YAxis), rg.Interval(0, backrest_width), rg.Interval(0, depth), rg.Interval(0, backrest_height))
    backrest_brep = rg.Brep.CreateFromBox(backrest_box)
    backrest = sc.doc.Objects.AddBrep(backrest_brep)
    chair_parts.append(backrest_brep)

    # Create chair legs
    leg_width = width / 20
    leg_depth = depth / 20
    leg_height = height - (height/10 + backrest_height)

    angle_offset = math.pi / leg_count  # Angle offset between legs

    leg_radius = min(leg_width, leg_depth) * 0.75  # Radius of leg base

    for i in range(leg_count):
        angle = i * 2 * math.pi / leg_count + angle_offset

        leg_center = rs.PointAdd(seat_plane.Origin, rg.Vector3d(math.cos(angle) * (width/2 - leg_radius), math.sin(angle) * (depth/2 - leg_radius), height/10 + backrest_height + leg_height/2))
        leg_box = rg.Box(rg.Plane(leg_center, rg.Vector3d.XAxis, rg.Vector3d.YAxis), rg.Interval(0, leg_width), rg.Interval(0, leg_depth), rg.Interval(0, leg_height))
        leg_brep = rg.Brep.CreateFromBox(leg_box)
        leg = sc.doc.Objects.AddBrep(leg_brep)
        chair_parts.append(leg_brep)

    # Create chair arms
    armrest_width = width * 0.6
    armrest_depth = depth / 10
    armrest_height = height * 0.2

    armrest1_plane = rs.MovePlane(backrest_plane, rg.Vector3d(-backrest_width/2 + armrest_width/2, -depth/2, -armrest_height/2))
    armrest1_box = rg.Box(rg.Plane(armrest1_plane.Origin, rg.Vector3d.XAxis, rg.Vector3d.YAxis), rg.Interval(0, armrest_width), rg.Interval(0, depth), rg.Interval(0, armrest_height))
    armrest1_brep = rg.Brep.CreateFromBox(armrest1_box)
    armrest1 = sc.doc.Objects.AddBrep(armrest1_brep)
    chair_parts.append(armrest1_brep)

    armrest2_plane = rs.MovePlane(backrest_plane, rg.Vector3d(backrest_width/2 - armrest_width/2, -depth/2, -armrest_height/2))
    armrest2_box = rg.Box(rg.Plane(armrest2_plane.Origin, rg.Vector3d.XAxis, rg.Vector3d.YAxis), rg.Interval(0, armrest_width), rg.Interval(0, depth), rg.Interval(0, armrest_height))
    armrest2_brep = rg.Brep.CreateFromBox(armrest2_box)
    armrest2 = sc.doc.Objects.AddBrep(armrest2_brep)
    chair_parts.append(armrest2_brep)

    # Create chair backrest shape
    backrest_width = width * 0.9
    backrest_height = height * 0.9
    backrest_curve = rg.Curve.CreateInterpolatedCurve([
        rg.Point3d(-backrest_width / 2, -depth / 2, height / 10),
        rg.Point3d(backrest_width / 2, -depth / 2, height / 10),
        rg.Point3d(backrest_width / 2, depth / 2, height / 10),
        rg.Point3d(-backrest_width / 2, depth / 2, height / 10),
        rg.Point3d(-backrest_width / 2, -depth / 2, height / 10)
    ], 3)
    backrest_extrusion = rg.Extrusion.Create(backrest_curve, backrest_height, True)
    backrest = sc.doc.Objects.AddExtrusion(backrest_extrusion)
    chair_parts.append(backrest_extrusion.ToBrep())

    # Join all chair parts
    chair = rg.Brep.JoinBreps(chair_parts, sc.doc.ModelAbsoluteTolerance)
    if chair:
        chair = chair[0]

    return chair, chair_parts

# Input parameters
#chair_width = 1.0  # Width of the chair
#chair_depth = 0.8  # Depth of the chair
#chair_height = 1.2  # Height of the chair
#leg_count = 4  # Number of chair legs

# Create chair
chair, chair_parts = create_chair(chair_width, chair_depth, chair_height, leg_count)

# Output the chair parts separately
a = chair_parts[0]  # Chair seat
b = chair_parts[1]  # Chair backrest
c = chair_parts[2]  # Chair leg 1
d = chair_parts[3]  # Chair leg 2
e = chair_parts[4]  # Chair leg 3
f = chair_parts[5]  # Chair leg 4
g = chair_parts[6]  # Chair armrest 1
h = chair_parts[7]  # Chair armrest 2
i = chair_parts[8]  # Chair backrest shape
# ---------- end ghpython_script_12 ----------
ghpython_script_13 = GhPythonScript(
    chair_width=Slider(1, range=0..1),
    chair_depth=Slider(0.82, range=0..1),
    chair_height=Slider(0.3, range=0..2),
    leg_count=Slider(6, range=0..10))  # -> out, a, b, c; inputs leg_count: Int32
# ---------- ghpython_script_13: Python ----------
import rhinoscriptsyntax as rs
import scriptcontext as sc
import Rhino.Geometry as rg
import math

def create_chair(width, depth, height, leg_count=4):
    chair_parts = []

    # Create chair seat
    seat_plane = rs.WorldXYPlane()
    seat_corner = rs.PointAdd(seat_plane.Origin, rg.Vector3d(-width/2, -depth/2, 0) * height/10)
    seat_box = rg.Box(rg.Plane(seat_corner, rg.Vector3d.XAxis, rg.Vector3d.YAxis), rg.Interval(0, width), rg.Interval(0, depth), rg.Interval(0, height/10))
    seat_brep = rg.Brep.CreateFromBox(seat_box)
    seat = sc.doc.Objects.AddBrep(seat_brep)
    chair_parts.append(seat_brep)

    # Create chair backrest
    backrest_width = width * 0.9
    backrest_height = height * 0.9
    backrest_plane = rs.MovePlane(seat_plane, rg.Vector3d(0, 0, height/10 + backrest_height/2))
    backrest_corner = rs.PointAdd(backrest_plane.Origin, rg.Vector3d(-backrest_width/2, -depth/2, -backrest_height/2))
    backrest_box = rg.Box(rg.Plane(backrest_corner, rg.Vector3d.XAxis, rg.Vector3d.YAxis), rg.Interval(0, backrest_width), rg.Interval(0, depth), rg.Interval(0, backrest_height))
    backrest_brep = rg.Brep.CreateFromBox(backrest_box)
    backrest = sc.doc.Objects.AddBrep(backrest_brep)
    chair_parts.append(backrest_brep)

    # Create chair legs
    leg_width = width / 20
    leg_depth = depth / 20
    leg_height = height - (height/10 + backrest_height)

    angle_offset = math.pi / leg_count  # Angle offset between legs

    leg_radius = min(leg_width, leg_depth) * 0.75  # Radius of leg base

    for i in range(leg_count):
        angle = i * 2 * math.pi / leg_count + angle_offset

        leg_center = rs.PointAdd(seat_plane.Origin, rg.Vector3d(math.cos(angle) * (width/2 - leg_radius), math.sin(angle) * (depth/2 - leg_radius), height/10 + backrest_height + leg_height/2))
        leg_bottom = rs.PointAdd(leg_center, rg.Vector3d(0, 0, -leg_height/2))
        leg_cylinder = rg.Cylinder(rg.Circle(leg_bottom, leg_radius), leg_height)
        leg_brep = rg.Brep.CreateFromCylinder(leg_cylinder, False, True)
        leg = sc.doc.Objects.AddBrep(leg_brep)
        chair_parts.append(leg_brep)

    # Create chair arms
    armrest_width = width * 0.6
    armrest_depth = depth / 10
    armrest_height = height * 0.2

    armrest1_plane = rs.MovePlane(backrest_plane, rg.Vector3d(-backrest_width/2 + armrest_width/2, -depth/2, -armrest_height/2))
    armrest1_box = rg.Box(rg.Plane(armrest1_plane.Origin, rg.Vector3d.XAxis, rg.Vector3d.YAxis), rg.Interval(0, armrest_width), rg.Interval(0, depth), rg.Interval(0, armrest_height))
    armrest1_brep = rg.Brep.CreateFromBox(armrest1_box)
    armrest1 = sc.doc.Objects.AddBrep(armrest1_brep)
    chair_parts.append(armrest1_brep)

    armrest2_plane = rs.MovePlane(backrest_plane, rg.Vector3d(backrest_width/2 - armrest_width/2, -depth/2, -armrest_height/2))
    armrest2_box = rg.Box(rg.Plane(armrest2_plane.Origin, rg.Vector3d.XAxis, rg.Vector3d.YAxis), rg.Interval(0, armrest_width), rg.Interval(0, depth), rg.Interval(0, armrest_height))
    armrest2_brep = rg.Brep.CreateFromBox(armrest2_box)
    armrest2 = sc.doc.Objects.AddBrep(armrest2_brep)
    chair_parts.append(armrest2_brep)

    # Create chair backrest shape
    backrest_width = width * 0.9
    backrest_height = height * 0.9
    backrest_curve = rg.Curve.CreateInterpolatedCurve([
        rg.Point3d(-backrest_width / 2, -depth / 2, height / 10),
        rg.Point3d(backrest_width / 2, -depth / 2, height / 10),
        rg.Point3d(backrest_width / 2, depth / 2, height / 10),
        rg.Point3d(-backrest_width / 2, depth / 2, height / 10),
        rg.Point3d(-backrest_width / 2, -depth / 2, height / 10)
    ], 3)
    backrest_extrusion = rg.Extrusion.Create(backrest_curve, backrest_height, True)
    backrest = sc.doc.Objects.AddExtrusion(backrest_extrusion)
    chair_parts.append(backrest_extrusion.ToBrep())

    # Join all chair parts
    chair = rg.Brep.JoinBreps(chair_parts, sc.doc.ModelAbsoluteTolerance)
    if chair:
        chair = chair[0]

    return chair, chair_parts

# Input parameters
#chair_width = 1.0  # Width of the chair
#chair_depth = 0.8  # Depth of the chair
#chair_height = 1.2  # Height of the chair
#leg_count = 4  # Number of chair legs

# Create chair
chair, chair_parts = create_chair(chair_width, chair_depth, chair_height, leg_count)

# Output the chair parts separately
a = chair_parts[0]  # Chair seat
b = chair_parts[1]  # Chair backrest
c = chair_parts[2:]  # Chair legs and other parts
# ---------- end ghpython_script_13 ----------
geometry_5 = Geometry(ghpython_script_11.a)
geometry_6 = Geometry(ghpython_script_11.b)
geometry_7 = Geometry(ghpython_script_11.c)
geometry_8 = Geometry(ghpython_script_11.d)
geometry_9 = Geometry(ghpython_script_11.e)
geometry_10 = Geometry(ghpython_script_11.f)
geometry_11 = Geometry(ghpython_script_11.g)
geometry_12 = Geometry(ghpython_script_11.h)
geometry_13 = Geometry(ghpython_script_11.i)
panel_11 = Panel(ghpython_script_11.out)
geometry_14 = Geometry(ghpython_script_13.c)
geometry_15 = Geometry(ghpython_script_13.b)
geometry_16 = Geometry(ghpython_script_13.a)
explode_tree = ExplodeTree(Data=graft(geometry_14))  # -> Branch0, Branch1, Branch2, Branch3, Branch4, Branch5, Branch6, Branch7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
geometry_17 = Geometry(ghpython_script_12.a)
geometry_18 = Geometry(ghpython_script_12.b)
geometry_19 = Geometry(ghpython_script_12.c)
geometry_20 = Geometry(ghpython_script_12.d)
geometry_21 = Geometry(ghpython_script_12.e)
geometry_22 = Geometry(ghpython_script_12.f)
geometry_23 = Geometry(ghpython_script_12.g)
geometry_24 = Geometry(ghpython_script_12.h)
geometry_25 = Geometry(ghpython_script_12.i)
panel_12 = Panel(ghpython_script_13.out)
geometry_26 = Geometry(explode_tree.Branch3)
geometry_27 = Geometry(explode_tree.Branch6)
geometry_28 = Geometry(explode_tree.Branch1)
geometry_29 = Geometry(explode_tree.Branch2)
geometry_30 = Geometry(explode_tree.Branch5)
geometry_31 = Geometry(explode_tree.Branch0)
geometry_32 = Geometry(explode_tree.Branch4)
geometry_33 = Geometry(explode_tree.Branch7)
geometry_34 = Geometry(explode_tree.Branch8)
