# Grasshopper definition floorPlan_001.gh (Grasshopper 1.0.7)

# Architectural Parametric
# Digital Assets
# gpt-4 into ghpython node
number_slider = Slider(40, range=0..100)
# Floor Plan
ghpython_script = GhPythonScript(
    popSize=number_slider,
    numGen=Slider(8, range=0..10),
    mutRate=Slider(0.07, range=0..1),
    Ax=Slider(12.85, range=1..20),
    Ay=Slider(6.16, range=1..20),
    Bx=Slider(14.33, range=1..20),
    By=Slider(7.01, range=1..20),
    Cx=Slider(20, range=1..20),
    Cy=Slider(20, range=1..20),
    Dx=Slider(7.51, range=1..20),
    Dy=Slider(19.07, range=1..20),
    Ex=Slider(4.69, range=1..20),
    Ey=Slider(12.43, range=1..20))  # -> out, a; inputs popSize: Int32, numGen: Int32
# ---------- ghpython_script: Python ----------
import Rhino.Geometry as rg
import random
import scriptcontext

# Room dimensions
room_dims = [(Ax, Ay), (Bx, By), (Cx, Cy), (Dx, Dy), (Ex, Ey)]

# House boundary
boundary = rg.Rectangle3d(rg.Plane.WorldXY, rg.Interval(0, 100), rg.Interval(0, 100)).ToPolyline().ToNurbsCurve()

# Number of individuals in each generation
population_size = popSize

# Number of generations
num_generations = numGen

# Mutation rate
mutation_rate = mutRate

# Fitness function
def fitness(individual):
    area_outside = 0
    overlap = 0
    for i, room in enumerate(individual):
        room_curve = room.ToPolyline().ToNurbsCurve()
        containment = rg.Curve.PlanarClosedCurveRelationship(boundary, room_curve, rg.Plane.WorldXY, 0.01)
        if not containment == rg.RegionContainment.AInsideB and not containment == rg.RegionContainment.BInsideA:
            area_outside += rg.AreaMassProperties.Compute(room_curve).Area
        for room2 in individual[i+1:]:
            if rg.Intersect.Intersection.CurveCurve(room_curve, room2.ToPolyline().ToNurbsCurve(), 0.01, 0.01):
                overlap += 1
    return area_outside, overlap


# Crossover function
def crossover(parent1, parent2):
    index = random.randrange(1, len(parent1))
    return parent1[:index] + parent2[index:], parent2[:index] + parent1[index:]

# Mutation function
def mutate(individual):
    for room in individual:
        if random.random() < mutation_rate:
            room.Transform(rg.Transform.Translation(random.uniform(-10, 10), random.uniform(-10, 10), 0))
    return individual,

# Generate initial population
population = []
for _ in range(population_size):
    individual = []
    for width, height in room_dims:
        bottom_left = rg.Point3d(random.uniform(0, 100 - width), random.uniform(0, 100 - height), 0)
        top_right = rg.Point3d(bottom_left.X + width, bottom_left.Y + height, 0)
        room = rg.Rectangle3d(rg.Plane.WorldXY, bottom_left, top_right)
        individual.append(room)
    population.append(individual)

# Evolutionary algorithm
for generation in range(num_generations):
    # Calculate fitness of each individual in the population
    fitnesses = [fitness(individual) for individual in population]

    # Select individuals to reproduce (higher fitness = higher probability to be selected)
    mating_pool = [random.choice(population) for _ in range(population_size)]


    # Create next generation through crossover and mutation
    next_generation = []
    for _ in range(population_size // 2):
        parent1 = random.choice(mating_pool)
        parent2 = random.choice(mating_pool)
        offspring1, offspring2 = crossover(parent1, parent2)
        next_generation += mutate(offspring1)
        next_generation += mutate(offspring2)

    # Replace current population with new generation
    population = next_generation

best_solution = min(population, key=fitness)
print("Best solution fitness:", fitness(best_solution))

# Convert each room in the best solution to a PolylineCurve
a = [room.ToPolyline() for room in best_solution]
# ---------- end ghpython_script ----------
geometry = Geometry(ghpython_script.a)
