# Grasshopper definition mobius_loop_001.gh (Grasshopper 1.0.7)

ghpython_script = GhPythonScript(
    radius=Slider(3.4, range=0..10),
    width=Slider(0, range=0..10),
    twists=Slider(3, range=0..10),
    divisions=Slider(100, range=0..100))  # -> out, aOut; inputs twists: Int32, divisions: Int32
# ---------- ghpython_script: Python ----------
import Rhino.Geometry as rg
import math

def create_moebius_loop(radius, width, twists, divisions):
    # Create an empty list to store the curve segments
    segments = []

    # Calculate the angle increment based on the number of divisions
    angle_increment = 2 * math.pi / divisions

    # Iterate over the divisions and create curve segments
    for i in range(divisions):
        t = i * angle_increment
        x = (radius + width * math.cos(t / twists)) * math.cos(t)
        y = (radius + width * math.cos(t / twists)) * math.sin(t)
        z = width * math.sin(t / twists)

        # Create a point based on the calculated coordinates
        point = rg.Point3d(x, y, z)

        # Add the point to the list of curve segments
        segments.append(point)

    # Create a closed curve from the segments
    curve = rg.Curve.CreateControlPointCurve(segments, 3)

    # Create a surface by extruding the curve along a vector
    vector = rg.Vector3d(0, 0, 1)  # Extrusion direction
    surface = rg.Surface.CreateExtrusion(curve, vector)

    # Return the resulting surface
    return surface

# Define the input parameters
#radius = 10.0
#width = 5.0
#twists = 3
#divisions = 100

# Call the function to create the Möbius loop surface
moebius_loop_surface = create_moebius_loop(radius, width, twists, divisions)

# Output the resulting surface
aOut = moebius_loop_surface
# ---------- end ghpython_script ----------
ghpython_script_2 = GhPythonScript(
    radius=Slider(10, range=0..10),
    width=Slider(4.9, range=0..10),
    twists=Slider(1, range=0..10),
    divisions=Slider(100, range=0..100))  # -> out, aOut; inputs twists: Int32, divisions: Int32
# ---------- ghpython_script_2: Python ----------
import Rhino.Geometry as rg
import math

def create_mobius_loop(radius, width, twists, divisions):
    # Create an empty list to store the curve segments
    segments = []

    # Calculate the angle increment based on the number of divisions
    angle_increment = 2 * math.pi / divisions

    # Iterate over the divisions and create curve segments
    for i in range(divisions):
        t = i * angle_increment

        # Calculate the coordinates of the point on the Möbius loop
        x = (radius + width * math.cos(t / twists)) * math.cos(t)
        y = (radius + width * math.cos(t / twists)) * math.sin(t)
        z = width * math.sin(t / twists)

        # Create a point based on the calculated coordinates
        point = rg.Point3d(x, y, z)

        # Add the point to the list of curve segments
        segments.append(point)

    # Create a closed curve from the segments
    curve = rg.Curve.CreateControlPointCurve(segments, 3)

    # Create a surface by sweeping the closed curve along a straight line
    sweep_distance = width
    sweep_vector = rg.Vector3d(0, 0, sweep_distance)
    surface = rg.Surface.CreateExtrusion(curve, sweep_vector)

    # Flatten the surface to make it planar
    surface = surface.ToBrep().Surfaces[0].ToNurbsSurface()

    # Return the resulting surface
    return surface

# Define the input parameters
#radius = 10.0
#width = 2.0
#twists = 1
#divisions = 100

# Call the function to create the Möbius loop surface
mobius_loop_surface = create_mobius_loop(radius, width, twists, divisions)

# Output the resulting surface
aOut = mobius_loop_surface
# ---------- end ghpython_script_2 ----------
# Architectural Parametric
# Digital Assets
# gpt-4 into ghpython node
# #Text prompting in GPT-4 at www.wickersonstudios.com
# mobius loop
ghpython_script_3 = GhPythonScript()  # -> out, aOut
# ---------- ghpython_script_3: Python ----------
import Rhino.Geometry as rg
import math

def create_moebius_loop(radius, width, twists, divisions):
    # Create an empty list to store the curve segments
    segments = []

    # Calculate the angle increment based on the number of divisions
    angle_increment = 2 * math.pi / divisions

    # Iterate over the divisions and create curve segments
    for i in range(divisions):
        t = i * angle_increment
        x = (radius + width * math.cos(t / twists)) * math.cos(t)
        y = (radius + width * math.cos(t / twists)) * math.sin(t)
        z = width * math.sin(t / twists)

        # Create a point based on the calculated coordinates
        point = rg.Point3d(x, y, z)

        # Add the point to the list of curve segments
        segments.append(point)

    # Create a closed curve from the segments
    curve = rg.Curve.CreateControlPointCurve(segments, 3)

    # Return the resulting curve
    return curve

# Define the input parameters
radius = 10.0
width = 5.0
twists = 3
divisions = 100

# Call the function to create the Moebius loop curve
moebius_loop = create_moebius_loop(radius, width, twists, divisions)

# Output the resulting curve
aOut = moebius_loop
# ---------- end ghpython_script_3 ----------
geometry = Geometry(ghpython_script_2.aOut)
geometry_2 = Geometry(ghpython_script_3.aOut)
geometry_3 = Geometry(ghpython_script.aOut)
panel = Panel(ghpython_script.out)
panel_2 = Panel(ghpython_script_2.out)
panel_3 = Panel(ghpython_script_3.out)
