# Grasshopper definition paneling_001.gh (Grasshopper 1.0.7)
# plug-ins: Kangaroo2 Components

quad_sphere = QuadSphere(Base=PlaneXY(0, 0, 0), Radius=Slider(12, range=0..100))
# gpt-4 into ghpython node
# #Text prompting in GPT-4 at www.wickersonstudios.com
deconstruct_brep = DeconstructBrep(Brep=quad_sphere)  # -> Faces, Edges, Vertices
surface = Surface(deconstruct_brep.Faces)
# paneling
ghpython_script = GhPythonScript(surface=surface, divisions=Slider(10, range=0..10))  # -> out, pattern; inputs surface: Surface, divisions: Int32
# ---------- ghpython_script: Python ----------
import Rhino
import rhinoscriptsyntax as rs
import math

# Inputs to the GhPython Component
# "surface" input - Connect it with a surface parameter in Grasshopper
# "divisions" input - Connect it with a slider (int) in Grasshopper to control the number of divisions

def create_pattern(surface, divisions):
    # Check if the surface is valid
    if not surface: return

    # Get the surface domain
    u_domain = surface.Domain(0)
    v_domain = surface.Domain(1)
    
    # Initialize the array for panel curves
    curves = []

    # Divide the surface into segments and create pattern
    for i in range(divisions):
        for j in range(divisions):
            # Calculate parameter values for surface division points
            u = u_domain.ParameterAt(i/divisions)
            v = v_domain.ParameterAt(j/divisions)
            
            # Get surface points
            pt1 = surface.PointAt(u, v)
            pt2 = surface.PointAt(u + u_domain.Length / divisions, v)
            pt3 = surface.PointAt(u + u_domain.Length / divisions, v + v_domain.Length / divisions)
            pt4 = surface.PointAt(u, v + v_domain.Length / divisions)
            
            # Modify points for an interesting pattern
            pt1.Z += math.sin(i) * 0.5
            pt2.Z += math.cos(j) * 0.5
            pt3.Z += math.sin(i+j) * 0.5
            pt4.Z += math.cos(i-j) * 0.5
            
            # Create a panel from the points
            panel = Rhino.Geometry.Curve.CreateInterpolatedCurve([pt1, pt2, pt3, pt4, pt1], 3)
            
            # Add the panel to the curves array
            curves.append(panel)

    # Return the array of curves
    return curves

# Call the function and assign the output to a variable that Grasshopper can read
pattern = create_pattern(surface, divisions)
# ---------- end ghpython_script ----------
geometry = Geometry(ghpython_script.pattern)
panel = Panel(ghpython_script.out)
multipipe = MultiPipe(
    Curves=geometry,
    NodeSize=Slider(0.22, range=0..1),
    EndOffset=1,
    StrutSize=1,
    Segment=0,
    KinkAngle=0.6,
    CubeFit=0,
    Caps=0)
