# Grasshopper definition recursive_morph_001.gh (Grasshopper 1.0.7)

number_slider = Slider(-1, range=-1..1)
number_slider_2 = Slider(1, range=-1..1)
# gpt-4 into ghpython node
# #Text prompting in GPT-4 at www.wickersonstudios.com
construct_point = ConstructPoint(XCoordinate=0, YCoordinate=0, ZCoordinate=0)
unit_x = UnitX(Factor=1)
unit_y = UnitY(Factor=1)
# recursive morph
ghpython_script = GhPythonScript(
    origin=construct_point,
    x_dir=unit_x,
    y_dir=unit_y,
    Xx=number_slider,
    Xy=number_slider_2,
    Yx=number_slider,
    Yy=number_slider_2,
    Zx=number_slider,
    Zy=number_slider_2,
    depth=Slider(1, range=0..3))  # -> out, a; inputs origin: Point3d, x_dir: Vector3d, y_dir: Vector3d, depth: Int32
# ---------- ghpython_script: Python ----------
import Rhino.Geometry as rg
import random

def recursive_box(box, depth):
    if depth == 0:
        return [box]
    
    boxes = []
    
    for i in [-1, 1]:
        for j in [-1, 1]:
            for k in [-1, 1]:
                corner = box.Center + rg.Vector3d(i * box.X.Length/4, j * box.Y.Length/4, k * box.Z.Length/4)
                newBox = rg.Box(box.Plane, box.X, box.Y, box.Z)
                newBox.Transform(rg.Transform.Scale(corner, 0.5))
                boxes.extend(recursive_box(newBox, depth - 1))
                
    return boxes

# Create the initial plane and box.
#origin = rg.Point3d(0, 0, 0)
#x_dir = rg.Vector3d(1, 0, 0)
#y_dir = rg.Vector3d(0, 1, 0)
plane = rg.Plane(origin, x_dir, y_dir)
box = rg.Box(plane, rg.Interval(Xx, Xy), rg.Interval(Yx, Yy), rg.Interval(Zx, Zy))

# Generate the recursive boxes.
#depth = 3 # adjust depth for more/less complexity
a = recursive_box(box, depth)  # assign the output to 'a'
# ---------- end ghpython_script ----------
panel = Panel(ghpython_script.out)
geometry = Geometry(ghpython_script.a)
