# Grasshopper definition shoe_001.gh (Grasshopper 1.0.7)

instep_radius = Slider(3.08, range=0..10)
instep_radius_2 = Slider(3.08, range=0..10)
toe_radius = Slider(4.1, range=0..10)
heel_radius = Slider(3.6, range=0..10)
heel_height = Slider(4.2, range=0..10)
length = Slider(12.38, range=0..100)
toe_radius_2 = Slider(4.1, range=0..10)
heel_radius_2 = Slider(3.6, range=0..10)
length_2 = Slider(12.38, range=0..100)
heel_height_2 = Slider(4.2, range=0..10)
instep_height = Slider(3.6, range=0..10)
instep_height_2 = Slider(3.6, range=0..10)
instep_height_3 = Slider(1.6, range=0..10)
instep_height_4 = Slider(1.6, range=0..10)
heel_radius_3 = Slider(1.5, range=0..10)
heel_height_3 = Slider(4, range=0..10)
heel_radius_4 = Slider(1.5, range=0..10)
instep_radius_3 = Slider(6.35, range=0..10)
heel_height_4 = Slider(4, range=0..10)
length_3 = Slider(22.3, range=0..100)
toe_radius_3 = Slider(6.4, range=0..10)
length_4 = Slider(11.78, range=0..100)
toe_radius_4 = Slider(1.9, range=0..10)
instep_radius_4 = Slider(2.83, range=0..10)
length_5 = Slider(0.48, range=0..10)
toe_radius_5 = Slider(0.76, range=0..10)
instep_radius_5 = Slider(0.1, range=0..10)
heel_radius_5 = Slider(1.81, range=0..10)
instep_height_5 = Slider(0.56, range=0..10)
instep_radius_6 = Slider(2.79, range=0..10)
instep_height_6 = Slider(1.7, range=0..10)
length_6 = Slider(11.2, range=0..100)
toe_radius_6 = Slider(2.5, range=0..10)
heel_radius_6 = Slider(1.6, range=0..10)
heel_height_5 = Slider(1.9, range=0..10)
heel_height_6 = Slider(0.57, range=0..10)
# parametric shoe
ghpython_script = GhPythonScript(length=length, width=toe_radius, height=instep_radius, toe_height=heel_radius, heel_height=instep_height)  # -> out, A, B, C
# ---------- ghpython_script: Python ----------
import Rhino.Geometry as rg

# Input parameters:
# length : float : Length of the shoe
# width : float : Width of the shoe
# height : float : Maximum height of the shoe
# toe_height : float : Height of the toe
# heel_height : float : Height of the heel

# Define curve control points
toe_points = [rg.Point3d(0, -width/2, 0), rg.Point3d(length/4, -width/2, toe_height), rg.Point3d(length/2, -width/2, 0)]
instep_points = [rg.Point3d(0, 0, 0), rg.Point3d(length/4, 0, height), rg.Point3d(length/2, 0, 0)]
heel_points = [rg.Point3d(0, width/2, 0), rg.Point3d(length/4, width/2, heel_height), rg.Point3d(length/2, width/2, 0)]

# Create curves
toe_curve = rg.Curve.CreateControlPointCurve(toe_points, 2)
instep_curve = rg.Curve.CreateControlPointCurve(instep_points, 2)
heel_curve = rg.Curve.CreateControlPointCurve(heel_points, 2)

# Mirror curves to other side
mirror_plane = rg.Plane.WorldYZ
toe_curve_mirror = toe_curve.Duplicate() # Duplicate the curve before mirroring
toe_curve_mirror.Transform(rg.Transform.Mirror(mirror_plane))

instep_curve_mirror = instep_curve.Duplicate() # Duplicate the curve before mirroring
instep_curve_mirror.Transform(rg.Transform.Mirror(mirror_plane))

heel_curve_mirror = heel_curve.Duplicate() # Duplicate the curve before mirroring
heel_curve_mirror.Transform(rg.Transform.Mirror(mirror_plane))

# Loft the curves to create surfaces
toe_surface = rg.Brep.CreateFromLoft([toe_curve, toe_curve_mirror], rg.Point3d.Unset, rg.Point3d.Unset, rg.LoftType.Normal, False)[0]
instep_surface = rg.Brep.CreateFromLoft([instep_curve, instep_curve_mirror], rg.Point3d.Unset, rg.Point3d.Unset, rg.LoftType.Normal, False)[0]
heel_surface = rg.Brep.CreateFromLoft([heel_curve, heel_curve_mirror], rg.Point3d.Unset, rg.Point3d.Unset, rg.LoftType.Normal, False)[0]

# Output
A = toe_surface
B = instep_surface
C = heel_surface
# ---------- end ghpython_script ----------
# parametric shoe
ghpython_script_2 = GhPythonScript(length=length_2, width=toe_radius_2, height=instep_radius_2, toe_height=heel_radius_2, heel_height=instep_height_2)  # -> out, A, B, C; same code as ghpython_script
curve = Curve([<curve referenced from the Rhino model> x3])
# gpt-4 into ghpython node
# #Text prompting in GPT-4 at www.wickersonstudios.com
curve_2 = Curve([<curve referenced from the Rhino model> x5])
# parametric shoe
ghpython_script_3 = GhPythonScript(length=length_3, width=toe_radius_3, height=instep_radius_3, p=heel_radius_3, q=instep_height_3, r=heel_height_3)  # -> out, A, B, C
# ---------- ghpython_script_3: Python ----------
import Rhino.Geometry as rg

# Define parameters for shoe
#length = 12.0 # in inches
#width = 4.0 # in inches
#height = 4.0 # in inches

# Define curve control points
toe_points = [rg.Point3d(0, -width/2, 0), rg.Point3d(length/4, -width/2, height/3), rg.Point3d(length/2, -width/2, 0)]
instep_points = [rg.Point3d(0, 0, 0), rg.Point3d(length/4, 0, height), rg.Point3d(length/2, 0, 0)]
heel_points = [rg.Point3d(0, width/2, 0), rg.Point3d(length/4, width/2, height/3), rg.Point3d(length/2, width/2, 0)]

# Create curves
toe_curve = rg.Curve.CreateControlPointCurve(toe_points, 2)
instep_curve = rg.Curve.CreateControlPointCurve(instep_points, 2)
heel_curve = rg.Curve.CreateControlPointCurve(heel_points, 2)

# Mirror curves to other side
mirror_plane = rg.Plane.WorldYZ
toe_curve_mirror = toe_curve.Duplicate() # Duplicate the curve before mirroring
toe_curve_mirror.Transform(rg.Transform.Mirror(mirror_plane))

instep_curve_mirror = instep_curve.Duplicate() # Duplicate the curve before mirroring
instep_curve_mirror.Transform(rg.Transform.Mirror(mirror_plane))

heel_curve_mirror = heel_curve.Duplicate() # Duplicate the curve before mirroring
heel_curve_mirror.Transform(rg.Transform.Mirror(mirror_plane))

# Loft the curves to create surfaces
toe_surface = rg.Brep.CreateFromLoft([toe_curve, toe_curve_mirror], rg.Point3d.Unset, rg.Point3d.Unset, rg.LoftType.Normal, False)[0]
instep_surface = rg.Brep.CreateFromLoft([instep_curve, instep_curve_mirror], rg.Point3d.Unset, rg.Point3d.Unset, rg.LoftType.Normal, False)[0]
heel_surface = rg.Brep.CreateFromLoft([heel_curve, heel_curve_mirror], rg.Point3d.Unset, rg.Point3d.Unset, rg.LoftType.Normal, False)[0]

# Output
A = toe_surface
B = instep_surface
C = heel_surface
# ---------- end ghpython_script_3 ----------
# parametric shoe
ghpython_script_4 = GhPythonScript(x=length_6, y=toe_radius_6, z=instep_radius_6, p=heel_radius_6, q=instep_height_6, r=heel_height_5)  # -> out, A, B, C
# ---------- ghpython_script_4: Python ----------
import Rhino.Geometry as rg
import math

def create_part(center, radius, height, direction=1):
    """Create a cylinder to represent a part of the shoe"""
    base_circle = rg.Circle(center, radius)
    base_cylinder = rg.Cylinder(base_circle, height)
    base_brep = base_cylinder.ToBrep(True, True)
    
    # direction controls whether the part is above or below the base plane
    if direction == -1:
        base_brep.Translate(rg.Vector3d(0, 0, -height))
    
    return base_brep

def create_shoe(length, toe_radius, instep_radius, heel_radius, instep_height, heel_height):
    # toe box
    toe_center = rg.Point3d(-length/3, 0, 0)
    toe = create_part(toe_center, toe_radius, instep_height)
    
    # instep
    instep_center = rg.Point3d(0, 0, 0)
    instep = create_part(instep_center, instep_radius, instep_height)
    
    # heel
    heel_center = rg.Point3d(length/3, 0, 0)
    heel = create_part(heel_center, heel_radius, heel_height, direction=-1)
    
    return toe, instep, heel

# Hardcoded parameters in inches
length = x  # inches
toe_radius = y  # inches
instep_radius = z  # inches
heel_radius = p  # inches
instep_height = q  # inches
heel_height = r  # inches

# Output
toe_brep, instep_brep, heel_brep = create_shoe(length, toe_radius, instep_radius, heel_radius, instep_height, heel_height)
A = toe_brep
B = instep_brep
C = heel_brep
# ---------- end ghpython_script_4 ----------
# parametric shoe
ghpython_script_5 = GhPythonScript(x=length_4, y=toe_radius_4, z=instep_radius_4, p=heel_radius_4, q=instep_height_4, r=heel_height_4)  # -> out, A, B, C
# ---------- ghpython_script_5: Python ----------
import Rhino.Geometry as rg

# Define parameters for shoe
length = 12.0 # in inches
width = 4.0 # in inches
height = 4.0 # in inches

# Define curve control points
toe_points = [rg.Point3d(0, -width/2, 0), rg.Point3d(length/4, -width/2, height/3), rg.Point3d(length/2, -width/2, 0)]
instep_points = [rg.Point3d(0, 0, 0), rg.Point3d(length/4, 0, height), rg.Point3d(length/2, 0, 0)]
heel_points = [rg.Point3d(0, width/2, 0), rg.Point3d(length/4, width/2, height/3), rg.Point3d(length/2, width/2, 0)]

# Create curves
toe_curve = rg.Curve.CreateControlPointCurve(toe_points, 2)
instep_curve = rg.Curve.CreateControlPointCurve(instep_points, 2)
heel_curve = rg.Curve.CreateControlPointCurve(heel_points, 2)

# Mirror curves to other side
mirror_plane = rg.Plane.WorldYZ
toe_curve_mirror = toe_curve.Duplicate() # Duplicate the curve before mirroring
toe_curve_mirror.Transform(rg.Transform.Mirror(mirror_plane))

instep_curve_mirror = instep_curve.Duplicate() # Duplicate the curve before mirroring
instep_curve_mirror.Transform(rg.Transform.Mirror(mirror_plane))

heel_curve_mirror = heel_curve.Duplicate() # Duplicate the curve before mirroring
heel_curve_mirror.Transform(rg.Transform.Mirror(mirror_plane))

# Loft the curves to create surfaces
toe_surface = rg.Brep.CreateFromLoft([toe_curve, toe_curve_mirror], rg.Point3d.Unset, rg.Point3d.Unset, rg.LoftType.Normal, False)
instep_surface = rg.Brep.CreateFromLoft([instep_curve, instep_curve_mirror], rg.Point3d.Unset, rg.Point3d.Unset, rg.LoftType.Normal, False)
heel_surface = rg.Brep.CreateFromLoft([heel_curve, heel_curve_mirror], rg.Point3d.Unset, rg.Point3d.Unset, rg.LoftType.Normal, False)

# Join surfaces into a single Brep
shoe_brep = rg.Brep.JoinBreps([toe_surface[0], instep_surface[0], heel_surface[0]], 0.01)

# Output
if shoe_brep:
    A = shoe_brep[0] # There should be only one Brep in the list
else:
    A = None
# ---------- end ghpython_script_5 ----------
# parametric shoe
ghpython_script_6 = GhPythonScript(
    x=Slider(0.3, range=0..1),
    y=Slider(0.04, range=0..0.1),
    z=Slider(0.05, range=0..0.1),
    p=Slider(0.03, range=0..0.1),
    q=Slider(0.06, range=0..0.1),
    r=Slider(0.04, range=0..0.1))  # -> out, A, B, C
# ---------- ghpython_script_6: Python ----------
import Rhino.Geometry as rg
import math

def create_part(center, radius, height, direction=1):
    """Create a cylinder to represent a part of the shoe"""
    base_circle = rg.Circle(center, radius)
    base_cylinder = rg.Cylinder(base_circle, height)
    base_brep = base_cylinder.ToBrep(True, True)
    
    # direction controls whether the part is above or below the base plane
    if direction == -1:
        base_brep.Translate(rg.Vector3d(0, 0, -height))
    
    return base_brep

def create_shoe(length, toe_radius, instep_radius, heel_radius, instep_height, heel_height):
    # toe box
    toe_center = rg.Point3d(-length/3, 0, 0)
    toe = create_part(toe_center, toe_radius, instep_height)
    
    # instep
    instep_center = rg.Point3d(0, 0, 0)
    instep = create_part(instep_center, instep_radius, instep_height)
    
    # heel
    heel_center = rg.Point3d(length/3, 0, 0)
    heel = create_part(heel_center, heel_radius, heel_height, direction=-1)
    
    # Join the parts
    shoe_parts = rg.Brep.JoinBreps([toe, instep, heel], tolerance=0.01)
    
    if shoe_parts:
        shoe = shoe_parts[0]  # There should be only one Brep in the list
    else:
        shoe = None

    return shoe

# Input parameters
length = x
toe_radius = y
instep_radius = z
heel_radius = p
instep_height = q
heel_height = r

# Output
A = create_shoe(length, toe_radius, instep_radius, heel_radius, instep_height, heel_height)
# ---------- end ghpython_script_6 ----------
# parametric shoe
ghpython_script_7 = GhPythonScript(x=length_5, y=toe_radius_5, z=instep_radius_5, p=heel_radius_5, q=instep_height_5, r=heel_height_6)  # -> out, A; same code as ghpython_script_6
# parametric shoe
ghpython_script_8 = GhPythonScript(a=Slider(5.8, range=0..10), b=Slider(2.54, range=0..10), c=Slider(1.13, range=0..10))  # -> out, b, A
# ---------- ghpython_script_8: Python ----------
import Rhino.Geometry as rg

# Check if the inputs are not None
if a is not None and b is not None and c is not None:
    # We assume 'a', 'b', and 'c' are input parameters and represent the length, width, and height respectively
    length = a
    width = b
    height = c

    # Create a box (shoe box form) based on the inputs
    base_plane = rg.Plane.WorldXY
    interval_x = rg.Interval(-length/2, length/2)
    interval_y = rg.Interval(-width/2, width/2)
    interval_z = rg.Interval(0, height)
    shoe_box = rg.Box(base_plane, interval_x, interval_y, interval_z)

    # Create a Brep form of the box
    shoe_form = shoe_box.ToBrep()

else:
    shoe_form = None

# Output
A = shoe_form
# ---------- end ghpython_script_8 ----------
# parametric shoe
ghpython_script_9 = GhPythonScript(a=curve_2, b=curve)  # -> out, A; inputs a: Curve, b: Curve
# ---------- ghpython_script_9: Python ----------
import Rhino.Geometry as rg

# Check if the inputs are not None
if a is not None and b is not None:
    # We assume 'a' and 'b' are input parameters and represent the profile and sole curves respectively
    profile_crv = a
    sole_crv = b

    # Check direction and reverse if needed
    if rg.Curve.DoDirectionsMatch(profile_crv, sole_crv) == False:
        sole_crv.Reverse()

    # Create a list to hold the curves that will be used to loft
    crvs_to_loft = [profile_crv, sole_crv]

    # Loft the curves to create the basic shoe form
    loft_type = rg.LoftType.Normal
    closed_loft = False
    loft = rg.Brep.CreateFromLoft(crvs_to_loft, rg.Point3d.Unset, rg.Point3d.Unset, loft_type, closed_loft)

    if loft:
        shoe_form = loft[0]  # There should be only one Brep in the list
    else:
        shoe_form = None
else:
    shoe_form = None

# Output
A = shoe_form
# ---------- end ghpython_script_9 ----------
geometry = Geometry(ghpython_script.A)
geometry_2 = Geometry(ghpython_script.B)
geometry_3 = Geometry(ghpython_script.C)
geometry_4 = Geometry(ghpython_script_2.C)
geometry_5 = Geometry(ghpython_script_2.A)
geometry_6 = Geometry(ghpython_script_2.B)
geometry_7 = Geometry(ghpython_script_3.A)
geometry_8 = Geometry(ghpython_script_3.B)
geometry_9 = Geometry(ghpython_script_3.C)
geometry_10 = Geometry(ghpython_script_5.A)
geometry_11 = Geometry(ghpython_script_5.B)
geometry_12 = Geometry(ghpython_script_5.C)
geometry_13 = Geometry(ghpython_script_4.A)
geometry_14 = Geometry(ghpython_script_4.B)
geometry_15 = Geometry(ghpython_script_4.C)
geometry_16 = Geometry(ghpython_script_6.A)
geometry_17 = Geometry(ghpython_script_6.C)
geometry_18 = Geometry(ghpython_script_7.A)
geometry_19 = Geometry(ghpython_script_6.B)
geometry_20 = Geometry(ghpython_script_9.A)
geometry_21 = Geometry(ghpython_script_8.A)
panel = Panel(ghpython_script.out)
panel_2 = Panel(ghpython_script_2.out)
panel_3 = Panel(ghpython_script_3.out)
panel_4 = Panel(ghpython_script_5.out)
panel_5 = Panel(ghpython_script_4.out)
panel_6 = Panel(ghpython_script_6.out)
panel_7 = Panel(ghpython_script_7.out)
panel_8 = Panel(ghpython_script_8.out)
panel_9 = Panel(ghpython_script_9.out)
