# Grasshopper definition temple_001.gh (Grasshopper 1.0.7)
# Copyright: © 2017-2022 Pierre Cuvilliers, Caitlin Mueller, Massachusetts Institute of Technology
# plug-ins: Hops

num_columns = Slider(11, range=0..100)
height = Slider(24.2, range=0..100)
height_2 = Slider(27.1, range=0..100)
num_columns_2 = Slider(4, range=0..100)
column_radius = Slider(3.06, range=0..10)
column_height = Slider(26.5, range=0..100)
column_radius_2 = Slider(4.14, range=0..10)
column_height_2 = Slider(31.3, range=0..100)
width = Slider(62.3, range=0..100)
num_columns_3 = Slider(17, range=0..100)
height_3 = Slider(24.2, range=0..100)
width_2 = Slider(100, range=0..100)
length = Slider(67.8, range=0..100)
column_radius_3 = Slider(3.5, range=0..10)
column_height_3 = Slider(24.1, range=0..100)
num_columns_4 = Slider(6, range=0..100)
width_3 = Slider(62.3, range=0..100)
num_columns_5 = Slider(5, range=0..100)
length_2 = Slider(44.2, range=0..100)
column_radius_4 = Slider(6.01, range=0..10)
length_3 = Slider(67.8, range=0..100)
num_columns_6 = Slider(11, range=0..100)
height_4 = Slider(27.1, range=0..100)
num_columns_7 = Slider(4, range=0..100)
column_radius_5 = Slider(4.14, range=0..10)
column_height_4 = Slider(31.3, range=0..100)
width_4 = Slider(100, range=0..100)
column_radius_6 = Slider(6.01, range=0..10)
num_columns_8 = Slider(6, range=0..100)
length_4 = Slider(44.2, range=0..100)

# ----
# temple
height_5 = Slider(16.3, range=0..100)
column_radius_7 = Slider(3.5, range=0..10)
column_height_5 = Slider(15.2, range=0..100)
width_5 = Slider(41.8, range=0..100)
num_columns_9 = Slider(7, range=0..100)
length_5 = Slider(66.9, range=0..100)
ghpython_script = GhPythonScript(x=length_5, y=width_5, z=height_5, u=column_radius_7, v=column_height_5, w=num_columns_9)  # -> out, A, B, C; inputs w: Int32
# ---------- ghpython_script: Python ----------
import rhinoscriptsyntax as rs
import math

# Create a Greek temple
def create_greek_temple(length, width, height, column_radius, column_height, num_columns):
    # create the base
    base = rs.AddBox([
        (-length/2, -width/2, 0),
        (length/2, -width/2, 0),
        (length/2, width/2, 0),
        (-length/2, width/2, 0),
        (-length/2, -width/2, -height),
        (length/2, -width/2, -height),
        (length/2, width/2, -height),
        (-length/2, width/2, -height)
    ])
    
    # create the roof
    roof_height = height/2
    roof = rs.AddBox([
        (-length/2+length/5, -width/2+width/5, height),
        (length/2-length/5, -width/2+width/5, height),
        (length/2-length/5, width/2-width/5, height),
        (-length/2+length/5, width/2-width/5, height),
        (-length/2+length/5, -width/2+width/5, height+roof_height),
        (length/2-length/5, -width/2+width/5, height+roof_height),
        (length/2-length/5, width/2-width/5, height+roof_height),
        (-length/2+length/5, width/2-width/5, height+roof_height)
    ])
    
    # create columns
    columns = []
    for i in range(num_columns):
        angle = (2.0 * math.pi / num_columns) * i
        x = (length/2 - column_radius) * math.cos(angle)
        y = (width/2 - column_radius) * math.sin(angle)
        base_pt = rs.CreatePoint(x, y, 0)
        top_pt = rs.CreatePoint(x, y, column_height)
        column = rs.AddCylinder(base_pt, top_pt, column_radius)
        columns.append(column)

    return base, roof, columns

# parameters
length = x
width = y
height = z
column_radius = u
column_height = v
num_columns = w

base, roof, columns = create_greek_temple(length, width, height, column_radius, column_height, num_columns)

# assign outputs
A = base
B = roof
C = columns
# ---------- end ghpython_script ----------
geometry = Geometry(ghpython_script.C)
geometry_2 = Geometry(ghpython_script.A)
geometry_3 = Geometry(ghpython_script.B)
panel = Panel(ghpython_script.out)

height_6 = Slider(24.2, range=0..100)
column_height_6 = Slider(24.1, range=0..100)
column_radius_8 = Slider(3.5, range=0..10)
num_columns_10 = Slider(11, range=0..100)
height_7 = Slider(27.1, range=0..100)
width_6 = Slider(62.3, range=0..100)
num_columns_11 = Slider(5, range=0..100)
column_radius_9 = Slider(4.14, range=0..10)
column_height_7 = Slider(31.3, range=0..100)
length_6 = Slider(67.8, range=0..100)
width_7 = Slider(100, range=0..100)
num_columns_12 = Slider(11, range=0..100)
num_columns_13 = Slider(11, range=0..100)
length_7 = Slider(44.2, range=0..100)
# temple
ghpython_script_2 = GhPythonScript(x=length, y=width, z=height, u=column_radius, v=column_height, w=num_columns_3)  # -> out, A, B, C; inputs w: Int32
# ---------- ghpython_script_2: Python ----------
import rhinoscriptsyntax as rs
import math

# Create a Greek temple
def create_greek_temple(length, width, base_height, column_radius, max_column_height, num_columns):
    # create the base
    base = rs.AddBox([
        (-length/2, -width/2, 0),
        (length/2, -width/2, 0),
        (length/2, width/2, 0),
        (-length/2, width/2, 0),
        (-length/2, -width/2, -base_height),
        (length/2, -width/2, -base_height),
        (length/2, width/2, -base_height),
        (-length/2, width/2, -base_height)
    ])

    # create the roof
    roof_height = base_height/2
    roof = rs.AddBox([
        (-length/2+length/5, -width/2+width/5, base_height),
        (length/2-length/5, -width/2+width/5, base_height),
        (length/2-length/5, width/2-width/5, base_height),
        (-length/2+length/5, width/2-width/5, base_height),
        (-length/2+length/5, -width/2+width/5, base_height+roof_height),
        (length/2-length/5, -width/2+width/5, base_height+roof_height),
        (length/2-length/5, width/2-width/5, base_height+roof_height),
        (-length/2+length/5, width/2-width/5, base_height+roof_height)
    ])

    # create columns
    columns = []
    fib_sequence = [1, 2]
    for i in range(2, num_columns):
        fib_sequence.append(fib_sequence[-1] + fib_sequence[-2])
    normalized_fib_sequence = [x / max(fib_sequence) * max_column_height for x in fib_sequence]
    for i in range(num_columns):
        angle = (2.0 * math.pi / num_columns) * i
        x = (length/2 - column_radius) * math.cos(angle)
        y = (width/2 - column_radius) * math.sin(angle)
        column_height = normalized_fib_sequence[i]
        base_pt = rs.CreatePoint(x, y, 0)
        top_pt = rs.CreatePoint(x, y, column_height)
        column = rs.AddCylinder(base_pt, top_pt, column_radius)
        columns.append(column)

    return base, roof, columns

# parameters

length = x
width = y
base_height = z
column_radius = u
max_column_height = v
num_columns = w

base, roof, columns = create_greek_temple(length, width, base_height, column_radius, max_column_height, num_columns)

# assign outputs
A = base
B = roof
C = columns
# ---------- end ghpython_script_2 ----------
# temple
ghpython_script_3 = GhPythonScript(
    x=length_2,
    y=width_2,
    z=height_2,
    a=column_radius_2,
    b=column_radius_4,
    v=column_height_2,
    m=num_columns_2,
    n=num_columns_4,
    s=num_columns)  # -> out, A, B, C; inputs m: Int32, n: Int32, s: Int32
# ---------- ghpython_script_3: Python ----------
import rhinoscriptsyntax as rs
import math

# Create a Greek temple
def create_greek_temple(length, width, base_height, column_width, column_depth, column_height, num_columns_x, num_columns_y, num_steps):
    # create the base with steps
    step_height = base_height / num_steps
    base = []
    for i in range(num_steps):
        base_part = rs.AddBox([
            (-length/2-i*length/(2*num_steps), -width/2-i*width/(2*num_steps), -i*step_height),
            (length/2+i*length/(2*num_steps), -width/2-i*width/(2*num_steps), -i*step_height),
            (length/2+i*length/(2*num_steps), width/2+i*width/(2*num_steps), -i*step_height),
            (-length/2-i*length/(2*num_steps), width/2+i*width/(2*num_steps), -i*step_height),
            (-length/2-i*length/(2*num_steps), -width/2-i*width/(2*num_steps), -(i+1)*step_height),
            (length/2+i*length/(2*num_steps), -width/2-i*width/(2*num_steps), -(i+1)*step_height),
            (length/2+i*length/(2*num_steps), width/2+i*width/(2*num_steps), -(i+1)*step_height),
            (-length/2-i*length/(2*num_steps), width/2+i*width/(2*num_steps), -(i+1)*step_height)
        ])
        base.append(base_part)
    
    # create the roof
    roof_height = base_height/2
    roof = rs.AddBox([
        (-length/2+length/5, -width/2+width/5, base_height),
        (length/2-length/5, -width/2+width/5, base_height),
        (length/2-length/5, width/2-width/5, base_height),
        (-length/2+length/5, width/2-width/5, base_height),
        (-length/2+length/5, -width/2+width/5, base_height+roof_height),
        (length/2-length/5, -width/2+width/5, base_height+roof_height),
        (length/2-length/5, width/2-width/5, base_height+roof_height),
        (-length/2+length/5, width/2-width/5, base_height+roof_height)
    ])
    
    # create columns in a grid
    columns = []
    for i in range(num_columns_x):
        for j in range(num_columns_y):
            x = -length/2 + column_width/2 + i * (length / num_columns_x)
            y = -width/2 + column_depth/2 + j * (width / num_columns_y)
            column = rs.AddBox([
                (x-column_width/2, y-column_depth/2, 0),
                (x+column_width/2, y-column_depth/2, 0),
                (x+column_width/2, y+column_depth/2, 0),
                (x-column_width/2, y+column_depth/2, 0),
                (x-column_width/2, y-column_depth/2, column_height),
                (x+column_width/2, y-column_depth/2, column_height),
                (x+column_width/2, y+column_depth/2, column_height),
                (x-column_width/2, y+column_depth/2, column_height),
            ])
            columns.append(column)

    return base, roof, columns

# parameters
length = x
width = y
base_height = z
column_width = a
column_depth = b
column_height = v
num_columns_x = m
num_columns_y = n
num_steps = s

base, roof, columns = create_greek_temple(length, width, base_height, column_width, column_depth, column_height, num_columns_x, num_columns_y, num_steps)

# assign outputs
A = base
B = roof
C = columns
# ---------- end ghpython_script_3 ----------
# temple
ghpython_script_4 = GhPythonScript(x=length_3, y=width_3, z=height_3, u=column_radius_3, v=column_height_3, w=num_columns_5)  # -> out, A, B, C; inputs w: Int32; same code as ghpython_script
# temple
ghpython_script_5 = GhPythonScript(
    x=length_4,
    y=width_4,
    z=height_4,
    a=column_radius_5,
    b=column_radius_6,
    v=column_height_4,
    m=num_columns_7,
    n=num_columns_8,
    s=num_columns_6)  # -> out, A, B, C; inputs m: Int32, n: Int32, s: Int32; same code as ghpython_script_3
# temple
ghpython_script_6 = GhPythonScript(x=length_6, y=width_6, z=height_6, u=column_radius_8, v=column_height_6, w=num_columns_11, s=num_columns_10)  # -> out, A, B, C; inputs w: Int32, s: Int32
# ---------- ghpython_script_6: Python ----------
import rhinoscriptsyntax as rs
import math

# Create a Greek temple
def create_greek_temple(length, width, base_height, column_radius, column_height, num_columns, num_steps):
    # create the base with steps
    step_height = base_height / num_steps
    base = []
    for i in range(num_steps):
        base_part = rs.AddBox([
            (-length/2+i*length/(2*num_steps), -width/2+i*width/(2*num_steps), -i*step_height),
            (length/2-i*length/(2*num_steps), -width/2+i*width/(2*num_steps), -i*step_height),
            (length/2-i*length/(2*num_steps), width/2-i*width/(2*num_steps), -i*step_height),
            (-length/2+i*length/(2*num_steps), width/2-i*width/(2*num_steps), -i*step_height),
            (-length/2+i*length/(2*num_steps), -width/2+i*width/(2*num_steps), -(i+1)*step_height),
            (length/2-i*length/(2*num_steps), -width/2+i*width/(2*num_steps), -(i+1)*step_height),
            (length/2-i*length/(2*num_steps), width/2-i*width/(2*num_steps), -(i+1)*step_height),
            (-length/2+i*length/(2*num_steps), width/2-i*width/(2*num_steps), -(i+1)*step_height)
        ])
        base.append(base_part)
    
    # create the roof
    roof_height = base_height/2
    roof = rs.AddBox([
        (-length/2+length/5, -width/2+width/5, base_height),
        (length/2-length/5, -width/2+width/5, base_height),
        (length/2-length/5, width/2-width/5, base_height),
        (-length/2+length/5, width/2-width/5, base_height),
        (-length/2+length/5, -width/2+width/5, base_height+roof_height),
        (length/2-length/5, -width/2+width/5, base_height+roof_height),
        (length/2-length/5, width/2-width/5, base_height+roof_height),
        (-length/2+length/5, width/2-width/5, base_height+roof_height)
    ])
    
    # create columns
    columns = []
    for i in range(num_columns):
        angle = (2.0 * math.pi / num_columns) * i
        x = (length/2 - column_radius) * math.cos(angle)
        y = (width/2 - column_radius) * math.sin(angle)
        base_pt = rs.CreatePoint(x, y, 0)
        top_pt = rs.CreatePoint(x, y, column_height)
        column = rs.AddCylinder(base_pt, top_pt, column_radius)
        columns.append(column)

    return base, roof, columns

# parameters
length = x
width = y
base_height = z
column_radius = u
column_height = v
num_columns = w
num_steps = s

base, roof, columns = create_greek_temple(length, width, base_height, column_radius, column_height, num_columns, num_steps)

# assign outputs
A = base
B = roof
C = columns
# ---------- end ghpython_script_6 ----------
# temple
ghpython_script_7 = GhPythonScript(x=length_7, y=width_7, z=height_7, u=column_radius_9, v=column_height_7, w=num_columns_12, s=num_columns_13)  # -> out, A, B, C; inputs w: Int32, s: Int32
# ---------- ghpython_script_7: Python ----------
import rhinoscriptsyntax as rs
import math

# Create a Greek temple
def create_greek_temple(length, width, base_height, column_radius, column_height, num_columns, num_steps):
    # create the base with steps
    step_height = base_height / num_steps
    base = []
    for i in range(num_steps):
        base_part = rs.AddBox([
            (-length/2-i*length/(2*num_steps), -width/2-i*width/(2*num_steps), -i*step_height),
            (length/2+i*length/(2*num_steps), -width/2-i*width/(2*num_steps), -i*step_height),
            (length/2+i*length/(2*num_steps), width/2+i*width/(2*num_steps), -i*step_height),
            (-length/2-i*length/(2*num_steps), width/2+i*width/(2*num_steps), -i*step_height),
            (-length/2-i*length/(2*num_steps), -width/2-i*width/(2*num_steps), -(i+1)*step_height),
            (length/2+i*length/(2*num_steps), -width/2-i*width/(2*num_steps), -(i+1)*step_height),
            (length/2+i*length/(2*num_steps), width/2+i*width/(2*num_steps), -(i+1)*step_height),
            (-length/2-i*length/(2*num_steps), width/2+i*width/(2*num_steps), -(i+1)*step_height)
        ])
        base.append(base_part)
    
    # create the roof
    roof_height = base_height/2
    roof = rs.AddBox([
        (-length/2+length/5, -width/2+width/5, base_height),
        (length/2-length/5, -width/2+width/5, base_height),
        (length/2-length/5, width/2-width/5, base_height),
        (-length/2+length/5, width/2-width/5, base_height),
        (-length/2+length/5, -width/2+width/5, base_height+roof_height),
        (length/2-length/5, -width/2+width/5, base_height+roof_height),
        (length/2-length/5, width/2-width/5, base_height+roof_height),
        (-length/2+length/5, width/2-width/5, base_height+roof_height)
    ])
    
    # create columns
    columns = []
    for i in range(num_columns):
        angle = (2.0 * math.pi / num_columns) * i
        x = (length/2 - column_radius) * math.cos(angle)
        y = (width/2 - column_radius) * math.sin(angle)
        base_pt = rs.CreatePoint(x, y, 0)
        top_pt = rs.CreatePoint(x, y, column_height)
        column = rs.AddCylinder(base_pt, top_pt, column_radius)
        columns.append(column)

    return base, roof, columns

# parameters
length = x
width = y
base_height = z
column_radius = u
column_height = v
num_columns = w
num_steps = s

base, roof, columns = create_greek_temple(length, width, base_height, column_radius, column_height, num_columns, num_steps)

# assign outputs
A = base
B = roof
C = columns
# ---------- end ghpython_script_7 ----------
# gpt-4 into ghpython node
# #Text prompting in GPT-4 at www.wickersonstudios.com
# temple
ghpython_script_8 = GhPythonScript()  # -> out, A, B, C
# ---------- ghpython_script_8: Python ----------
import rhinoscriptsyntax as rs
import math

# Create a Greek temple
def create_greek_temple(length, width, height, column_radius, column_height, num_columns):
    # create the base
    base = rs.AddBox([
        (-length/2, -width/2, 0),
        (length/2, -width/2, 0),
        (length/2, width/2, 0),
        (-length/2, width/2, 0),
        (-length/2, -width/2, -height),
        (length/2, -width/2, -height),
        (length/2, width/2, -height),
        (-length/2, width/2, -height)
    ])
    
    # create the roof
    roof_height = height/2
    roof = rs.AddBox([
        (-length/2+length/5, -width/2+width/5, height),
        (length/2-length/5, -width/2+width/5, height),
        (length/2-length/5, width/2-width/5, height),
        (-length/2+length/5, width/2-width/5, height),
        (-length/2+length/5, -width/2+width/5, height+roof_height),
        (length/2-length/5, -width/2+width/5, height+roof_height),
        (length/2-length/5, width/2-width/5, height+roof_height),
        (-length/2+length/5, width/2-width/5, height+roof_height)
    ])
    
    # create columns
    columns = []
    for i in range(num_columns):
        angle = (2.0 * math.pi / num_columns) * i
        x = (length/2 - column_radius) * math.cos(angle)
        y = (width/2 - column_radius) * math.sin(angle)
        base_pt = rs.CreatePoint(x, y, 0)
        top_pt = rs.CreatePoint(x, y, column_height)
        column = rs.AddCylinder(base_pt, top_pt, column_radius)
        columns.append(column)

    return base, roof, columns

# parameters
length = 20.0
width = 10.0
height = 10.0
column_radius = 1.0
column_height = 10.0
num_columns = 8

base, roof, columns = create_greek_temple(length, width, height, column_radius, column_height, num_columns)

# assign outputs
A = base
B = roof
C = columns
# ---------- end ghpython_script_8 ----------
geometry_4 = Geometry(ghpython_script_2.C)
geometry_5 = Geometry(ghpython_script_3.C)
geometry_6 = Geometry(ghpython_script_2.A)
geometry_7 = Geometry(ghpython_script_2.B)
geometry_8 = Geometry(ghpython_script_4.C)
geometry_9 = Geometry(ghpython_script_3.A)
geometry_10 = Geometry(ghpython_script_3.B)
geometry_11 = Geometry(ghpython_script_4.A)
geometry_12 = Geometry(ghpython_script_4.B)
geometry_13 = Geometry(ghpython_script_5.C)
geometry_14 = Geometry(ghpython_script_5.A)
geometry_15 = Geometry(ghpython_script_5.B)
geometry_16 = Geometry(ghpython_script_8.C)
geometry_17 = Geometry(ghpython_script_6.C)
geometry_18 = Geometry(ghpython_script_8.A)
geometry_19 = Geometry(ghpython_script_7.C)
geometry_20 = Geometry(ghpython_script_8.B)
geometry_21 = Geometry(ghpython_script_6.A)
geometry_22 = Geometry(ghpython_script_6.B)
geometry_23 = Geometry(ghpython_script_7.A)
geometry_24 = Geometry(ghpython_script_7.B)
panel_2 = Panel(ghpython_script_2.out)
panel_3 = Panel(ghpython_script_3.out)
panel_4 = Panel(ghpython_script_4.out)
panel_5 = Panel(ghpython_script_5.out)
panel_6 = Panel(ghpython_script_8.out)
panel_7 = Panel(ghpython_script_6.out)
panel_8 = Panel(ghpython_script_7.out)
column_height_8 = Slider(22.5, range=0..100)
length_8 = Slider(100, range=0..100)
width_8 = Slider(52.2, range=0..100)
height_8 = Slider(13.9, range=0..100)
column_radius_10 = Slider(0.81, range=0..10)
column_radius_11 = Slider(2.5, range=0..20)
num_columns_14 = Slider(16, range=0..100)
num_columns_15 = Slider(4, range=0..100)
# temple
num_columns_16 = Slider(5, range=0..100)
column_height_9 = Slider(22.5, range=0..100)
column_height_10 = Slider(22.5, range=0..100)
length_9 = Slider(100, range=0..100)
width_9 = Slider(52.2, range=0..100)
height_9 = Slider(13.9, range=0..100)
column_radius_12 = Slider(0.81, range=0..10)
column_radius_13 = Slider(2.5, range=0..20)
num_columns_17 = Slider(16, range=0..100)
num_columns_18 = Slider(4, range=0..100)
num_columns_19 = Slider(5, range=0..100)
length_10 = Slider(100, range=0..100)
width_10 = Slider(53.7, range=0..100)
column_radius_14 = Slider(2.5, range=0..20)
num_columns_20 = Slider(16, range=0..100)
num_columns_21 = Slider(4, range=0..100)
height_10 = Slider(13.9, range=0..100)
column_radius_15 = Slider(0.81, range=0..10)
num_columns_22 = Slider(5, range=0..100)
length_11 = Slider(100, range=0..100)
width_11 = Slider(74.2, range=0..100)
column_radius_16 = Slider(0.96, range=0..20)
column_height_11 = Slider(20.3, range=0..100)
num_columns_23 = Slider(12, range=0..100)
length_12 = Slider(100, range=0..100)
width_12 = Slider(74.2, range=0..100)
column_radius_17 = Slider(0.84, range=0..20)
column_height_12 = Slider(20.3, range=0..100)
height_11 = Slider(7.9, range=0..100)
column_radius_18 = Slider(2.71, range=0..10)
num_columns_24 = Slider(4, range=0..100)
num_columns_25 = Slider(6, range=0..100)
height_12 = Slider(7.9, range=0..100)
column_radius_19 = Slider(2.42, range=0..10)
num_columns_26 = Slider(12, range=0..100)
num_columns_27 = Slider(4, range=0..100)
num_columns_28 = Slider(6, range=0..100)
num_columns_29 = Slider(4, range=0..100)
num_columns_30 = Slider(11, range=0..100)
height_13 = Slider(27.1, range=0..100)
column_height_13 = Slider(20.3, range=0..100)
column_radius_20 = Slider(4.14, range=0..10)
column_height_14 = Slider(31.3, range=0..100)
length_13 = Slider(100, range=0..100)
width_13 = Slider(74.2, range=0..100)
column_radius_21 = Slider(0.84, range=0..20)
num_columns_31 = Slider(12, range=0..100)
num_columns_32 = Slider(4, range=0..100)
width_14 = Slider(100, range=0..100)
height_14 = Slider(7.9, range=0..100)
column_radius_22 = Slider(2.42, range=0..10)
num_columns_33 = Slider(3, range=0..100)
length_14 = Slider(44.2, range=0..100)
column_radius_23 = Slider(6.01, range=0..10)
num_columns_34 = Slider(6, range=0..100)
# temple
ghpython_script_9 = GhPythonScript(
    x=length_8,
    y=width_8,
    z=column_height_8,
    a=column_radius_10,
    b=column_radius_11,
    v=column_height_8,
    m=num_columns_14,
    n=num_columns_15,
    s=num_columns_16)  # -> out, A, B, C; inputs m: Int32, n: Int32, s: Int32
# ---------- ghpython_script_9: Python ----------
import rhinoscriptsyntax as rs
import math
import Rhino.Geometry as rg

# Create a Greek temple
def create_greek_temple(length, width, base_height, bottom_column_radius, top_column_radius_ratio, column_height, num_columns_x, num_columns_y, num_steps):
    # create the base with steps
    step_height = base_height / num_steps
    base = []
    for i in range(num_steps):
        base_part = rs.AddBox([
            (-length/2-i*length/(2*num_steps), -width/2-i*width/(2*num_steps), -i*step_height),
            (length/2+i*length/(2*num_steps), -width/2-i*width/(2*num_steps), -i*step_height),
            (length/2+i*length/(2*num_steps), width/2+i*width/(2*num_steps), -i*step_height),
            (-length/2-i*length/(2*num_steps), width/2+i*width/(2*num_steps), -i*step_height),
            (-length/2-i*length/(2*num_steps), -width/2-i*width/(2*num_steps), -(i+1)*step_height),
            (length/2+i*length/(2*num_steps), -width/2-i*width/(2*num_steps), -(i+1)*step_height),
            (length/2+i*length/(2*num_steps), width/2+i*width/(2*num_steps), -(i+1)*step_height),
            (-length/2-i*length/(2*num_steps), width/2+i*width/(2*num_steps), -(i+1)*step_height)
        ])
        base.append(base_part)

    # create the roof with pediments
    roof_height = base_height/2
    roof_base = rs.AddBox([
        (-length/2, -width/2, base_height + column_height),
        (length/2, -width/2, base_height + column_height),
        (length/2, width/2, base_height + column_height),
        (-length/2, width/2, base_height + column_height),
        (-length/2, -width/2, base_height + column_height + roof_height),
        (length/2, -width/2, base_height + column_height + roof_height),
        (length/2, width/2, base_height + column_height + roof_height),
        (-length/2, width/2, base_height + column_height + roof_height)
    ])

    pediment1 = rs.AddSrfPt([rs.coerce3dpoint([-length/2, -width/2, base_height + column_height + roof_height]),
                            rs.coerce3dpoint([length/2, -width/2, base_height + column_height + roof_height]),
                            rs.coerce3dpoint([0, -width/2, base_height + column_height + roof_height + roof_height/2])])

    pediment2 = rs.AddSrfPt([rs.coerce3dpoint([-length/2, width/2, base_height + column_height + roof_height]),
                            rs.coerce3dpoint([length/2, width/2, base_height + column_height + roof_height]),
                            rs.coerce3dpoint([0, width/2, base_height + column_height + roof_height + roof_height/2])])

    roof = [roof_base, pediment1, pediment2]

    # create tapered columns in a grid
    columns = []
    for i in range(num_columns_x):
        for j in range(num_columns_y):
            x = -length/2 + i * (length / (num_columns_x-1))
            y = -width/2 + j * (width / (num_columns_y-1))
            base_pt = rs.CreatePoint(x, y, 0)
            top_pt = rs.CreatePoint(x, y, base_height + column_height)
            bottom_circle = rg.Circle(base_pt, bottom_column_radius)
            top_circle = rg.Circle(top_pt, bottom_column_radius * top_column_radius_ratio)
            bottom_curve = bottom_circle.ToNurbsCurve()
            top_curve = top_circle.ToNurbsCurve()
            loft_type = rg.LoftType.Normal
            loft_rebuild = 0
            loft = rg.Brep.CreateFromLoft([bottom_curve, top_curve], rg.Point3d.Unset, rg.Point3d.Unset, loft_type, False)
            columns.extend(loft)

    return base, roof, columns

# parameters
length = 50
width = 20
base_height = 10
bottom_column_radius = 1
top_column_radius_ratio = 0.8 
column_height = 15
num_columns_x = 6
num_columns_y = 3
num_steps = 5

base, roof, columns = create_greek_temple(length, width, base_height, bottom_column_radius, top_column_radius_ratio, column_height, num_columns_x, num_columns_y, num_steps)

# assign outputs
A = base
B = roof
C = columns
# ---------- end ghpython_script_9 ----------
# temple
ghpython_script_10 = GhPythonScript(
    x=length_9,
    y=width_9,
    z=column_height_9,
    a=column_radius_12,
    b=column_radius_13,
    v=column_height_9,
    m=num_columns_17,
    n=num_columns_18,
    s=num_columns_19)  # -> out, A, B, C; inputs m: Int32, n: Int32, s: Int32
# ---------- ghpython_script_10: Python ----------
import rhinoscriptsyntax as rs
import math
import Rhino.Geometry as rg

# Create a Greek temple
def create_greek_temple(length, width, base_height, bottom_column_radius, top_column_radius_ratio, column_height, num_columns_x, num_columns_y, num_steps):
    # create the base with steps
    step_height = base_height / num_steps
    base = []
    for i in range(num_steps):
        base_part = rs.AddBox([
            (-length/2-i*length/(2*num_steps), -width/2-i*width/(2*num_steps), -i*step_height),
            (length/2+i*length/(2*num_steps), -width/2-i*width/(2*num_steps), -i*step_height),
            (length/2+i*length/(2*num_steps), width/2+i*width/(2*num_steps), -i*step_height),
            (-length/2-i*length/(2*num_steps), width/2+i*width/(2*num_steps), -i*step_height),
            (-length/2-i*length/(2*num_steps), -width/2-i*width/(2*num_steps), -(i+1)*step_height),
            (length/2+i*length/(2*num_steps), -width/2-i*width/(2*num_steps), -(i+1)*step_height),
            (length/2+i*length/(2*num_steps), width/2+i*width/(2*num_steps), -(i+1)*step_height),
            (-length/2-i*length/(2*num_steps), width/2+i*width/(2*num_steps), -(i+1)*step_height)
        ])
        base.append(base_part)

    # create the roof with pediments
    roof_height = base_height/2
    roof_base = rs.AddBox([
        (-length/2, -width/2, column_height),
        (length/2, -width/2, column_height),
        (length/2, width/2, column_height),
        (-length/2, width/2, column_height),
        (-length/2, -width/2, column_height + roof_height),
        (length/2, -width/2, column_height + roof_height),
        (length/2, width/2, column_height + roof_height),
        (-length/2, width/2, column_height + roof_height)
    ])

    pediment1 = rs.AddSrfPt([rs.coerce3dpoint([-length/2, -width/2, column_height + roof_height]),
                            rs.coerce3dpoint([length/2, -width/2, column_height + roof_height]),
                            rs.coerce3dpoint([0, -width/2, column_height + roof_height + roof_height/2])])

    pediment2 = rs.AddSrfPt([rs.coerce3dpoint([-length/2, width/2, column_height + roof_height]),
                            rs.coerce3dpoint([length/2, width/2, column_height + roof_height]),
                            rs.coerce3dpoint([0, width/2, column_height + roof_height + roof_height/2])])

    roof = [roof_base, pediment1, pediment2]

    # create tapered columns in a grid
    columns = []
    for i in range(num_columns_x):
        for j in range(num_columns_y):
            x = -length/2 + i * (length / (num_columns_x-1))
            y = -width/2 + j * (width / (num_columns_y-1))
            base_pt = rs.CreatePoint(x, y, base_height)
            top_pt = rs.CreatePoint(x, y, column_height + base_height)
            bottom_circle = rg.Circle(base_pt, bottom_column_radius)
            top_circle = rg.Circle(top_pt, bottom_column_radius * top_column_radius_ratio)
            bottom_curve = bottom_circle.ToNurbsCurve()
            top_curve = top_circle.ToNurbsCurve()
            loft_type = rg.LoftType.Normal
            loft_rebuild = 0
            loft = rg.Brep.CreateFromLoft([bottom_curve, top_curve], rg.Point3d.Unset, rg.Point3d.Unset, loft_type, False)
            columns.extend(loft)

    return base, roof, columns

# parameters
length = 50
width = 20
base_height = 10
bottom_column_radius = 1
top_column_radius_ratio = 0.8 
column_height = 15
num_columns_x = 6
num_columns_y = 3
num_steps = 5

base, roof, columns = create_greek_temple(length, width, base_height, bottom_column_radius, top_column_radius_ratio, column_height, num_columns_x, num_columns_y, num_steps)

# assign outputs
A = base
B = roof
C = columns
# ---------- end ghpython_script_10 ----------
# temple
ghpython_script_11 = GhPythonScript(
    x=length_14,
    y=width_14,
    z=height_13,
    u=column_radius_20,
    v=column_height_14,
    m=num_columns_29,
    n=num_columns_34,
    s=num_columns_30)  # -> out, A, B, C; inputs m: Int32, n: Int32, s: Int32
# ---------- ghpython_script_11: Python ----------
import rhinoscriptsyntax as rs
import math

# Create a Greek temple
def create_greek_temple(length, width, base_height, column_radius, column_height, num_columns_x, num_columns_y, num_steps):
    # create the base with steps
    step_height = base_height / num_steps
    base = []
    for i in range(num_steps):
        base_part = rs.AddBox([
            (-length/2-i*length/(2*num_steps), -width/2-i*width/(2*num_steps), -i*step_height),
            (length/2+i*length/(2*num_steps), -width/2-i*width/(2*num_steps), -i*step_height),
            (length/2+i*length/(2*num_steps), width/2+i*width/(2*num_steps), -i*step_height),
            (-length/2-i*length/(2*num_steps), width/2+i*width/(2*num_steps), -i*step_height),
            (-length/2-i*length/(2*num_steps), -width/2-i*width/(2*num_steps), -(i+1)*step_height),
            (length/2+i*length/(2*num_steps), -width/2-i*width/(2*num_steps), -(i+1)*step_height),
            (length/2+i*length/(2*num_steps), width/2+i*width/(2*num_steps), -(i+1)*step_height),
            (-length/2-i*length/(2*num_steps), width/2+i*width/(2*num_steps), -(i+1)*step_height)
        ])
        base.append(base_part)
    
    # create the roof
    roof_height = base_height/2
    roof = rs.AddBox([
        (-length/2+length/5, -width/2+width/5, base_height),
        (length/2-length/5, -width/2+width/5, base_height),
        (length/2-length/5, width/2-width/5, base_height),
        (-length/2+length/5, width/2-width/5, base_height),
        (-length/2+length/5, -width/2+width/5, base_height+roof_height),
        (length/2-length/5, -width/2+width/5, base_height+roof_height),
        (length/2-length/5, width/2-width/5, base_height+roof_height),
        (-length/2+length/5, width/2-width/5, base_height+roof_height)
    ])
    
    # create columns in a grid
    columns = []
    for i in range(num_columns_x):
        for j in range(num_columns_y):
            x = -length/2 + i * (length / (num_columns_x-1))
            y = -width/2 + j * (width / (num_columns_y-1))
            base_pt = rs.CreatePoint(x, y, 0)
            top_pt = rs.CreatePoint(x, y, column_height)
            column = rs.AddCylinder(base_pt, top_pt, column_radius)
            columns.append(column)

    return base, roof, columns

# parameters
length = x
width = y
base_height = z
column_radius = u
column_height = v
num_columns_x = m
num_columns_y = n
num_steps = s

base, roof, columns = create_greek_temple(length, width, base_height, column_radius, column_height, num_columns_x, num_columns_y, num_steps)

# assign outputs
A = base
B = roof
C = columns
# ---------- end ghpython_script_11 ----------
# temple
ghpython_script_12 = GhPythonScript(
    x=length_10,
    y=width_10,
    z=column_height_10,
    a=column_radius_15,
    b=column_radius_14,
    v=column_height_10,
    m=num_columns_20,
    n=num_columns_21,
    s=num_columns_22)  # -> out, A, B, C; inputs m: Int32, n: Int32, s: Int32
# ---------- ghpython_script_12: Python ----------
import rhinoscriptsyntax as rs
import math
import Rhino.Geometry as rg

# Create a Greek temple
def create_greek_temple(length, width, base_height, bottom_column_radius, top_column_radius_ratio, column_height, num_columns_x, num_columns_y, num_steps):
    # create the base with steps
    step_height = base_height / num_steps
    base = []
    for i in range(num_steps):
        base_part = rs.AddBox([
            (-length/2-i*length/(2*num_steps), -width/2-i*width/(2*num_steps), -i*step_height),
            (length/2+i*length/(2*num_steps), -width/2-i*width/(2*num_steps), -i*step_height),
            (length/2+i*length/(2*num_steps), width/2+i*width/(2*num_steps), -i*step_height),
            (-length/2-i*length/(2*num_steps), width/2+i*width/(2*num_steps), -i*step_height),
            (-length/2-i*length/(2*num_steps), -width/2-i*width/(2*num_steps), -(i+1)*step_height),
            (length/2+i*length/(2*num_steps), -width/2-i*width/(2*num_steps), -(i+1)*step_height),
            (length/2+i*length/(2*num_steps), width/2+i*width/(2*num_steps), -(i+1)*step_height),
            (-length/2-i*length/(2*num_steps), width/2+i*width/(2*num_steps), -(i+1)*step_height)
        ])
        base.append(base_part)
    
    # create the roof with pediments
    roof_height = base_height/2
    roof_base = rs.AddBox([
        (-length/2, -width/2, base_height),
        (length/2, -width/2, base_height),
        (length/2, width/2, base_height),
        (-length/2, width/2, base_height),
        (-length/2, -width/2, base_height+roof_height),
        (length/2, -width/2, base_height+roof_height),
        (length/2, width/2, base_height+roof_height),
        (-length/2, width/2, base_height+roof_height)
    ])

    pediment1 = rs.AddSrfPt([rs.coerce3dpoint([-length/2, -width/2, base_height+roof_height]), 
                            rs.coerce3dpoint([length/2, -width/2, base_height+roof_height]), 
                            rs.coerce3dpoint([0, -width/2, base_height + 1.5*roof_height])])
                            
    pediment2 = rs.AddSrfPt([rs.coerce3dpoint([-length/2, width/2, base_height+roof_height]), 
                            rs.coerce3dpoint([length/2, width/2, base_height+roof_height]), 
                            rs.coerce3dpoint([0, width/2, base_height + 1.5*roof_height])])
    
    pediment3 = rs.AddSrfPt([rs.coerce3dpoint([-length/2, -width/2, base_height+1.5*roof_height]), 
                             rs.coerce3dpoint([-length/2, width/2, base_height+1.5*roof_height]), 
                             rs.coerce3dpoint([0, 0, base_height + 2*roof_height])])
                             
    pediment4 = rs.AddSrfPt([rs.coerce3dpoint([length/2, -width/2, base_height+1.5*roof_height]), 
                             rs.coerce3dpoint([length/2, width/2, base_height+1.5*roof_height]), 
                             rs.coerce3dpoint([0, 0, base_height + 2*roof_height])])

    roof = [roof_base, pediment1, pediment2, pediment3, pediment4]

    # create tapered columns in a grid
    columns = []
    for i in range(num_columns_x):
        for j in range(num_columns_y):
            x = -length/2 + i * (length / (num_columns_x-1))
            y = -width/2 + j * (width / (num_columns_y-1))
            base_pt = rs.CreatePoint(x, y, 0)
            top_pt = rs.CreatePoint(x, y, column_height)
            bottom_circle = rg.Circle(base_pt, bottom_column_radius)
            top_circle = rg.Circle(top_pt, bottom_column_radius * top_column_radius_ratio)
            bottom_curve = bottom_circle.ToNurbsCurve()
            top_curve = top_circle.ToNurbsCurve()
            loft_type = rg.LoftType.Normal
            loft_rebuild = 0
            loft = rg.Brep.CreateFromLoft([bottom_curve, top_curve], rg.Point3d.Unset, rg.Point3d.Unset, loft_type, False)
            columns.extend(loft)

    return base, roof, columns

# parameters
length = 50
width = 20
base_height = 10
bottom_column_radius = 1
top_column_radius_ratio = 0.8 
column_height = 15
num_columns_x = 6
num_columns_y = 3
num_steps = 5

base, roof, columns = create_greek_temple(length, width, base_height, bottom_column_radius, top_column_radius_ratio, column_height, num_columns_x, num_columns_y, num_steps)

# assign outputs
A = base
B = roof
C = columns
# ---------- end ghpython_script_12 ----------
# temple
ghpython_script_13 = GhPythonScript(
    x=length_11,
    y=width_11,
    z=column_height_11,
    a=column_radius_18,
    b=column_radius_16,
    v=column_height_11,
    m=num_columns_23,
    n=num_columns_24,
    s=num_columns_25)  # -> out, A, B, C; inputs m: Int32, n: Int32, s: Int32
# ---------- ghpython_script_13: Python ----------
import rhinoscriptsyntax as rs
import math
import Rhino.Geometry as rg

# Create a Greek temple
def create_greek_temple(length, width, base_height, bottom_column_radius, top_column_radius_ratio, column_height, num_columns_x, num_columns_y, num_steps):
    # create the base with steps
    step_height = base_height / num_steps
    base = []
    for i in range(num_steps):
        base_part = rs.AddBox([
            (-length/2-i*length/(2*num_steps), -width/2-i*width/(2*num_steps), -i*step_height),
            (length/2+i*length/(2*num_steps), -width/2-i*width/(2*num_steps), -i*step_height),
            (length/2+i*length/(2*num_steps), width/2+i*width/(2*num_steps), -i*step_height),
            (-length/2-i*length/(2*num_steps), width/2+i*width/(2*num_steps), -i*step_height),
            (-length/2-i*length/(2*num_steps), -width/2-i*width/(2*num_steps), -(i+1)*step_height),
            (length/2+i*length/(2*num_steps), -width/2-i*width/(2*num_steps), -(i+1)*step_height),
            (length/2+i*length/(2*num_steps), width/2+i*width/(2*num_steps), -(i+1)*step_height),
            (-length/2-i*length/(2*num_steps), width/2+i*width/(2*num_steps), -(i+1)*step_height)
        ])
        base.append(base_part)
    
    # create the roof with pediments
    roof_height = base_height/2
    roof_base = rs.AddBox([
        (-length/2, -width/2, base_height),
        (length/2, -width/2, base_height),
        (length/2, width/2, base_height),
        (-length/2, width/2, base_height),
        (-length/2, -width/2, base_height+roof_height),
        (length/2, -width/2, base_height+roof_height),
        (length/2, width/2, base_height+roof_height),
        (-length/2, width/2, base_height+roof_height)
    ])

    pediment1 = rs.AddSrfPt([rs.coerce3dpoint([-length/2, -width/2, base_height+roof_height]), 
                            rs.coerce3dpoint([length/2, -width/2, base_height+roof_height]), 
                            rs.coerce3dpoint([0, -width/2, base_height + 1.5*roof_height])])
                            
    pediment2 = rs.AddSrfPt([rs.coerce3dpoint([-length/2, width/2, base_height+roof_height]), 
                            rs.coerce3dpoint([length/2, width/2, base_height+roof_height]), 
                            rs.coerce3dpoint([0, width/2, base_height + 1.5*roof_height])])
    
    roof = [roof_base, pediment1, pediment2]

    # create tapered columns in a grid
    columns = []
    for i in range(num_columns_x):
        for j in range(num_columns_y):
            x = -length/2 + i * (length / (num_columns_x-1))
            y = -width/2 + j * (width / (num_columns_y-1))
            base_pt = rs.CreatePoint(x, y, 0)
            top_pt = rs.CreatePoint(x, y, column_height)
            bottom_circle = rg.Circle(base_pt, bottom_column_radius)
            top_circle = rg.Circle(top_pt, bottom_column_radius * top_column_radius_ratio)
            bottom_curve = bottom_circle.ToNurbsCurve()
            top_curve = top_circle.ToNurbsCurve()
            loft_type = rg.LoftType.Normal
            loft_rebuild = 0
            loft = rg.Brep.CreateFromLoft([bottom_curve, top_curve], rg.Point3d.Unset, rg.Point3d.Unset, loft_type, False)
            columns.extend(loft)

    return base, roof, columns

# parameters
length = x
width = y
base_height = z
bottom_column_radius = a
top_column_radius_ratio = b # this is now a ratio of the top radius to the bottom radius
column_height = v
num_columns_x = m
num_columns_y = n
num_steps = s

base, roof, columns = create_greek_temple(length, width, base_height, bottom_column_radius, top_column_radius_ratio, column_height, num_columns_x, num_columns_y, num_steps)

# assign outputs
A = base
B = roof
C = columns
# ---------- end ghpython_script_13 ----------
# temple
ghpython_script_14 = GhPythonScript(
    x=length_12,
    y=width_12,
    z=column_height_12,
    a=column_radius_19,
    b=column_radius_17,
    v=column_height_12,
    m=num_columns_26,
    n=num_columns_27,
    s=num_columns_28)  # -> out, A, B, C; inputs m: Int32, n: Int32, s: Int32
# ---------- ghpython_script_14: Python ----------
import rhinoscriptsyntax as rs
import math
import Rhino.Geometry as rg

# Create a Greek temple
def create_greek_temple(length, width, base_height, bottom_column_radius, top_column_radius_ratio, column_height, num_columns_x, num_columns_y, num_steps):
    # create the base with steps
    step_height = base_height / num_steps
    base = []
    for i in range(num_steps):
        base_part = rs.AddBox([
            (-length/2-i*length/(2*num_steps), -width/2-i*width/(2*num_steps), -i*step_height),
            (length/2+i*length/(2*num_steps), -width/2-i*width/(2*num_steps), -i*step_height),
            (length/2+i*length/(2*num_steps), width/2+i*width/(2*num_steps), -i*step_height),
            (-length/2-i*length/(2*num_steps), width/2+i*width/(2*num_steps), -i*step_height),
            (-length/2-i*length/(2*num_steps), -width/2-i*width/(2*num_steps), -(i+1)*step_height),
            (length/2+i*length/(2*num_steps), -width/2-i*width/(2*num_steps), -(i+1)*step_height),
            (length/2+i*length/(2*num_steps), width/2+i*width/(2*num_steps), -(i+1)*step_height),
            (-length/2-i*length/(2*num_steps), width/2+i*width/(2*num_steps), -(i+1)*step_height)
        ])
        base.append(base_part)
    
    # create the roof with pediments
    roof_height = base_height/2
    roof_base = rs.AddBox([
        (-length/2+length/5, -width/2+width/5, base_height),
        (length/2-length/5, -width/2+width/5, base_height),
        (length/2-length/5, width/2-width/5, base_height),
        (-length/2+length/5, width/2-width/5, base_height),
        (-length/2+length/5, -width/2+width/5, base_height+roof_height),
        (length/2-length/5, -width/2+width/5, base_height+roof_height),
        (length/2-length/5, width/2-width/5, base_height+roof_height),
        (-length/2+length/5, width/2-width/5, base_height+roof_height)
    ])

    pediment1 = rs.AddSrfPt([rs.coerce3dpoint([-length/2+length/5, -width/2+width/5, base_height+roof_height]), 
                            rs.coerce3dpoint([length/2-length/5, -width/2+width/5, base_height+roof_height]), 
                            rs.coerce3dpoint([0, -width/2+width/5, base_height + 1.5*roof_height])])
                            
    pediment2 = rs.AddSrfPt([rs.coerce3dpoint([-length/2+length/5, width/2-width/5, base_height+roof_height]), 
                            rs.coerce3dpoint([length/2-length/5, width/2-width/5, base_height+roof_height]), 
                            rs.coerce3dpoint([0, width/2-width/5, base_height + 1.5*roof_height])])
    
    roof = [roof_base, pediment1, pediment2]

    # create tapered columns in a grid
    columns = []
    for i in range(num_columns_x):
        for j in range(num_columns_y):
            x = -length/2 + i * (length / (num_columns_x-1))
            y = -width/2 + j * (width / (num_columns_y-1))
            base_pt = rs.CreatePoint(x, y, 0)
            top_pt = rs.CreatePoint(x, y, column_height)
            bottom_circle = rg.Circle(base_pt, bottom_column_radius)
            top_circle = rg.Circle(top_pt, bottom_column_radius * top_column_radius_ratio)
            bottom_curve = bottom_circle.ToNurbsCurve()
            top_curve = top_circle.ToNurbsCurve()
            loft_type = rg.LoftType.Normal
            loft_rebuild = 0
            loft = rg.Brep.CreateFromLoft([bottom_curve, top_curve], rg.Point3d.Unset, rg.Point3d.Unset, loft_type, False)
            columns.extend(loft)

    return base, roof, columns

# parameters
length = x
width = y
base_height = z
bottom_column_radius = a
top_column_radius_ratio = b # this is now a ratio of the top radius to the bottom radius
column_height = v
num_columns_x = m
num_columns_y = n
num_steps = s

base, roof, columns = create_greek_temple(length, width, base_height, bottom_column_radius, top_column_radius_ratio, column_height, num_columns_x, num_columns_y, num_steps)

# assign outputs
A = base
B = roof
C = columns
# ---------- end ghpython_script_14 ----------
# temple
ghpython_script_15 = GhPythonScript(
    x=length_13,
    y=width_13,
    z=column_height_13,
    a=column_radius_22,
    b=column_radius_21,
    v=column_height_13,
    m=num_columns_31,
    n=num_columns_32,
    s=num_columns_33)  # -> out, A, B, C; inputs m: Int32, n: Int32, s: Int32
# ---------- ghpython_script_15: Python ----------
import rhinoscriptsyntax as rs
import math
import Rhino.Geometry as rg

# Create a Greek temple
def create_greek_temple(length, width, base_height, bottom_column_radius, top_column_radius_ratio, column_height, num_columns_x, num_columns_y, num_steps):
    # create the base with steps
    step_height = base_height / num_steps
    base = []
    for i in range(num_steps):
        base_part = rs.AddBox([
            (-length/2-i*length/(2*num_steps), -width/2-i*width/(2*num_steps), -i*step_height),
            (length/2+i*length/(2*num_steps), -width/2-i*width/(2*num_steps), -i*step_height),
            (length/2+i*length/(2*num_steps), width/2+i*width/(2*num_steps), -i*step_height),
            (-length/2-i*length/(2*num_steps), width/2+i*width/(2*num_steps), -i*step_height),
            (-length/2-i*length/(2*num_steps), -width/2-i*width/(2*num_steps), -(i+1)*step_height),
            (length/2+i*length/(2*num_steps), -width/2-i*width/(2*num_steps), -(i+1)*step_height),
            (length/2+i*length/(2*num_steps), width/2+i*width/(2*num_steps), -(i+1)*step_height),
            (-length/2-i*length/(2*num_steps), width/2+i*width/(2*num_steps), -(i+1)*step_height)
        ])
        base.append(base_part)
    
    # create the roof
    roof_height = base_height/2
    roof = rs.AddBox([
        (-length/2+length/5, -width/2+width/5, base_height),
        (length/2-length/5, -width/2+width/5, base_height),
        (length/2-length/5, width/2-width/5, base_height),
        (-length/2+length/5, width/2-width/5, base_height),
        (-length/2+length/5, -width/2+width/5, base_height+roof_height),
        (length/2-length/5, -width/2+width/5, base_height+roof_height),
        (length/2-length/5, width/2-width/5, base_height+roof_height),
        (-length/2+length/5, width/2-width/5, base_height+roof_height)
    ])
    
    # create tapered columns in a grid
    columns = []
    for i in range(num_columns_x):
        for j in range(num_columns_y):
            x = -length/2 + i * (length / (num_columns_x-1))
            y = -width/2 + j * (width / (num_columns_y-1))
            bottom_pt = rs.CreatePoint(x, y, 0)
            top_pt = rs.CreatePoint(x, y, column_height)
            bottom_circle = rg.Circle(bottom_pt, bottom_column_radius)
            top_circle = rg.Circle(top_pt, bottom_column_radius * top_column_radius_ratio)
            bottom_curve = bottom_circle.ToNurbsCurve()
            top_curve = top_circle.ToNurbsCurve()
            loft_type = rg.LoftType.Normal
            loft_rebuild = 0
            loft = rg.Brep.CreateFromLoft([bottom_curve, top_curve], rg.Point3d.Unset, rg.Point3d.Unset, loft_type, False)
            columns.extend(loft)
            
    return base, roof, columns

# parameters
length = x
width = y
base_height = z
bottom_column_radius = a
top_column_radius_ratio = b # this is now a ratio of the top radius to the bottom radius
column_height = v
num_columns_x = m
num_columns_y = n
num_steps = s

base, roof, columns = create_greek_temple(length, width, base_height, bottom_column_radius, top_column_radius_ratio, column_height, num_columns_x, num_columns_y, num_steps)

# assign outputs
A = base
B = roof
C = columns
# ---------- end ghpython_script_15 ----------
geometry_25 = Geometry(ghpython_script_9.C)
geometry_26 = Geometry(ghpython_script_9.B)
geometry_27 = Geometry(ghpython_script_9.A)
geometry_28 = Geometry(ghpython_script_10.C)
geometry_29 = Geometry(ghpython_script_12.C)
geometry_30 = Geometry(ghpython_script_10.B)
geometry_31 = Geometry(ghpython_script_12.B)
geometry_32 = Geometry(ghpython_script_10.A)
geometry_33 = Geometry(ghpython_script_12.A)
geometry_34 = Geometry(ghpython_script_13.C)
geometry_35 = Geometry(ghpython_script_14.C)
geometry_36 = Geometry(ghpython_script_13.A)
geometry_37 = Geometry(ghpython_script_13.B)
geometry_38 = Geometry(ghpython_script_14.B)
geometry_39 = Geometry(ghpython_script_14.A)
geometry_40 = Geometry(ghpython_script_15.C)
geometry_41 = Geometry(ghpython_script_15.B)
geometry_42 = Geometry(ghpython_script_15.A)
geometry_43 = Geometry(ghpython_script_11.C)
geometry_44 = Geometry(ghpython_script_11.A)
geometry_45 = Geometry(ghpython_script_11.B)
panel_9 = Panel(ghpython_script_9.out)
panel_10 = Panel(ghpython_script_10.out)
panel_11 = Panel(ghpython_script_12.out)
panel_12 = Panel(ghpython_script_13.out)
panel_13 = Panel(ghpython_script_14.out)
panel_14 = Panel(ghpython_script_15.out)
panel_15 = Panel(ghpython_script_11.out)

# ----
# temple
column_height_15 = Slider(11.4, range=0..100)
column_radius_24 = Slider(0.68, range=0..20)
length_15 = Slider(54.3, range=0..100)
width_15 = Slider(20.4, range=0..100)
column_radius_25 = Slider(1.04, range=0..10)
num_columns_35 = Slider(6, range=0..100)
num_columns_36 = Slider(3, range=0..100)
num_columns_37 = Slider(5, range=0..100)
ghpython_script_16 = GhPythonScript(
    x=length_15,
    y=width_15,
    z=column_height_15,
    a=column_radius_25,
    b=column_radius_24,
    v=column_height_15,
    m=num_columns_35,
    n=num_columns_36,
    s=num_columns_37)  # -> out, A, B, C, D; inputs m: Int32, n: Int32, s: Int32
# ---------- ghpython_script_16: Python ----------
import rhinoscriptsyntax as rs
import math
import Rhino.Geometry as rg

# Create a Greek temple
def create_greek_temple(length, width, base_height, bottom_column_radius, top_column_radius_ratio, column_height, num_columns_x, num_columns_y, num_steps):
    # create the base with steps
    step_height = base_height / num_steps
    base = []
    for i in range(num_steps):
        base_part = rs.AddBox([
            (-length/2-i*length/(2*num_steps), -width/2-i*width/(2*num_steps), -i*step_height),
            (length/2+i*length/(2*num_steps), -width/2-i*width/(2*num_steps), -i*step_height),
            (length/2+i*length/(2*num_steps), width/2+i*width/(2*num_steps), -i*step_height),
            (-length/2-i*length/(2*num_steps), width/2+i*width/(2*num_steps), -i*step_height),
            (-length/2-i*length/(2*num_steps), -width/2-i*width/(2*num_steps), -(i+1)*step_height),
            (length/2+i*length/(2*num_steps), -width/2-i*width/(2*num_steps), -(i+1)*step_height),
            (length/2+i*length/(2*num_steps), width/2+i*width/(2*num_steps), -(i+1)*step_height),
            (-length/2-i*length/(2*num_steps), width/2+i*width/(2*num_steps), -(i+1)*step_height)
        ])
        base.append(base_part)

    # create the main roof box
    roof_height = base_height/2
    roof_box = rs.AddBox([
        (-length/2, -width/2, base_height + column_height),
        (length/2, -width/2, base_height + column_height),
        (length/2, width/2, base_height + column_height),
        (-length/2, width/2, base_height + column_height),
        (-length/2, -width/2, base_height + column_height + roof_height),
        (length/2, -width/2, base_height + column_height + roof_height),
        (length/2, width/2, base_height + column_height + roof_height),
        (-length/2, width/2, base_height + column_height + roof_height)
    ])
    
    # create the roof with pediments
    apex = (0, 0, base_height + column_height + roof_height * 1.5)

    pediment1 = rs.AddSrfPt([
        rs.coerce3dpoint([-length/2, -width/2, base_height + column_height + roof_height]),
        rs.coerce3dpoint([length/2, -width/2, base_height + column_height + roof_height]),
        rs.coerce3dpoint(apex)
    ])

    pediment2 = rs.AddSrfPt([
        rs.coerce3dpoint([-length/2, width/2, base_height + column_height + roof_height]),
        rs.coerce3dpoint([length/2, width/2, base_height + column_height + roof_height]),
        rs.coerce3dpoint(apex)
    ])

    side1 = rs.AddSrfPt([
        rs.coerce3dpoint([-length/2, -width/2, base_height + column_height + roof_height]),
        rs.coerce3dpoint([-length/2, width/2, base_height + column_height + roof_height]),
        rs.coerce3dpoint(apex)
    ])

    side2 = rs.AddSrfPt([
        rs.coerce3dpoint([length/2, -width/2, base_height + column_height + roof_height]),
        rs.coerce3dpoint([length/2, width/2, base_height + column_height + roof_height]),
        rs.coerce3dpoint(apex)
    ])

    # create tapered columns in a grid
    columns = []
    for i in range(num_columns_x):
        for j in range(num_columns_y):
            x = -length/2 + i * (length / (num_columns_x-1))
            y = -width/2 + j * (width / (num_columns_y-1))
            base_pt = rs.CreatePoint(x, y, 0)
            top_pt = rs.CreatePoint(x, y, base_height + column_height)
            bottom_circle = rg.Circle(base_pt, bottom_column_radius)
            top_circle = rg.Circle(top_pt, bottom_column_radius * top_column_radius_ratio)
            bottom_curve = bottom_circle.ToNurbsCurve()
            top_curve = top_circle.ToNurbsCurve()
            loft_type = rg.LoftType.Normal
            loft_rebuild = 0
            loft = rg.Brep.CreateFromLoft([bottom_curve, top_curve], rg.Point3d.Unset, rg.Point3d.Unset, loft_type, False)
            columns.extend(loft)

    roof = [pediment1, pediment2, side1, side2]

    return base, roof, columns, roof_box

# parameters
length = x
width = y
base_height = z
bottom_column_radius = a
top_column_radius_ratio = b 
column_height = v
num_columns_x = m
num_columns_y = n
num_steps = s

base, roof, columns, roof_box = create_greek_temple(length, width, base_height, bottom_column_radius, top_column_radius_ratio, column_height, num_columns_x, num_columns_y, num_steps)

# assign outputs
A = base
B = roof
C = columns
D = roof_box
# ---------- end ghpython_script_16 ----------
geometry_46 = Geometry(ghpython_script_16.C)
geometry_47 = Geometry(ghpython_script_16.A)
geometry_48 = Geometry(ghpython_script_16.B)
geometry_49 = Geometry(ghpython_script_16.D)
panel_16 = Panel(ghpython_script_16.out)

column_height_16 = Slider(13.4, range=0..100)
length_16 = Slider(100, range=0..100)
width_16 = Slider(62.8, range=0..100)
column_radius_26 = Slider(0.79, range=0..20)
column_height_17 = Slider(2.9, range=0..10)
column_radius_27 = Slider(2.49, range=0..10)
num_columns_38 = Slider(13, range=0..100)
num_columns_39 = Slider(7, range=0..100)
num_columns_40 = Slider(7, range=0..100)
ghpython_script_17 = GhPythonScript(
    x=length_16,
    y=width_16,
    z=column_height_16,
    a=column_radius_27,
    b=column_radius_26,
    v=column_height_16,
    m=num_columns_38,
    n=num_columns_39,
    s=num_columns_40,
    r=column_height_17)  # -> out, A, B, C, D; inputs m: Int32, n: Int32, s: Int32
# ---------- ghpython_script_17: Python ----------
import rhinoscriptsyntax as rs
import math
import Rhino.Geometry as rg

# Create a Greek temple
def create_greek_temple(length, width, base_height, bottom_column_radius, top_column_radius_ratio, column_height, num_columns_x, num_columns_y, num_steps, apex_ratio):
    # create the base with steps
    step_height = base_height / num_steps
    base = []
    for i in range(num_steps):
        base_part = rs.AddBox([
            (-length/2-i*length/(2*num_steps), -width/2-i*width/(2*num_steps), -i*step_height),
            (length/2+i*length/(2*num_steps), -width/2-i*width/(2*num_steps), -i*step_height),
            (length/2+i*length/(2*num_steps), width/2+i*width/(2*num_steps), -i*step_height),
            (-length/2-i*length/(2*num_steps), width/2+i*width/(2*num_steps), -i*step_height),
            (-length/2-i*length/(2*num_steps), -width/2-i*width/(2*num_steps), -(i+1)*step_height),
            (length/2+i*length/(2*num_steps), -width/2-i*width/(2*num_steps), -(i+1)*step_height),
            (length/2+i*length/(2*num_steps), width/2+i*width/(2*num_steps), -(i+1)*step_height),
            (-length/2-i*length/(2*num_steps), width/2+i*width/(2*num_steps), -(i+1)*step_height)
        ])
        base.append(base_part)

    # create the main roof box
    roof_height = base_height/2
    roof_box = rs.AddBox([
        (-length/2, -width/2, base_height + column_height),
        (length/2, -width/2, base_height + column_height),
        (length/2, width/2, base_height + column_height),
        (-length/2, width/2, base_height + column_height),
        (-length/2, -width/2, base_height + column_height + roof_height),
        (length/2, -width/2, base_height + column_height + roof_height),
        (length/2, width/2, base_height + column_height + roof_height),
        (-length/2, width/2, base_height + column_height + roof_height)
    ])
    
    # create the roof with pediments
    apex = (0, 0, base_height + column_height + roof_height * apex_ratio)

    pediment1 = rs.AddSrfPt([
        rs.coerce3dpoint([-length/2, -width/2, base_height + column_height + roof_height]),
        rs.coerce3dpoint([length/2, -width/2, base_height + column_height + roof_height]),
        rs.coerce3dpoint(apex)
    ])

    pediment2 = rs.AddSrfPt([
        rs.coerce3dpoint([-length/2, width/2, base_height + column_height + roof_height]),
        rs.coerce3dpoint([length/2, width/2, base_height + column_height + roof_height]),
        rs.coerce3dpoint(apex)
    ])

    side1 = rs.AddSrfPt([
        rs.coerce3dpoint([-length/2, -width/2, base_height + column_height + roof_height]),
        rs.coerce3dpoint([-length/2, width/2, base_height + column_height + roof_height]),
        rs.coerce3dpoint(apex)
    ])

    side2 = rs.AddSrfPt([
        rs.coerce3dpoint([length/2, -width/2, base_height + column_height + roof_height]),
        rs.coerce3dpoint([length/2, width/2, base_height + column_height + roof_height]),
        rs.coerce3dpoint(apex)
    ])

    # create tapered columns in a grid
    columns = []
    for i in range(1, num_columns_x - 1):
        for j in range(1, num_columns_y - 1):
            x = -length/2 + i * (length / (num_columns_x-1))
            y = -width/2 + j * (width / (num_columns_y-1))
            base_pt = rs.CreatePoint(x, y, 0)
            top_pt = rs.CreatePoint(x, y, base_height + column_height)
            bottom_circle = rg.Circle(base_pt, bottom_column_radius)
            top_circle = rg.Circle(top_pt, bottom_column_radius * top_column_radius_ratio)
            bottom_curve = bottom_circle.ToNurbsCurve()
            top_curve = top_circle.ToNurbsCurve()
            loft_type = rg.LoftType.Normal
            loft_rebuild = 0
            loft = rg.Brep.CreateFromLoft([bottom_curve, top_curve], rg.Point3d.Unset, rg.Point3d.Unset, loft_type, False)
            columns.extend(loft)

    roof = [pediment1, pediment2, side1, side2]

    return base, roof, columns, roof_box

# parameters
length = x
width = y
base_height = z
bottom_column_radius = a
top_column_radius_ratio = b 
column_height = v
num_columns_x = m
num_columns_y = n
num_steps = s
apex_ratio = r

base, roof, columns, roof_box = create_greek_temple(length, width, base_height, bottom_column_radius, top_column_radius_ratio, column_height, num_columns_x, num_columns_y, num_steps, apex_ratio)

# assign outputs
A = base
B = roof
C = columns
D = roof_box
# ---------- end ghpython_script_17 ----------
geometry_50 = Geometry(ghpython_script_17.B)
geometry_51 = Geometry(ghpython_script_17.C)
geometry_52 = Geometry(ghpython_script_17.D)
geometry_53 = Geometry(ghpython_script_17.A)
panel_17 = Panel(ghpython_script_17.out)

column_height_18 = Slider(15.4, range=0..100)
column_height_19 = Slider(11.4, range=0..100)
length_17 = Slider(54.3, range=0..100)
width_17 = Slider(20.4, range=0..100)
column_radius_28 = Slider(1.52, range=0..10)
column_radius_29 = Slider(1, range=0..20)
num_columns_41 = Slider(6, range=0..100)
num_columns_42 = Slider(3, range=0..100)
num_columns_43 = Slider(5, range=0..100)
length_18 = Slider(100, range=0..100)
width_18 = Slider(51.1, range=0..100)
column_radius_30 = Slider(2.24, range=0..10)
column_radius_31 = Slider(0.79, range=0..20)
num_columns_44 = Slider(10, range=0..100)
num_columns_45 = Slider(8, range=0..100)
num_columns_46 = Slider(7, range=0..100)
column_height_20 = Slider(15.4, range=0..100)
length_19 = Slider(54.3, range=0..100)
width_19 = Slider(20.4, range=0..100)
column_radius_32 = Slider(1, range=0..20)
num_columns_47 = Slider(6, range=0..100)
num_columns_48 = Slider(3, range=0..100)
column_radius_33 = Slider(1.52, range=0..10)
num_columns_49 = Slider(5, range=0..100)
column_height_21 = Slider(15.4, range=0..100)
length_20 = Slider(54.3, range=0..100)
width_20 = Slider(20.4, range=0..100)
column_radius_34 = Slider(1.52, range=0..10)
column_radius_35 = Slider(0.65, range=0..20)
num_columns_50 = Slider(6, range=0..100)
num_columns_51 = Slider(3, range=0..100)
num_columns_52 = Slider(5, range=0..100)
column_height_22 = Slider(15.4, range=0..100)
length_21 = Slider(54.3, range=0..100)
width_21 = Slider(20.4, range=0..100)
column_radius_36 = Slider(1.52, range=0..10)
column_radius_37 = Slider(0.65, range=0..20)
num_columns_53 = Slider(6, range=0..100)
num_columns_54 = Slider(3, range=0..100)
num_columns_55 = Slider(5, range=0..100)
hops = Hops(
    CacheResultsInMemory=True,
    CacheSolveResults=True,
    RemoteSolveVersion=(0, 1, 0),
    ShowInput_Enabled=False,
    ShowInput_Path=False,
    SynchronousSolve=True)
c_script = CSharpScript()  # -> Out, A
ghpython_script_18 = GhPythonScript(
    x=length_18,
    y=width_18,
    z=column_height_19,
    a=column_radius_30,
    b=column_radius_31,
    v=column_height_19,
    m=num_columns_44,
    n=num_columns_45,
    s=num_columns_46)  # -> out, A, B, C, D; inputs m: Int32, n: Int32, s: Int32
# ---------- ghpython_script_18: Python ----------
import rhinoscriptsyntax as rs
import math
import Rhino.Geometry as rg

# Create a Greek temple
def create_greek_temple(length, width, base_height, bottom_column_radius, top_column_radius_ratio, column_height, num_columns_x, num_columns_y, num_steps):
    # create the base with steps
    step_height = base_height / num_steps
    base = []
    for i in range(num_steps):
        base_part = rs.AddBox([
            (-length/2-i*length/(2*num_steps), -width/2-i*width/(2*num_steps), -i*step_height),
            (length/2+i*length/(2*num_steps), -width/2-i*width/(2*num_steps), -i*step_height),
            (length/2+i*length/(2*num_steps), width/2+i*width/(2*num_steps), -i*step_height),
            (-length/2-i*length/(2*num_steps), width/2+i*width/(2*num_steps), -i*step_height),
            (-length/2-i*length/(2*num_steps), -width/2-i*width/(2*num_steps), -(i+1)*step_height),
            (length/2+i*length/(2*num_steps), -width/2-i*width/(2*num_steps), -(i+1)*step_height),
            (length/2+i*length/(2*num_steps), width/2+i*width/(2*num_steps), -(i+1)*step_height),
            (-length/2-i*length/(2*num_steps), width/2+i*width/(2*num_steps), -(i+1)*step_height)
        ])
        base.append(base_part)

    # create the main roof box
    roof_height = base_height/2
    roof_box = rs.AddBox([
        (-length/2, -width/2, base_height + column_height),
        (length/2, -width/2, base_height + column_height),
        (length/2, width/2, base_height + column_height),
        (-length/2, width/2, base_height + column_height),
        (-length/2, -width/2, base_height + column_height + roof_height),
        (length/2, -width/2, base_height + column_height + roof_height),
        (length/2, width/2, base_height + column_height + roof_height),
        (-length/2, width/2, base_height + column_height + roof_height)
    ])
    
    # create the roof with pediments
    apex = (0, 0, base_height + column_height + roof_height * 1.5)

    pediment1 = rs.AddSrfPt([
        rs.coerce3dpoint([-length/2, -width/2, base_height + column_height + roof_height]),
        rs.coerce3dpoint([length/2, -width/2, base_height + column_height + roof_height]),
        rs.coerce3dpoint(apex)
    ])

    pediment2 = rs.AddSrfPt([
        rs.coerce3dpoint([-length/2, width/2, base_height + column_height + roof_height]),
        rs.coerce3dpoint([length/2, width/2, base_height + column_height + roof_height]),
        rs.coerce3dpoint(apex)
    ])

    side1 = rs.AddSrfPt([
        rs.coerce3dpoint([-length/2, -width/2, base_height + column_height + roof_height]),
        rs.coerce3dpoint([-length/2, width/2, base_height + column_height + roof_height]),
        rs.coerce3dpoint(apex)
    ])

    side2 = rs.AddSrfPt([
        rs.coerce3dpoint([length/2, -width/2, base_height + column_height + roof_height]),
        rs.coerce3dpoint([length/2, width/2, base_height + column_height + roof_height]),
        rs.coerce3dpoint(apex)
    ])

    # create tapered columns in a grid
    columns = []
    for i in range(1, num_columns_x - 1):  # columns start and end inside the roof and base
        for j in range(1, num_columns_y - 1):  # columns start and end inside the roof and base
            x = -length/2 + i * (length / (num_columns_x-1))
            y = -width/2 + j * (width / (num_columns_y-1))
            base_pt = rs.CreatePoint(x, y, 0)
            top_pt = rs.CreatePoint(x, y, base_height + column_height)
            bottom_circle = rg.Circle(base_pt, bottom_column_radius)
            top_circle = rg.Circle(top_pt, bottom_column_radius * top_column_radius_ratio)
            bottom_curve = bottom_circle.ToNurbsCurve()
            top_curve = top_circle.ToNurbsCurve()
            loft_type = rg.LoftType.Normal
            loft_rebuild = 0
            loft = rg.Brep.CreateFromLoft([bottom_curve, top_curve], rg.Point3d.Unset, rg.Point3d.Unset, loft_type, False)
            columns.extend(loft)

    roof = [pediment1, pediment2, side1, side2]

    return base, roof, columns, roof_box

# parameters
length = x
width = y
base_height = z
bottom_column_radius = a
top_column_radius_ratio = b 
column_height = v
num_columns_x = m
num_columns_y = n
num_steps = s

base, roof, columns, roof_box = create_greek_temple(length, width, base_height, bottom_column_radius, top_column_radius_ratio, column_height, num_columns_x, num_columns_y, num_steps)

# assign outputs
A = base
B = roof
C = columns
D = roof_box
# ---------- end ghpython_script_18 ----------
# temple
ghpython_script_19 = GhPythonScript(
    x=length_17,
    y=width_17,
    z=column_height_18,
    a=column_radius_28,
    b=column_radius_29,
    v=column_height_18,
    m=num_columns_41,
    n=num_columns_42,
    s=num_columns_43)  # -> out, A, B, C; inputs m: Int32, n: Int32, s: Int32
# ---------- ghpython_script_19: Python ----------
import rhinoscriptsyntax as rs
import math
import Rhino.Geometry as rg

# Create a Greek temple
def create_greek_temple(length, width, base_height, bottom_column_radius, top_column_radius_ratio, column_height, num_columns_x, num_columns_y, num_steps):
    # create the base with steps
    step_height = base_height / num_steps
    base = []
    for i in range(num_steps):
        base_part = rs.AddBox([
            (-length/2-i*length/(2*num_steps), -width/2-i*width/(2*num_steps), -i*step_height),
            (length/2+i*length/(2*num_steps), -width/2-i*width/(2*num_steps), -i*step_height),
            (length/2+i*length/(2*num_steps), width/2+i*width/(2*num_steps), -i*step_height),
            (-length/2-i*length/(2*num_steps), width/2+i*width/(2*num_steps), -i*step_height),
            (-length/2-i*length/(2*num_steps), -width/2-i*width/(2*num_steps), -(i+1)*step_height),
            (length/2+i*length/(2*num_steps), -width/2-i*width/(2*num_steps), -(i+1)*step_height),
            (length/2+i*length/(2*num_steps), width/2+i*width/(2*num_steps), -(i+1)*step_height),
            (-length/2-i*length/(2*num_steps), width/2+i*width/(2*num_steps), -(i+1)*step_height)
        ])
        base.append(base_part)



    # create the roof with pediments
    roof_height = base_height/2
    apex_point = [0, 0, base_height + column_height + roof_height + roof_height/2]

    pediment1 = rs.AddSrfPt([
        rs.coerce3dpoint([-length/2, -width/2, base_height + column_height + roof_height]),
        rs.coerce3dpoint([length/2, -width/2, base_height + column_height + roof_height]),
        rs.coerce3dpoint(apex_point)
    ])

    pediment2 = rs.AddSrfPt([
        rs.coerce3dpoint([-length/2, width/2, base_height + column_height + roof_height]),
        rs.coerce3dpoint([length/2, width/2, base_height + column_height + roof_height]),
        rs.coerce3dpoint(apex_point)
    ])

    side1 = rs.AddSrfPt([
        rs.coerce3dpoint([-length/2, -width/2, base_height + column_height + roof_height]),
        rs.coerce3dpoint([-length/2, width/2, base_height + column_height + roof_height]),
        rs.coerce3dpoint(apex_point)
    ])

    side2 = rs.AddSrfPt([
        rs.coerce3dpoint([length/2, -width/2, base_height + column_height + roof_height]),
        rs.coerce3dpoint([length/2, width/2, base_height + column_height + roof_height]),
        rs.coerce3dpoint(apex_point)
    ])

    # create tapered columns in a grid
    columns = []
    for i in range(int(num_columns_x)):
        for j in range(int(num_columns_y)):
            x = -length/2 + i * (length / (num_columns_x-1))
            y = -width/2 + j * (width / (num_columns_y-1))
            base_pt = rs.CreatePoint(x, y, 0)
            top_pt = rs.CreatePoint(x, y, base_height + column_height)
            bottom_circle = rg.Circle(base_pt, bottom_column_radius)
            top_circle = rg.Circle(top_pt, bottom_column_radius * top_column_radius_ratio)
            bottom_curve = bottom_circle.ToNurbsCurve()
            top_curve = top_circle.ToNurbsCurve()
            loft_type = rg.LoftType.Normal
            loft_rebuild = 0
            loft = rg.Brep.CreateFromLoft([bottom_curve, top_curve], rg.Point3d.Unset, rg.Point3d.Unset, loft_type, False)
            columns.extend(loft)

    roof = [pediment1, pediment2, side1, side2]

    return base, roof, columns

# parameters
length = x
width = y
base_height = z
bottom_column_radius = a
top_column_radius_ratio = b 
column_height = v
num_columns_x = m
num_columns_y = n
num_steps = s

base, roof, columns = create_greek_temple(length, width, base_height, bottom_column_radius, top_column_radius_ratio, column_height, num_columns_x, num_columns_y, num_steps)

# assign outputs
A = base
B = roof
C = columns
# ---------- end ghpython_script_19 ----------
# temple
ghpython_script_20 = GhPythonScript(
    x=length_20,
    y=width_20,
    z=column_height_21,
    a=column_radius_34,
    b=column_radius_35,
    v=column_height_21,
    m=num_columns_50,
    n=num_columns_51,
    s=num_columns_52)  # -> out, A, B, C; inputs m: Int32, n: Int32, s: Int32
# ---------- ghpython_script_20: Python ----------
import rhinoscriptsyntax as rs
import math
import Rhino.Geometry as rg

# Create a Greek temple
def create_greek_temple(length, width, base_height, bottom_column_radius, top_column_radius_ratio, column_height, num_columns_x, num_columns_y, num_steps):
    # create the base with steps
    step_height = base_height / num_steps
    base = []
    for i in range(num_steps):
        base_part = rs.AddBox([
            (-length/2-i*length/(2*num_steps), -width/2-i*width/(2*num_steps), -i*step_height),
            (length/2+i*length/(2*num_steps), -width/2-i*width/(2*num_steps), -i*step_height),
            (length/2+i*length/(2*num_steps), width/2+i*width/(2*num_steps), -i*step_height),
            (-length/2-i*length/(2*num_steps), width/2+i*width/(2*num_steps), -i*step_height),
            (-length/2-i*length/(2*num_steps), -width/2-i*width/(2*num_steps), -(i+1)*step_height),
            (length/2+i*length/(2*num_steps), -width/2-i*width/(2*num_steps), -(i+1)*step_height),
            (length/2+i*length/(2*num_steps), width/2+i*width/(2*num_steps), -(i+1)*step_height),
            (-length/2-i*length/(2*num_steps), width/2+i*width/(2*num_steps), -(i+1)*step_height)
        ])
        base.append(base_part)
    
    # create the roof with pediments
    roof_height = base_height/2
    apex = (0, 0, base_height + column_height + roof_height * 1.5)
    
    pediment1 = rs.AddSrfPt([
        rs.coerce3dpoint([-length/2, -width/2, base_height + column_height + roof_height]),
        rs.coerce3dpoint([length/2, -width/2, base_height + column_height + roof_height]),
        apex
    ])

    pediment2 = rs.AddSrfPt([
        rs.coerce3dpoint([-length/2, width/2, base_height + column_height + roof_height]),
        rs.coerce3dpoint([length/2, width/2, base_height + column_height + roof_height]),
        apex
    ])
    
    side1 = rs.AddSrfPt([
        rs.coerce3dpoint([-length/2, -width/2, base_height + column_height + roof_height]),
        rs.coerce3dpoint([-length/2, width/2, base_height + column_height + roof_height]),
        apex
    ])
    
    side2 = rs.AddSrfPt([
        rs.coerce3dpoint([length/2, -width/2, base_height + column_height + roof_height]),
        rs.coerce3dpoint([length/2, width/2, base_height + column_height + roof_height]),
        apex
    ])
    
    # create tapered columns in a grid
    columns = []
    for i in range(num_columns_x):
        for j in range(num_columns_y):
            x = -length/2 + i * (length / (num_columns_x-1))
            y = -width/2 + j * (width / (num_columns_y-1))
            base_pt = rs.CreatePoint(x, y, 0)
            top_pt = rs.CreatePoint(x, y, base_height + column_height)
            bottom_circle = rg.Circle(base_pt, bottom_column_radius)
            top_circle = rg.Circle(top_pt, bottom_column_radius * top_column_radius_ratio)
            bottom_curve = bottom_circle.ToNurbsCurve()
            top_curve = top_circle.ToNurbsCurve()
            loft_type = rg.LoftType.Normal
            loft_rebuild = 0
            loft = rg.Brep.CreateFromLoft([bottom_curve, top_curve], rg.Point3d.Unset, rg.Point3d.Unset, loft_type, False)
            columns.extend(loft)
    
    roof = [pediment1, pediment2, side1, side2]
    
    return base, roof, columns

# parameters
length = x
width = y
base_height = z
bottom_column_radius = a
top_column_radius_ratio = b 
column_height = v
num_columns_x = m
num_columns_y = n
num_steps = s

base, roof, columns = create_greek_temple(length, width, base_height, bottom_column_radius, top_column_radius_ratio, column_height, num_columns_x, num_columns_y, num_steps)

# assign outputs
A = base
B = roof
C = columns
# ---------- end ghpython_script_20 ----------
# temple
ghpython_script_21 = GhPythonScript(
    x=length_21,
    y=width_21,
    z=column_height_22,
    a=column_radius_36,
    b=column_radius_37,
    v=column_height_22,
    m=num_columns_53,
    n=num_columns_54,
    s=num_columns_55)  # -> out, A, B, C; inputs m: Int32, n: Int32, s: Int32
# ---------- ghpython_script_21: Python ----------
import rhinoscriptsyntax as rs
import math
import Rhino.Geometry as rg

# Create a Greek temple
def create_greek_temple(length, width, base_height, bottom_column_radius, top_column_radius_ratio, column_height, num_columns_x, num_columns_y, num_steps):
    # create the base with steps
    step_height = base_height / num_steps
    base = []
    for i in range(num_steps):
        base_part = rs.AddBox([
            (-length/2-i*length/(2*num_steps), -width/2-i*width/(2*num_steps), -i*step_height),
            (length/2+i*length/(2*num_steps), -width/2-i*width/(2*num_steps), -i*step_height),
            (length/2+i*length/(2*num_steps), width/2+i*width/(2*num_steps), -i*step_height),
            (-length/2-i*length/(2*num_steps), width/2+i*width/(2*num_steps), -i*step_height),
            (-length/2-i*length/(2*num_steps), -width/2-i*width/(2*num_steps), -(i+1)*step_height),
            (length/2+i*length/(2*num_steps), -width/2-i*width/(2*num_steps), -(i+1)*step_height),
            (length/2+i*length/(2*num_steps), width/2+i*width/(2*num_steps), -(i+1)*step_height),
            (-length/2-i*length/(2*num_steps), width/2+i*width/(2*num_steps), -(i+1)*step_height)
        ])
        base.append(base_part)
    
    # create the roof
    roof_height = base_height/2
    roof = []
    roof_base_points = [
        (-length/2, -width/2, base_height + column_height),
        (length/2, -width/2, base_height + column_height),
        (length/2, width/2, base_height + column_height),
        (-length/2, width/2, base_height + column_height)
    ]
    roof_peak_points = [
        (-length/2+roof_height, -width/2, base_height + column_height + roof_height),
        (length/2-roof_height, -width/2, base_height + column_height + roof_height),
        (length/2-roof_height, width/2, base_height + column_height + roof_height),
        (-length/2+roof_height, width/2, base_height + column_height + roof_height)
    ]
    for i in range(4):
        roof.append(rs.AddSrfPt([roof_base_points[i], roof_base_points[(i+1)%4], roof_peak_points[(i+1)%4], roof_peak_points[i]]))

    # create tapered columns in a grid
    columns = []
    for i in range(num_columns_x):
        for j in range(num_columns_y):
            x = -length/2 + i * (length / (num_columns_x-1))
            y = -width/2 + j * (width / (num_columns_y-1))
            base_pt = rs.CreatePoint(x, y, base_height)
            top_pt = rs.CreatePoint(x, y, base_height + column_height)
            bottom_circle = rg.Circle(base_pt, bottom_column_radius)
            top_circle = rg.Circle(top_pt, bottom_column_radius * top_column_radius_ratio)
            bottom_curve = bottom_circle.ToNurbsCurve()
            top_curve = top_circle.ToNurbsCurve()
            loft_type = rg.LoftType.Normal
            loft_rebuild = 0
            loft = rg.Brep.CreateFromLoft([bottom_curve, top_curve], rg.Point3d.Unset, rg.Point3d.Unset, loft_type, False)
            columns.extend(loft)

    return base, roof, columns

# parameters
length = x
width = y
base_height = z
bottom_column_radius = a
top_column_radius_ratio = b # this is now a ratio of the top radius to the bottom radius
column_height = v
num_columns_x = m
num_columns_y = n
num_steps = s

base, roof, columns = create_greek_temple(length, width, base_height, bottom_column_radius, top_column_radius_ratio, column_height, num_columns_x, num_columns_y, num_steps)

# assign outputs
A = base
B = roof
C = columns
# ---------- end ghpython_script_21 ----------
# temple
ghpython_script_22 = GhPythonScript(
    x=length_19,
    y=width_19,
    z=column_height_20,
    a=column_radius_33,
    b=column_radius_32,
    v=column_height_20,
    m=num_columns_47,
    n=num_columns_48,
    s=num_columns_49)  # -> out, A, B, C; inputs m: Int32, n: Int32, s: Int32
# ---------- ghpython_script_22: Python ----------
import rhinoscriptsyntax as rs
import math
import Rhino.Geometry as rg

# parameters
length = 50
width = 25
base_height = 10
bottom_column_radius = 2
top_column_radius_ratio = 0.8
column_height = 30
num_columns_x = 8
num_columns_y = 4
num_steps = 5

# Create a Greek temple
def create_greek_temple(length, width, base_height, bottom_column_radius, top_column_radius_ratio, column_height, num_columns_x, num_columns_y, num_steps):
    # create the base with steps
    step_height = base_height / num_steps
    base = []
    for i in range(num_steps):
        base_part = rs.AddBox([
            (-length/2-i*length/(2*num_steps), -width/2-i*width/(2*num_steps), -i*step_height),
            (length/2+i*length/(2*num_steps), -width/2-i*width/(2*num_steps), -i*step_height),
            (length/2+i*length/(2*num_steps), width/2+i*width/(2*num_steps), -i*step_height),
            (-length/2-i*length/(2*num_steps), width/2+i*width/(2*num_steps), -i*step_height),
            (-length/2-i*length/(2*num_steps), -width/2-i*width/(2*num_steps), -(i+1)*step_height),
            (length/2+i*length/(2*num_steps), -width/2-i*width/(2*num_steps), -(i+1)*step_height),
            (length/2+i*length/(2*num_steps), width/2+i*width/(2*num_steps), -(i+1)*step_height),
            (-length/2-i*length/(2*num_steps), width/2+i*width/(2*num_steps), -(i+1)*step_height)
        ])
        base.append(base_part)
    
    # create the roof
    roof_height = base_height/2
    roof_apex = (0, 0, base_height + column_height + roof_height * 1.5) # All sides will meet at this apex point
    roof = []
    for i in range(4):
        roof_face_points = [
            (-length/2, -width/2, base_height + column_height),
            (length/2, -width/2, base_height + column_height),
            (length/2, width/2, base_height + column_height),
            (-length/2, width/2, base_height + column_height)
        ]
        roof.append(rs.AddSrfPt([roof_face_points[i], roof_face_points[(i+1)%4], roof_apex]))

    # create tapered columns in a grid
    columns = []
    for i in range(num_columns_x):
        for j in range(num_columns_y):
            x = -length/2 + i * (length / (num_columns_x-1))
            y = -width/2 + j * (width / (num_columns_y-1))
            base_pt = rs.CreatePoint(x, y, base_height)
            top_pt = rs.CreatePoint(x, y, base_height + column_height)
            bottom_circle = rg.Circle(base_pt, bottom_column_radius)
            top_circle = rg.Circle(top_pt, bottom_column_radius * top_column_radius_ratio)
            column = rs.AddLoftSrf([rs.coercecurve(bottom_circle.ToNurbsCurve()), rs.coercecurve(top_circle.ToNurbsCurve())])
            columns.append(column)

    return base, roof, columns

base, roof, columns = create_greek_temple(length, width, base_height, bottom_column_radius, top_column_radius_ratio, column_height, num_columns_x, num_columns_y, num_steps)

# assign outputs
A = base
B = roof
C = columns
# ---------- end ghpython_script_22 ----------
gh_python_remote = GHPythonRemote()  # -> out, linked_modules, rpy, import_statements
geometry_54 = Geometry(ghpython_script_19.A)
geometry_55 = Geometry(ghpython_script_19.B)
geometry_56 = Geometry(ghpython_script_19.C)
geometry_57 = Geometry(ghpython_script_22.A)
geometry_58 = Geometry(ghpython_script_22.B)
geometry_59 = Geometry(ghpython_script_22.C)
geometry_60 = Geometry(ghpython_script_18.C)
geometry_61 = Geometry(ghpython_script_18.A)
geometry_62 = Geometry(ghpython_script_18.B)
geometry_63 = Geometry(ghpython_script_18.D)
geometry_64 = Geometry(ghpython_script_20.A)
geometry_65 = Geometry(ghpython_script_20.B)
geometry_66 = Geometry(ghpython_script_21.A)
geometry_67 = Geometry(ghpython_script_20.C)
geometry_68 = Geometry(ghpython_script_21.B)
geometry_69 = Geometry(ghpython_script_21.C)
panel_18 = Panel(ghpython_script_19.out)
panel_19 = Panel(ghpython_script_18.out)
panel_20 = Panel(ghpython_script_22.out)
panel_21 = Panel(ghpython_script_20.out)
panel_22 = Panel(ghpython_script_21.out)

# ==== cluster GHPythonRemote: Connects the Grasshopper Python component to an external Python instance.
python = PythonScript()  # -> default_working_dir
# ---------- python: Python ----------
from os import path
from Grasshopper.Folders import UserObjectFolders

cluster_comp = ghenv.Component.OnPingDocument().Owner
parent_doc_path = cluster_comp.OnPingDocument().FilePath

if parent_doc_path is not None:
    # Get path to parent GH document
    default_working_dir = path.abspath(path.dirname(parent_doc_path))
else:
    # Fallback to path to user objects default dir
    uo_folder = path.abspath(UserObjectFolders[0])
    if path.isdir(path.join(uo_folder, "gh-python-remote")):
        uo_folder = path.abspath(path.join(uo_folder, "gh-python-remote"))
    default_working_dir = uo_folder
# ---------- end python ----------
# GH to python remote example.
# ⓒ Pierre Cuvilliers, 2017-2022
# Released under the MIT license
# github.com/pilcru/ghpythonremote
# Runs and connects to an external python engine, and
# assigns imported modules to scriptcontext.sticky variables.
# 
# Arguments:
#       code (str): Path to the GH_to_python_sticky.py code file.
#       location (str): Path to a python executable, or to a folder
#             containing `python.exe`, or the name of a conda-created
#             virtual environment prefixed by `conda://` (`conda://env_name`).
#             If empty, finds python from your windows %PATH%.
#       run (boolean): Creates the connection, and imports new
#             modules, when turned to True. Kills the connection,
#             and deletes the references to the imports, when turned
#             to False.
#       modules (str list): List of module names to import in the
#             remote python. They will be added to the
#             scriptcontext.sticky dictionary, allowing them to be
#             reused from other python components in the same
#             Grasshopper document. Submodules (for example
#             `numpy.linalg` have to be added explicitly to this list
#             to be available later.
#       log_level (str from ['NOTSET', 'DEBUG', 'INFO', 'WARNING', 'ERROR', 'CRITICAL']):
#             Logging level to use for the local IronPython and the
#             remote python instance.
#       working_dir (str): Working directory for the remote python
#             instance.
# 
# Returns:
#       out (str): Console output with DEBUG information.
#       linked_modules (str list): list of imported module names.
#       rpy (rpyc connection object): The object representing the
#             remote Python interpreter.
location = ClusterInput()  # location (str): Path to a python executable, or to a folder containing `python.exe`, or the name of a conda-created virtual environment prefixed by `conda://` (`conda://env_name`). If empty, finds python from your windows %PATH%.
run = ClusterInput()  # run (boolean): Creates the connection, and imports new modules, when turned to True. Kills the connection,and deletes the references to the imports, when turned to False.
modules = ClusterInput()  # modules (str list): List of module names to import in the remote python. They will be added to the scriptcontext.sticky dictionary, allowing them to be reused from other python components in the same Grasshopper document. Submodules (for example `numpy.linalg` have to be added explicitly to this list to be available later.
list = ValueList({"CRITICAL", "ERROR", "WARNING", "INFO", "DEBUG", "NOTSET"}, selected="DEBUG")
panel = Panel(python)
ghpythonremote = GHPythonRemote(location=location, run=run, modules=modules, log_level=list, working_dir=panel)  # -> out, linked_modules, rpy; inputs run: Boolean, modules: list
# ---------- ghpythonremote: Python ----------
import inspect
import logging
from os import path
import sys
from time import sleep

import scriptcontext

import ghpythonremote
from ghpythonremote.connectors import GrasshopperToPythonRemote
from Grasshopper.Kernel.GH_RuntimeMessageLevel import Error, Warning

local_log_level = getattr(logging, log_level, logging.WARNING)
logger = logging.getLogger("ghpythonremote")
logger.setLevel(local_log_level)
ch = logging.StreamHandler()
ch.setLevel(local_log_level)
formatter = logging.Formatter("%(levelname)s: %(name)s:\n%(message)s")
ch.setFormatter(formatter)
logger.handlers = []
logger.addHandler(ch)
logger = logging.getLogger("ghpythonremote.GH_to_python")

ROOT = path.abspath(path.dirname(inspect.getfile(ghpythonremote)))
rpyc_server_py = path.join(ROOT, "pythonservice.py")

cluster_comp = ghenv.Component.OnPingDocument().Owner

# Set connection to CLOSED if this is the first run
# and initialize set of linked modules
try:
    remote_python_status
except NameError:
    remote_python_status = "CLOSED"
    lkd_modules = set()

# Wait for connection to connect or terminate
timer = 0
while remote_python_status == "CONNECTING" or remote_python_status == "CLOSING":
    sleep(1)
    timer += 1
    if timer == 10:
        try:
            gh2py_manager.__exit__(*sys.exc_info())
        except Exception:
            pass
        remote_python_status = "CLOSED"
        lkd_modules = set()
        message = (
            "Connection left in an inconsistent state and not returning. Reset "
            "everything."
        )
        if cluster_comp is not None:
            cluster_comp.AddRuntimeMessage(Warning, message)
        raise RuntimeError(message)

if run:
    if not remote_python_status == "OPEN":
        remote_python_status = "CONNECTING"
        gh2py_manager = GrasshopperToPythonRemote(
            rpyc_server_py,
            location=location,
            timeout=10,
            port=None,
            log_level=log_level,
            working_dir=working_dir,
        )
        gh2py = gh2py_manager.__enter__()
        remote_python_status = "OPEN"

    # Stuff that we can reach
    rpymod = gh2py.py_remote_modules  # A getter function for a named python module
    rpy = gh2py.connection  # Represents the remote instance root object
    scriptcontext.sticky["rpy"] = rpy
    # Add modules
    for mod in modules:
        try:
            scriptcontext.sticky[mod] = rpymod(mod)
            lkd_modules.add(mod)
        except ImportError:
            gh2py_manager.__exit__(*sys.exc_info())
            if cluster_comp is not None:
                cluster_comp.AddRuntimeMessage(
                    Error,
                    'Could not import module "{}" in remote Python.'.format(mod)
                )
            raise
        except EOFError:
            if cluster_comp is not None:
                cluster_comp.AddRuntimeMessage(
                    Error,
                    'Remote Python has been closed unexpectedly'
                )
            raise

elif not remote_python_status == "CLOSED":
    remote_python_status = "CLOSING"
    # Remove linked modules
    for mod in lkd_modules:
        del scriptcontext.sticky[mod]
    del scriptcontext.sticky["rpy"]
    gh2py_manager.__exit__(*sys.exc_info())
    lkd_modules = set()
    remote_python_status = "CLOSED"

# Change variable name because ghpython resets outputs to None before each run
linked_modules = lkd_modules

logger.info("GH to python connection is {}".format(remote_python_status))
# ---------- end ghpythonremote ----------
out = ClusterOutput(ghpythonremote.out)  # Console output.
linked_modules = ClusterOutput(ghpythonremote.linked_modules)  # Names of modules that were successfully added to the scriptcontext.sticky dictionary.
rpy = ClusterOutput(ghpythonremote.rpy)  # The object representing the remote python instance
python_2 = PythonScript(module_names=ghpythonremote.linked_modules)  # -> import_statements; inputs module_names: list
# ---------- python_2: Python ----------
import_statements = ["import scriptcontext as sc"]
for module_name in module_names:
    import_statements.append("{0} = sc.sticky['{0}']".format(module_name))

if len(module_names) == 0:
    import_statements = []
# ---------- end python_2 ----------
import_statements = ClusterOutput(python_2)  # Useful import statements to use the imported modules in your scripts.
