# Grasshopper definition wafflePattern_001.gh (Grasshopper 1.0.7)

# Architectural Parametric
# Digital Assets
# gpt-4 into ghpython node
# #Text prompting in GPT-4 at www.wickersonstudios.com
number_slider = Slider(0.1, range=0.1..10)
number_slider_2 = Slider(0.1, range=0.1..10)
number_slider_3 = Slider(3, range=0.1..3)
# Waffle Pattern
ghpython_script = GhPythonScript()  # -> out, a
# ---------- ghpython_script: Python ----------
import Rhino
import scriptcontext
import rhinoscriptsyntax as rs
import math

# input parameters
weave_length = 10  # length of the weave
weave_width = 5  # width of the weave
weave_height = 3  # height of the weave
weave_res = 50  # resolution of the weave (number of points)

# create an empty list to store the curves
curves = []

# loop over the width of the weave
for i in range(weave_width):
    # create an empty list to store the points for this curve
    points = []
    
    # loop over the length of the weave
    for j in range(weave_res):
        # calculate the x, y, and z coordinates
        x = i
        y = j / float(weave_res) * weave_length
        z = weave_height * math.sin(2 * math.pi * y / weave_length)
        
        # if i is even, shift z upwards by weave_height / 2
        if i % 2 == 0:
            z += weave_height / 2
            
        # create a point at the calculated coordinates and add it to the list
        point = Rhino.Geometry.Point3d(x, y, z)
        points.append(point)
        
    # create a curve through the points and add it to the list
    curve = Rhino.Geometry.Curve.CreateInterpolatedCurve(points, 3)
    curves.append(curve)

# create a Brep from the curves
brep = Rhino.Geometry.Brep.CreateFromLoft(curves, Rhino.Geometry.Point3d.Unset, Rhino.Geometry.Point3d.Unset, Rhino.Geometry.LoftType.Normal, False)

# assign the Brep to the output
a = brep
# ---------- end ghpython_script ----------
panel = Panel(ghpython_script.out)
geometry = Geometry(ghpython_script.a)
